# Dynamo graph 04_estructura.dyn (Dynamo 4.0.0.0)
# Crea columnas (con reducción de sección), vigas y zapatas aisladas según CIRSOC 201-2005.

frente_m = CodeBlock { 10.0 }
fondo_m = CodeBlock { 24.0 }
lado_col_cm = CodeBlock { 35 }
pisos_tipo = CodeBlock { 6 }
nombre_col = CodeBlock { "Columna HA 35x35cm" }
crear_columnas_v2 = Python()  # PythonNet3; unwired: IN[0], IN[1], IN[2], IN[3], IN[4]
# ---------- crear_columnas_v2.python (93 lines) ----------
import clr
clr.AddReference("RevitAPI")
from Autodesk.Revit.DB import (
    FamilySymbol, Level, XYZ,
    FilteredElementCollector, BuiltInCategory,
    Transaction, UnitUtils, UnitTypeId,
)
from Autodesk.Revit.DB.Structure import StructuralType
clr.AddReference("RevitServices")
from RevitServices.Persistence import DocumentManager

doc = DocumentManager.Instance.CurrentDBDocument

frente_m        = float(IN[0])
fondo_m         = float(IN[1])
lado_col_cm     = float(IN[2])
pisos_tipo      = int(IN[3])
nombre_col_tipo = str(IN[4])
paso_m          = 5.0

def m_to_ft(m):
    return UnitUtils.ConvertToInternalUnits(m, UnitTypeId.Meters)

def get_col_symbol():
    col = (FilteredElementCollector(doc)
           .OfClass(FamilySymbol)
           .OfCategory(BuiltInCategory.OST_StructuralColumns)
           .ToElements())
    match = next((s for s in col if s.Name == nombre_col_tipo), None)
    if match:
        return match
    _kw = ("concrete","hormigon","hormigón","ha ","h.a","rectangular")
    match = next((s for s in col if any(k in s.FamilyName.lower() for k in _kw)), None)
    return match or (col[0] if col else None)

def get_level(nombre):
    levels = FilteredElementCollector(doc).OfClass(Level).ToElements()
    return next((l for l in levels if l.Name == nombre), None)            or sorted(levels, key=lambda l: l.Elevation)[0]

def set_section(sym, lado_m):
    lado_ft = m_to_ft(lado_m)
    for n in ("b","Ancho","Width","w"):
        p = sym.LookupParameter(n)
        if p and not p.IsReadOnly:
            try: p.Set(lado_ft); break
            except Exception: pass
    for n in ("h","Alto","Depth","d"):
        p = sym.LookupParameter(n)
        if p and not p.IsReadOnly:
            try: p.Set(lado_ft); break
            except Exception: pass

# ── Reducción de sección en altura: CIRSOC 201 — pisos altos tienen menos carga ──
# Pisos 1..n/2: sección base; pisos n/2+1..n: sección reducida (−5cm)
lado_inf_m = lado_col_cm / 100.0
lado_sup_m = max(0.25, lado_inf_m - 0.05)
piso_corte = pisos_tipo // 2 + 1   # piso desde donde se reduce

sym = get_col_symbol()
columnas = []

if sym:
    set_section(sym, lado_inf_m)
    if not sym.IsActive:
        sym.Activate()

    with Transaction(doc, "py-building-gen: Columnas v2") as t:
        t.Start()
        for idx_piso, nombre_nivel in enumerate(
            ["PB"] + [f"P{i:02d}" for i in range(1, pisos_tipo + 1)]
        ):
            lvl = get_level(nombre_nivel)
            # Reducción de sección para pisos superiores
            if idx_piso >= piso_corte:
                set_section(sym, lado_sup_m)
            else:
                set_section(sym, lado_inf_m)
            x = 0.0
            while x <= frente_m + 0.001:
                y = 0.0
                while y <= fondo_m + 0.001:
                    pt = XYZ(m_to_ft(x), m_to_ft(y), 0)
                    inst = doc.Create.NewFamilyInstance(pt, sym, lvl, StructuralType.Column)
                    columnas.append(inst.Id.Value)
                    y += paso_m
                x += paso_m
        t.Commit()

OUT = {
    "total": len(columnas),
    "seccion_inferior": f"{lado_inf_m*100:.0f}x{lado_inf_m*100:.0f}cm (pisos 1-{piso_corte-1})",
    "seccion_superior": f"{lado_sup_m*100:.0f}x{lado_sup_m*100:.0f}cm (pisos {piso_corte}-{pisos_tipo})",
}
# ----------------------------------------
frente_m_2 = CodeBlock { 10.0 }
fondo_m_2 = CodeBlock { 24.0 }
ancho_viga_cm = CodeBlock { 45 }
alto_viga_cm = CodeBlock { 85 }
pisos_tipo_2 = CodeBlock { 6 }
nombre_viga = CodeBlock { "Viga HA 45x85cm" }
crear_vigas = Python()  # PythonNet3; unwired: IN[0], IN[1], IN[2], IN[3], IN[4], IN[5]
# ---------- crear_vigas.python (93 lines) ----------
import clr
clr.AddReference("RevitAPI")
from Autodesk.Revit.DB import (
    FamilySymbol, Level, XYZ, Line,
    FilteredElementCollector, BuiltInCategory,
    Transaction, UnitUtils, UnitTypeId,
)
from Autodesk.Revit.DB.Structure import StructuralType

clr.AddReference("RevitServices")
from RevitServices.Persistence import DocumentManager
doc  = DocumentManager.Instance.CurrentDBDocument

frente_m        = float(IN[0])
fondo_m         = float(IN[1])
ancho_cm        = float(IN[2])
alto_cm         = float(IN[3])
pisos_tipo      = int(IN[4])
nombre_viga_tipo = str(IN[5])   # "Viga HA 45x85cm"  (creado por 00_familias.dyn)
paso_m          = 5.0

def m_to_ft(m):
    return UnitUtils.ConvertToInternalUnits(m, UnitTypeId.Meters)

def get_beam_symbol():
    col = (FilteredElementCollector(doc)
           .OfClass(FamilySymbol)
           .OfCategory(BuiltInCategory.OST_StructuralFraming)
           .ToElements())
    # 1° intento: tipo exacto creado por 00_familias.dyn
    match = next((s for s in col if s.Name == nombre_viga_tipo), None)
    if match:
        return match
    # 2° intento: familia con keyword de hormigón
    _kw = ("concrete", "hormigon", "hormigón", "ha ", "h.a")
    match = next((s for s in col if any(k in s.FamilyName.lower() for k in _kw)), None)
    return match or (col[0] if col else None)

def get_level(nombre):
    levels = FilteredElementCollector(doc).OfClass(Level).ToElements()
    match = next((l for l in levels if l.Name == nombre), None)
    return match or sorted(levels, key=lambda l: l.Elevation)[0]

sym = get_beam_symbol()
vigas = []

if sym:
    try:
        sym.LookupParameter("b").Set(m_to_ft(ancho_cm / 100))
        sym.LookupParameter("h").Set(m_to_ft(alto_cm  / 100))
    except Exception:
        pass

    if not sym.IsActive:
        sym.Activate()

    with Transaction(doc, "py-building-gen: Vigas") as t:
        t.Start()

        for nombre_nivel in [f"P{i:02d}" for i in range(1, pisos_tipo + 1)]:
            lvl = get_level(nombre_nivel)

            # Vigas en dirección X (paralelas al frente) — una por eje Y
            y = 0.0
            while y <= fondo_m + 0.001:
                x = 0.0
                while x + paso_m <= frente_m + 0.001:
                    p1 = XYZ(m_to_ft(x),        m_to_ft(y), 0)
                    p2 = XYZ(m_to_ft(x + paso_m), m_to_ft(y), 0)
                    inst = doc.Create.NewFamilyInstance(
                        Line.CreateBound(p1, p2), sym, lvl, StructuralType.Beam
                    )
                    vigas.append(inst.Id.IntegerValue)
                    x += paso_m
                y += paso_m

            # Vigas en dirección Y (paralelas al fondo)
            x = 0.0
            while x <= frente_m + 0.001:
                y = 0.0
                while y + paso_m <= fondo_m + 0.001:
                    p1 = XYZ(m_to_ft(x), m_to_ft(y),        0)
                    p2 = XYZ(m_to_ft(x), m_to_ft(y + paso_m), 0)
                    inst = doc.Create.NewFamilyInstance(
                        Line.CreateBound(p1, p2), sym, lvl, StructuralType.Beam
                    )
                    vigas.append(inst.Id.IntegerValue)
                    y += paso_m
                x += paso_m

        t.Commit()

OUT = {"total_vigas": len(vigas), "seccion": f"{ancho_cm:.0f}x{alto_cm:.0f}cm"}
# ----------------------------------------
frente_m_3 = CodeBlock { 10.0 }
fondo_m_3 = CodeBlock { 24.0 }
ancho_vf_cm = CodeBlock { 45 }
alto_vf_cm = CodeBlock { 85 }
tiene_subsuelo = CodeBlock { false }
nombre_viga_2 = CodeBlock { "Viga HA 45x85cm" }
vigas_de_fundación = Python()  # PythonNet3; unwired: IN[0], IN[1], IN[2], IN[3], IN[4], IN[5]
# ---------- vigas_de_fundación.python (85 lines) ----------
import clr
clr.AddReference("RevitAPI")
from Autodesk.Revit.DB import (
    FamilySymbol, Level, XYZ, Line,
    FilteredElementCollector, BuiltInCategory,
    Transaction, UnitUtils, UnitTypeId,
)
from Autodesk.Revit.DB.Structure import StructuralType
clr.AddReference("RevitServices")
from RevitServices.Persistence import DocumentManager

doc = DocumentManager.Instance.CurrentDBDocument

frente_m        = float(IN[0])
fondo_m         = float(IN[1])
ancho_vf_cm     = float(IN[2])   # sección viga de fundación (CIRSOC: ≥ 30×60cm)
alto_vf_cm      = float(IN[3])
tiene_subsuelo  = bool(IN[4])
nombre_viga_tipo = str(IN[5])
paso_m          = 5.0
Z_OFFSET        = -0.30           # m — centro viga a 30cm bajo nivel de fundación

def m_to_ft(m):
    return UnitUtils.ConvertToInternalUnits(m, UnitTypeId.Meters)

def get_beam_symbol():
    col = (FilteredElementCollector(doc)
           .OfClass(FamilySymbol)
           .OfCategory(BuiltInCategory.OST_StructuralFraming)
           .ToElements())
    match = next((s for s in col if s.Name == nombre_viga_tipo), None)
    if match: return match
    _kw = ("concrete","hormigon","hormigón","ha ","h.a","rectangular")
    return next((s for s in col if any(k in s.FamilyName.lower() for k in _kw)), col[0] if col else None)

def get_level(nombre):
    levels = FilteredElementCollector(doc).OfClass(Level).ToElements()
    return next((l for l in levels if l.Name == nombre), None)            or sorted(levels, key=lambda l: l.Elevation)[0]

sym = get_beam_symbol()
vigas_fund = []

if sym:
    try:
        sym.LookupParameter("b").Set(m_to_ft(ancho_vf_cm / 100))
        sym.LookupParameter("h").Set(m_to_ft(alto_vf_cm  / 100))
    except Exception:
        pass
    if not sym.IsActive:
        sym.Activate()

    lvl_fund = get_level("SS01" if tiene_subsuelo else "PB")

    with Transaction(doc, "py-building-gen: Vigas de fundación") as t:
        t.Start()
        z = m_to_ft(Z_OFFSET)

        # Dirección X (paralelas al frente)
        y = 0.0
        while y <= fondo_m + 0.001:
            x = 0.0
            while x + paso_m <= frente_m + 0.001:
                p1 = XYZ(m_to_ft(x),          m_to_ft(y), z)
                p2 = XYZ(m_to_ft(x + paso_m), m_to_ft(y), z)
                inst = doc.Create.NewFamilyInstance(Line.CreateBound(p1, p2), sym, lvl_fund, StructuralType.Beam)
                vigas_fund.append(inst.Id.Value)
                x += paso_m
            y += paso_m

        # Dirección Y (paralelas al fondo)
        x = 0.0
        while x <= frente_m + 0.001:
            y = 0.0
            while y + paso_m <= fondo_m + 0.001:
                p1 = XYZ(m_to_ft(x), m_to_ft(y),          z)
                p2 = XYZ(m_to_ft(x), m_to_ft(y + paso_m), z)
                inst = doc.Create.NewFamilyInstance(Line.CreateBound(p1, p2), sym, lvl_fund, StructuralType.Beam)
                vigas_fund.append(inst.Id.Value)
                y += paso_m
            x += paso_m

        t.Commit()

OUT = {"total_vf": len(vigas_fund), "nivel": "SS01" if tiene_subsuelo else "PB",
       "seccion": f"{ancho_vf_cm:.0f}x{alto_vf_cm:.0f}cm"}
# ----------------------------------------
frente_m_4 = CodeBlock { 10.0 }
fondo_m_4 = CodeBlock { 24.0 }
lado_zapata_cm = CodeBlock { 120 }
altura_pb_m = CodeBlock { 3.5 }
tiene_subsuelo_2 = CodeBlock { false }
crear_zapatas = Python()  # PythonNet3; unwired: IN[0], IN[1], IN[2], IN[3], IN[4]
# ---------- crear_zapatas.python (77 lines) ----------
import clr
clr.AddReference("RevitAPI")
from Autodesk.Revit.DB import (
    FamilySymbol, Level, XYZ,
    FilteredElementCollector, BuiltInCategory,
    Transaction, UnitUtils, UnitTypeId,
)
from Autodesk.Revit.DB.Structure import StructuralType
clr.AddReference("RevitServices")
from RevitServices.Persistence import DocumentManager

doc = DocumentManager.Instance.CurrentDBDocument

frente_m       = float(IN[0])
fondo_m        = float(IN[1])
lado_zapata_cm = float(IN[2])   # lado de la zapata cuadrada (predimensionado)
altura_pb      = float(IN[3])
tiene_subsuelo = bool(IN[4])
paso_m         = 5.0

def m_to_ft(m):
    return UnitUtils.ConvertToInternalUnits(m, UnitTypeId.Meters)

def get_foundation_sym():
    col = (FilteredElementCollector(doc)
           .OfClass(FamilySymbol)
           .OfCategory(BuiltInCategory.OST_StructuralFoundation)
           .ToElements())
    _kw = ("pad","isolated","zapata","footing","aislada","foundation")
    match = next((s for s in col if any(k in s.FamilyName.lower() for k in _kw)), None)
    return match or (col[0] if col else None)

def get_level(nombre):
    levels = FilteredElementCollector(doc).OfClass(Level).ToElements()
    return next((l for l in levels if l.Name == nombre), None)            or sorted(levels, key=lambda l: l.Elevation)[0]

sym = get_foundation_sym()
zapatas = []

if sym:
    # Tamaño de zapata
    lado_ft = m_to_ft(lado_zapata_cm / 100.0)
    for n in ("Width","Ancho","b","w","Length","Largo"):
        p = sym.LookupParameter(n)
        if p and not p.IsReadOnly:
            try: p.Set(lado_ft)
            except Exception: pass
    for n in ("Thickness","Espesor","h","d","Depth"):
        p = sym.LookupParameter(n)
        if p and not p.IsReadOnly:
            try: p.Set(m_to_ft(0.50)); break   # espesor zapata: 0.50m
            except Exception: pass
    if not sym.IsActive:
        sym.Activate()

    # Nivel de fundación: PB si no hay subsuelo, SS01 si hay
    nom_fund = "SS01" if tiene_subsuelo else "PB"
    lvl_fund = get_level(nom_fund)

    with Transaction(doc, "py-building-gen: Zapatas") as t:
        t.Start()
        x = 0.0
        while x <= frente_m + 0.001:
            y = 0.0
            while y <= fondo_m + 0.001:
                pt = XYZ(m_to_ft(x), m_to_ft(y), 0)
                inst = doc.Create.NewFamilyInstance(pt, sym, lvl_fund, StructuralType.Footing)
                zapatas.append(inst.Id.Value)
                y += paso_m
            x += paso_m
        t.Commit()

OUT = {
    "total": len(zapatas),
    "lado_cm": lado_zapata_cm,
    "nivel": nom_fund,
}
# ----------------------------------------
