# Dynamo graph 05_aberturas.dyn (Dynamo 4.0.0.0)
# Coloca ventanas de living y dormitorios en fachada, puertas de acceso a deptos y puertas interiores.

frente_m = CodeBlock { 10.0; }
fondo_m = CodeBlock { 24.0; }
altura_tipo_m = CodeBlock { 2.8; }
pisos_tipo = CodeBlock { 6; }
cant_depto_tipo = CodeBlock { 2; }
tipologias = CodeBlock { "2amb:1,3amb:1"; }
cant_escaleras = CodeBlock { 1; }
cant_ascensores = CodeBlock { 1; }
crear_aberturas_v2 = Python(IN[0]=frente_m, IN[1]=fondo_m, IN[2]=altura_tipo_m, IN[3]=pisos_tipo, IN[4]=cant_depto_tipo, IN[5]=tipologias, IN[6]=cant_escaleras, IN[7]=cant_ascensores)  # PythonNet3
# ---------- crear_aberturas_v2.python (180 lines) ----------
def _fi(v, d=0.0): return float(v) if v is not None else float(d)
def _ii(v, d=0):   return int(v)   if v is not None else int(d)
def _si(v, d=""):  return str(v)   if v is not None else str(d)
import clr
import json
clr.AddReference("RevitAPI")
from Autodesk.Revit.DB import (
    FamilySymbol, Wall, Level,
    FilteredElementCollector, BuiltInCategory,
    Transaction, XYZ, UnitUtils, UnitTypeId,
)
from Autodesk.Revit.DB.Structure import StructuralType as ST
clr.AddReference("RevitServices")
from RevitServices.Persistence import DocumentManager

doc = DocumentManager.Instance.CurrentDBDocument

frente_m        = _fi(IN[0])
fondo_m         = _fi(IN[1])
altura_tipo     = _fi(IN[2])
pisos_tipo      = _ii(IN[3])
cant_depto_tipo = _ii(IN[4])
tipologias_str  = _si(IN[5])   # "2amb:1,3amb:1" (quote-free para Code Block)
cant_escaleras  = _ii(IN[6])
cant_ascensores = _ii(IN[7])

apts = []
for _par in tipologias_str.split(","):
    _par = _par.strip()
    if not _par:
        continue
    _tipo, _, _cant = _par.partition(":")
    _tipo = _tipo.strip() or "2amb"
    try:
        _n = int(_cant)
    except Exception:
        _n = 1
    for _ in range(_n):
        apts.append(_tipo)

# ── Layout geometry (same constants as Script 02) ─────────────────────────────
ESC_ANCHO = 3.00; ESC_FONDO = 5.50; ASC_ANCHO = 2.00; PASILLO_PROF = 1.20
_n_apts      = max(cant_depto_tipo, 1)
ancho_nucleo = cant_escaleras * ESC_ANCHO + cant_ascensores * ASC_ANCHO
y_nucleo     = fondo_m - ESC_FONDO
y_pasillo    = y_nucleo - PASILLO_PROF
apt_ancho    = frente_m / _n_apts

_PROP_LIVING = {"1amb":0.00,"estudio":0.00,"2amb":0.40,"3amb":0.38,"4amb":0.35,"duplex":0.35}

# ── Helpers ───────────────────────────────────────────────────────────────────
def m_to_ft(m):
    return UnitUtils.ConvertToInternalUnits(m, UnitTypeId.Meters)

def ft_to_m(ft):
    return UnitUtils.ConvertFromInternalUnits(ft, UnitTypeId.Meters)

def get_sym(categoria, keywords):
    col = FilteredElementCollector(doc).OfClass(FamilySymbol).OfCategory(categoria).ToElements()
    match = next((s for s in col if any(k in s.FamilyName.lower() for k in keywords)), None)
    return match or (col[0] if col else None)

def get_level(nombre):
    levels = FilteredElementCollector(doc).OfClass(Level).ToElements()
    return next((l for l in levels if l.Name == nombre), None)

def find_wall_at_y(lvl_id, target_y, tol=0.40):
    """Primer muro horizontal (paralelo a X) con ambos extremos a y ≈ target_y."""
    for w in FilteredElementCollector(doc).OfClass(Wall).ToElements():
        if w.LevelId != lvl_id:
            continue
        loc = w.Location
        if not hasattr(loc, "Curve"):
            continue
        c = loc.Curve
        y1 = ft_to_m(c.GetEndPoint(0).Y)
        y2 = ft_to_m(c.GetEndPoint(1).Y)
        if abs(y1 - target_y) < tol and abs(y2 - target_y) < tol:
            return w
    return None

def set_size(inst, ancho_m, alto_m):
    for name in ("Width", "Ancho", "w", "b"):
        p = inst.LookupParameter(name)
        if p and not p.IsReadOnly:
            try: p.Set(m_to_ft(ancho_m)); break
            except Exception: pass
    for name in ("Height", "Alto", "h", "Height 1"):
        p = inst.LookupParameter(name)
        if p and not p.IsReadOnly:
            try: p.Set(m_to_ft(alto_m)); break
            except Exception: pass

def place(sym, wall, lvl, x, y, z=0.0):
    if wall is None or sym is None:
        return None
    pt = XYZ(m_to_ft(x), m_to_ft(y), m_to_ft(z))
    try:
        return doc.Create.NewFamilyInstance(pt, sym, wall, lvl, ST.NonStructural)
    except Exception:
        return None

# ── Symbols ───────────────────────────────────────────────────────────────────
sym_p = get_sym(BuiltInCategory.OST_Doors,   ("door","puerta","single","simple","entry"))
sym_v = get_sym(BuiltInCategory.OST_Windows, ("window","ventana","fixed","fija","casement"))

aberturas = []

def crear_nivel(nombre, es_pb=False):
    lvl = get_level(nombre)
    if not lvl:
        return
    w_frente  = find_wall_at_y(lvl.Id, 0.0)
    w_pasillo = find_wall_at_y(lvl.Id, y_pasillo)

    if es_pb:
        # PB: puerta de acceso al edificio (centrada en el frente)
        if sym_p and w_frente:
            inst = place(sym_p, w_frente, lvl, frente_m / 2, 0.0)
            if inst:
                set_size(inst, 1.20, 2.40)
                aberturas.append({"nivel": nombre, "tipo": "puerta_acceso_edificio", "id": inst.Id.Value})
        return

    for apt_idx in range(_n_apts):
        tipo  = apts[apt_idx] if apt_idx < len(apts) else "2amb"
        x0    = apt_ancho * apt_idx
        x_cen = x0 + apt_ancho / 2.0
        pct_l = _PROP_LIVING.get(tipo, 0.40)
        y_l   = y_pasillo * pct_l   # y-coord del muro living/dorm (0 si no hay)

        # ── 1. Ventana de living — fachada principal, zona izq del apt ────
        if sym_v and w_frente:
            x_vl  = x0 + apt_ancho * 0.30
            ancho_v = min(apt_ancho * 0.55, 2.40)
            inst = place(sym_v, w_frente, lvl, x_vl, 0.0, 0.90)
            if inst:
                set_size(inst, ancho_v, 1.50)
                aberturas.append({"nivel": nombre, "tipo": "ventana_living", "id": inst.Id.Value})

        # ── 2. Ventanas de dormitorios — fachada principal, zona der del apt
        n_dorms = {"1amb":0,"estudio":0,"2amb":1,"3amb":2,"4amb":3,"duplex":3}.get(tipo, 1)
        if sym_v and w_frente and n_dorms > 0:
            x_start = x0 + apt_ancho * 0.60
            paso_d  = apt_ancho * 0.35 / max(n_dorms, 1)
            for d in range(n_dorms):
                x_vd = x_start + paso_d * d
                if x_vd < x0 + apt_ancho - 0.30:
                    inst = place(sym_v, w_frente, lvl, x_vd, 0.0, 0.90)
                    if inst:
                        set_size(inst, 1.20, 1.20)
                        aberturas.append({"nivel": nombre, "tipo": f"ventana_dorm{d+1}", "id": inst.Id.Value})

        # ── 3. Puerta de entrada al depto — muro del pasillo ─────────────
        if sym_p and w_pasillo:
            inst = place(sym_p, w_pasillo, lvl, x_cen, y_pasillo)
            if inst:
                set_size(inst, 0.90, 2.10)
                aberturas.append({"nivel": nombre, "tipo": "puerta_entrada_depto", "id": inst.Id.Value})

        # ── 4. Puertas interiores — muro separador living/dormitorios ─────
        if sym_p and y_l > 0.50:
            w_sep = find_wall_at_y(lvl.Id, y_l)
            if w_sep:
                inst = place(sym_p, w_sep, lvl, x0 + apt_ancho * 0.25, y_l)
                if inst:
                    set_size(inst, 0.80, 2.10)
                    aberturas.append({"nivel": nombre, "tipo": "puerta_int_living_dorm", "id": inst.Id.Value})

with Transaction(doc, "py-building-gen: Aberturas v2") as t:
    t.Start()
    for sym in [sym_p, sym_v]:
        if sym and not sym.IsActive:
            sym.Activate()
    crear_nivel("PB", es_pb=True)
    for i in range(1, pisos_tipo + 1):
        crear_nivel(f"P{i:02d}")
    t.Commit()

OUT = {"total": len(aberturas), "detalle": aberturas}
# ----------------------------------------
