# Dynamo graph 10_schedules.dyn (Dynamo 4.0.0.0)
# Crea tablas de cómputo (áreas, puertas, ventanas, estructura) para documentación y presupuesto.

pisos_tipo = CodeBlock { 6; }
crear_schedules = Python(IN[0]=pisos_tipo)  # PythonNet3
# ---------- crear_schedules.python (111 lines) ----------
def _fi(v, d=0.0): return float(v) if v is not None else float(d)
def _ii(v, d=0):   return int(v)   if v is not None else int(d)
def _si(v, d=""):  return str(v)   if v is not None else str(d)
import clr
clr.AddReference("RevitAPI")
from Autodesk.Revit.DB import (
    ViewSchedule, SchedulableField, ScheduleFieldType,
    BuiltInParameter, FilteredElementCollector,
    BuiltInCategory, ScheduleSortGroupField,
    Transaction, ElementId,
)
clr.AddReference("RevitServices")
from RevitServices.Persistence import DocumentManager

doc = DocumentManager.Instance.CurrentDBDocument

pisos_tipo = _ii(IN[0])

def crear_schedule(nombre, cat_id_int):
    try:
        sch = ViewSchedule.CreateSchedule(doc, ElementId(cat_id_int))
        sch.Name = nombre
        return sch
    except Exception:
        return None

def agregar_campos(sch, bip_list):
    """Agrega campos BuiltInParameter al schedule si están disponibles."""
    sched_def = sch.Definition
    campos_disponibles = {f.ParameterId: f for f in sched_def.GetSchedulableFields()}
    for bip in bip_list:
        fid = ElementId(int(bip))
        if fid in campos_disponibles:
            try:
                sched_def.AddField(campos_disponibles[fid])
            except Exception:
                pass

schedules_creados = []

# Campos por categoría (BuiltInParameter)
CAMPOS = {
    int(BuiltInCategory.OST_Rooms): [
        BuiltInParameter.ROOM_NAME,
        BuiltInParameter.ROOM_NUMBER,
        BuiltInParameter.LEVEL_NAME,
        BuiltInParameter.ROOM_AREA,
        BuiltInParameter.ROOM_PERIMETER,
    ],
    int(BuiltInCategory.OST_Doors): [
        BuiltInParameter.ALL_MODEL_MARK,
        BuiltInParameter.ELEM_FAMILY_AND_TYPE_PARAM,
        BuiltInParameter.LEVEL_PARAM,
        BuiltInParameter.DOOR_WIDTH,
        BuiltInParameter.DOOR_HEIGHT,
    ],
    int(BuiltInCategory.OST_Windows): [
        BuiltInParameter.ALL_MODEL_MARK,
        BuiltInParameter.ELEM_FAMILY_AND_TYPE_PARAM,
        BuiltInParameter.LEVEL_PARAM,
        BuiltInParameter.WINDOW_WIDTH,
        BuiltInParameter.WINDOW_HEIGHT,
    ],
    int(BuiltInCategory.OST_Walls): [
        BuiltInParameter.ALL_MODEL_MARK,
        BuiltInParameter.ELEM_FAMILY_AND_TYPE_PARAM,
        BuiltInParameter.WALL_BASE_CONSTRAINT,
        BuiltInParameter.HOST_AREA_COMPUTED,
        BuiltInParameter.CURVE_ELEM_LENGTH,
    ],
    int(BuiltInCategory.OST_Floors): [
        BuiltInParameter.ELEM_FAMILY_AND_TYPE_PARAM,
        BuiltInParameter.LEVEL_PARAM,
        BuiltInParameter.HOST_AREA_COMPUTED,
        BuiltInParameter.FLOOR_HEIGHTABOVELEVEL_PARAM,
    ],
    int(BuiltInCategory.OST_StructuralColumns): [
        BuiltInParameter.ALL_MODEL_MARK,
        BuiltInParameter.ELEM_FAMILY_AND_TYPE_PARAM,
        BuiltInParameter.SCHEDULE_BASE_LEVEL_PARAM,
        BuiltInParameter.FAMILY_HEIGHT_PARAM,
    ],
    int(BuiltInCategory.OST_StructuralFraming): [
        BuiltInParameter.ALL_MODEL_MARK,
        BuiltInParameter.ELEM_FAMILY_AND_TYPE_PARAM,
        BuiltInParameter.STRUCTURAL_BEAM_END0_ELEVATION,
        BuiltInParameter.CURVE_ELEM_LENGTH,
    ],
}

config = [
    ("CÓMPUTO - LOCALES Y ÁREAS",   int(BuiltInCategory.OST_Rooms)),
    ("CÓMPUTO - PUERTAS",           int(BuiltInCategory.OST_Doors)),
    ("CÓMPUTO - VENTANAS",          int(BuiltInCategory.OST_Windows)),
    ("CÓMPUTO - MUROS",             int(BuiltInCategory.OST_Walls)),
    ("CÓMPUTO - LOSAS",             int(BuiltInCategory.OST_Floors)),
    ("CÓMPUTO - COLUMNAS",          int(BuiltInCategory.OST_StructuralColumns)),
    ("CÓMPUTO - VIGAS",             int(BuiltInCategory.OST_StructuralFraming)),
]

with Transaction(doc, "py-building-gen: Schedules v2") as t:
    t.Start()
    for nombre, cat_id in config:
        sch = crear_schedule(nombre, cat_id)
        if sch:
            campos_bip = CAMPOS.get(cat_id, [])
            agregar_campos(sch, campos_bip)
            schedules_creados.append({"nombre": nombre, "id": sch.Id.Value})
    t.Commit()

OUT = {"total": len(schedules_creados), "schedules": schedules_creados}
# ----------------------------------------
