# Dynamo graph 00_familias.dyn (Dynamo 4.0.0.0)
# Crea materiales, wall types, floor types y tipos estructurales. Ejecutar PRIMERO, antes de 01_niveles_grilla.dyn.

tipo_hormigon = CodeBlock { "H-21" }
tipo_acero = CodeBlock { "ADN 420" }
crear_materiales = Python()  # PythonNet3; unwired: IN[0], IN[1]
# ---------- crear_materiales.python (78 lines) ----------
import clr
clr.AddReference("RevitAPI")
from Autodesk.Revit.DB import (
    Material, Color, FillPatternElement,
    FilteredElementCollector,
    BuiltInParameter, ElementId,
)

clr.AddReference("RevitNodes")
import Revit
clr.ImportExtensions(Revit.GeometryConversion)
clr.ImportExtensions(Revit.Elements)

clr.AddReference("System")
from System.Collections.Generic import List

clr.AddReference("RevitServices")
from RevitServices.Persistence import DocumentManager
from RevitServices.Transactions import TransactionManager
doc  = DocumentManager.Instance.CurrentDBDocument

tipo_hormigon = str(IN[0])   # "H-21" | "H-25" | "H-30"
tipo_acero    = str(IN[1])   # "ADN 420" | "AL 220"

def color(r, g, b):
    return Color(r, g, b)

def get_or_create_material(nombre, r, g, b):
    col = FilteredElementCollector(doc).OfClass(Material).ToElements()
    mat = next((m for m in col if m.Name == nombre), None)
    if mat:
        return mat
    mat_id = Material.Create(doc, nombre)
    mat = doc.GetElement(mat_id)
    mat.Color = color(r, g, b)
    return mat

materiales_creados = []

TransactionManager.Instance.EnsureInTransaction(doc)

# Hormigones según tipo seleccionado (+ los otros para referencia)
for nombre, rgb in [
    ("Hormigón H-21",  (180, 180, 180)),
    ("Hormigón H-25",  (160, 160, 160)),
    ("Hormigón H-30",  (140, 140, 140)),
]:
    m = get_or_create_material(nombre, *rgb)
    materiales_creados.append(m.Name)

# Aceros
for nombre, rgb in [
    ("Acero ADN 420", (80,  80,  80)),
    ("Acero AL 220",  (100, 100, 100)),
]:
    m = get_or_create_material(nombre, *rgb)
    materiales_creados.append(m.Name)

# Mampostería y terminaciones
for nombre, rgb in [
    ("Ladrillo cerámico",    (195, 100,  60)),
    ("Mortero de cemento",   (220, 210, 200)),
    ("Revoque grueso",       (230, 220, 210)),
    ("Revoque fino / yeso",  (245, 240, 235)),
    ("Pintura látex blanca", (255, 255, 255)),
    ("Cámara de aire",       (200, 230, 255)),
    ("Membrana asfáltica",   ( 30,  30,  30)),
]:
    m = get_or_create_material(nombre, *rgb)
    materiales_creados.append(m.Name)

TransactionManager.Instance.TransactionTaskDone()

OUT = {
    "materiales_creados": materiales_creados,
    "tipo_hormigon_proyecto": tipo_hormigon,
    "tipo_acero_proyecto": tipo_acero,
}
# ----------------------------------------
crear_wall_types = Python()  # PythonNet3
# ---------- crear_wall_types.python (95 lines) ----------
import clr
clr.AddReference("RevitAPI")
from Autodesk.Revit.DB import (
    WallType, CompoundStructure, CompoundStructureLayer,
    MaterialFunctionAssignment, Material, ElementId,
    FilteredElementCollector, ShellLayerType,
    UnitUtils, UnitTypeId,
)

clr.AddReference("RevitNodes")
import Revit
clr.ImportExtensions(Revit.GeometryConversion)
clr.ImportExtensions(Revit.Elements)

clr.AddReference("System")
from System.Collections.Generic import List

clr.AddReference("RevitServices")
from RevitServices.Persistence import DocumentManager
from RevitServices.Transactions import TransactionManager
doc  = DocumentManager.Instance.CurrentDBDocument

def m_to_ft(m):
    return UnitUtils.ConvertToInternalUnits(m, UnitTypeId.Meters)

def get_material_id(nombre):
    col = FilteredElementCollector(doc).OfClass(Material).ToElements()
    mat = next((m for m in col if m.Name == nombre), None)
    return mat.Id if mat else ElementId.InvalidElementId

def get_or_duplicate_wall_type(nombre_base, nombre_nuevo):
    """Duplica un tipo de muro existente o devuelve el nuevo si ya existe."""
    wts = FilteredElementCollector(doc).OfClass(WallType).ToElements()
    existente = next((wt for wt in wts if wt.Name == nombre_nuevo), None)
    if existente:
        return existente
    base = next((wt for wt in wts if nombre_base.lower() in wt.Name.lower()), wts[0])
    return base.Duplicate(nombre_nuevo)

def build_compound_structure(capas, n_ext=1, n_int=1):
    """
    capas: lista de (espesor_m, MaterialFunctionAssignment, nombre_material)
    Orden: de exterior a interior.
    n_ext / n_int: shell layers exterior e interior (muros: 1/1; medianera: 0/1)
    """
    layers = []
    for espesor_m, funcion, nombre_mat in capas:
        mat_id = get_material_id(nombre_mat)
        layer = CompoundStructureLayer(m_to_ft(espesor_m), funcion, mat_id)
        layers.append(layer)
    cs = CompoundStructure.CreateSimpleCompoundStructure(layers)
    cs.SetNumberOfShellLayers(ShellLayerType.Exterior, n_ext)
    cs.SetNumberOfShellLayers(ShellLayerType.Interior, n_int)
    return cs

FA = MaterialFunctionAssignment  # alias
tipos_creados = []

# Buscar keyword para muro genérico en español e inglés
_kw_muro = ("generic", "genérico", "generico", "basic", "básico", "basico")

TransactionManager.Instance.EnsureInTransaction(doc)

# 1. Muro exterior 200mm
wt_ext = get_or_duplicate_wall_type("genér", "Muro exterior - 200mm")
capas_ext = [
    (0.015, FA.Finish1,    "Revoque fino / yeso"),
    (0.170, FA.Structure,  "Ladrillo cerámico"),
    (0.015, FA.Finish2,    "Revoque grueso"),
]
wt_ext.SetCompoundStructure(build_compound_structure(capas_ext))
tipos_creados.append("Muro exterior - 200mm")

# 2. Tabique interior 100mm
wt_tab = get_or_duplicate_wall_type("genér", "Tabique interior - 100mm")
capas_tab = [
    (0.013, FA.Finish1,    "Revoque fino / yeso"),
    (0.074, FA.Structure,  "Ladrillo cerámico"),
    (0.013, FA.Finish2,    "Revoque fino / yeso"),
]
wt_tab.SetCompoundStructure(build_compound_structure(capas_tab))
tipos_creados.append("Tabique interior - 100mm")

# 3. Medianera 200mm (sin revoque exterior — va contra pared lindante)
wt_med = get_or_duplicate_wall_type("genér", "Medianera - 200mm")
capas_med = [
    (0.185, FA.Structure,  "Ladrillo cerámico"),
    (0.015, FA.Finish2,    "Revoque grueso"),
]
wt_med.SetCompoundStructure(build_compound_structure(capas_med, n_ext=0, n_int=1))
tipos_creados.append("Medianera - 200mm")

TransactionManager.Instance.TransactionTaskDone()

OUT = tipos_creados
# ----------------------------------------
espesor_losa_cm = CodeBlock { 30.0 }
tipo_hormigon_2 = CodeBlock { "H-21" }
crear_floor_types = Python()  # PythonNet3; unwired: IN[0], IN[1]
# ---------- crear_floor_types.python (96 lines) ----------
import clr
clr.AddReference("RevitAPI")
from Autodesk.Revit.DB import (
    FloorType, CompoundStructure, CompoundStructureLayer,
    MaterialFunctionAssignment, Material, ElementId,
    FilteredElementCollector,
    UnitUtils, UnitTypeId, ShellLayerType,
)

clr.AddReference("RevitNodes")
import Revit
clr.ImportExtensions(Revit.GeometryConversion)
clr.ImportExtensions(Revit.Elements)

clr.AddReference("System")
from System.Collections.Generic import List

clr.AddReference("RevitServices")
from RevitServices.Persistence import DocumentManager
from RevitServices.Transactions import TransactionManager
doc  = DocumentManager.Instance.CurrentDBDocument

espesor_losa_cm = float(IN[0]) if IN[0] is not None else 30.0
tipo_hormigon   = str(IN[1])   if IN[1] is not None else "H-21"

def m_to_ft(m):
    return UnitUtils.ConvertToInternalUnits(m, UnitTypeId.Meters)

def get_material_id(nombre):
    col = FilteredElementCollector(doc).OfClass(Material).ToElements()
    mat = next((m for m in col if m.Name == nombre), None)
    return mat.Id if mat else ElementId.InvalidElementId

def get_or_duplicate_floor_type(nombre_nuevo):
    fts = FilteredElementCollector(doc).OfClass(FloorType).ToElements()
    existente = next((ft for ft in fts if ft.Name == nombre_nuevo), None)
    if existente:
        return existente
    base = fts[0]
    return base.Duplicate(nombre_nuevo)

def try_set_compound_structure(ft, capas):
    FA = MaterialFunctionAssignment
    layers = []
    for esp, func, mat_nombre in capas:
        mat_id = get_material_id(mat_nombre)
        layers.append(CompoundStructureLayer(m_to_ft(esp), func, mat_id))
    try:
        cs = CompoundStructure.CreateSimpleCompoundStructure(layers)
        cs.SetNumberOfShellLayers(ShellLayerType.Exterior, 0)
        cs.SetNumberOfShellLayers(ShellLayerType.Interior, 0)
        ft.SetCompoundStructure(cs)
        return True
    except Exception:
        return False

FA = MaterialFunctionAssignment
tipos_creados = []
tipos_sin_capas = []

espesor_m = espesor_losa_cm / 100.0
nombre_mat_ha = f"Hormig\u00f3n {tipo_hormigon}"

TransactionManager.Instance.EnsureInTransaction(doc)

nombre = f"Losa HA {tipo_hormigon} - {espesor_losa_cm:.0f}cm"
ft = get_or_duplicate_floor_type(nombre)
capas = [
    (0.030,     FA.Substrate, "Mortero de cemento"),
    (espesor_m, FA.Structure, nombre_mat_ha),
]
if try_set_compound_structure(ft, capas):
    tipos_creados.append(nombre + " [capas OK]")
else:
    tipos_creados.append(nombre)
    tipos_sin_capas.append(nombre)

nombre_azo = f"Losa azotea HA {tipo_hormigon} - {espesor_losa_cm:.0f}cm"
ft_azo = get_or_duplicate_floor_type(nombre_azo)
capas_azo = [
    (0.004,     FA.Membrane,  "Membrana asf\u00e1ltica"),
    (0.020,     FA.Substrate, "Mortero de cemento"),
    (espesor_m, FA.Structure, nombre_mat_ha),
]
if try_set_compound_structure(ft_azo, capas_azo):
    tipos_creados.append(nombre_azo + " [capas OK]")
else:
    tipos_creados.append(nombre_azo)
    tipos_sin_capas.append(nombre_azo)

TransactionManager.Instance.TransactionTaskDone()

OUT = {
    "tipos_creados": tipos_creados,
    "configurar_manualmente": tipos_sin_capas if tipos_sin_capas else "ninguno",
}
# ----------------------------------------
lado_col_cm = CodeBlock { 35.0 }
ancho_viga_cm = CodeBlock { 45.0 }
alto_viga_cm = CodeBlock { 85.0 }
tipo_hormigon_3 = CodeBlock { "H-21" }
crear_tipos_estructurales = Python()  # PythonNet3; unwired: IN[0], IN[1], IN[2], IN[3]
# ---------- crear_tipos_estructurales.python (134 lines) ----------
import clr
clr.AddReference("RevitAPI")
from Autodesk.Revit.DB import (
    FamilySymbol, Material, ElementId,
    FilteredElementCollector, BuiltInCategory,
    UnitUtils, UnitTypeId,
)

clr.AddReference("RevitNodes")
import Revit
clr.ImportExtensions(Revit.GeometryConversion)
clr.ImportExtensions(Revit.Elements)

clr.AddReference("System")
from System.Collections.Generic import List

clr.AddReference("RevitServices")
from RevitServices.Persistence import DocumentManager
from RevitServices.Transactions import TransactionManager
doc  = DocumentManager.Instance.CurrentDBDocument

lado_col_cm   = float(IN[0]) if IN[0] is not None else 35.0
ancho_viga_cm = float(IN[1]) if IN[1] is not None else 45.0
alto_viga_cm  = float(IN[2]) if IN[2] is not None else 85.0
tipo_hormigon = str(IN[3])   if IN[3] is not None else "H-21"

def m_to_ft(m):
    return UnitUtils.ConvertToInternalUnits(m, UnitTypeId.Meters)

def get_material_id(nombre):
    col = FilteredElementCollector(doc).OfClass(Material).ToElements()
    mat = next((m for m in col if m.Name == nombre), None)
    return mat.Id if mat else ElementId.InvalidElementId

_KW_COL  = ("concrete", "hormigon", "hormigón", "pilar", "column", "ha ", "rectangular")
_KW_VIGA = ("concrete", "hormigon", "hormigón", "viga",  "beam",   "ha ", "rectangular")

def find_symbol(categoria, keywords):
    col = (FilteredElementCollector(doc)
           .OfClass(FamilySymbol)
           .OfCategory(categoria)
           .ToElements())
    match = next((s for s in col if any(k in s.FamilyName.lower() for k in keywords)), None)
    return match or (col[0] if col else None)

def set_param(symbol, nombres, valor_m):
    """Intenta asignar un parámetro de sección por múltiples nombres posibles."""
    for nombre in nombres:
        p = symbol.LookupParameter(nombre)
        if p and not p.IsReadOnly:
            try:
                p.Set(m_to_ft(valor_m))
                return True
            except Exception:
                pass
    return False

mat_id_ha = get_material_id(f"Hormigón {tipo_hormigon}")
tipos_creados = []

TransactionManager.Instance.EnsureInTransaction(doc)

# --- Columnas ---
sym_col = find_symbol(BuiltInCategory.OST_StructuralColumns, _KW_COL)
if sym_col:
    if not sym_col.IsActive:
        sym_col.Activate()

    nombre_col = f"Columna HA {lado_col_cm:.0f}x{lado_col_cm:.0f}cm"
    try:
        nuevo_col = sym_col.Duplicate(nombre_col)
    except Exception:
        nuevo_col = sym_col

    # Parámetros de sección (nombres varían según familia y versión)
    lado = lado_col_cm / 100.0
    set_param(nuevo_col, ["b", "Ancho", "Width", "w"],  lado)
    set_param(nuevo_col, ["h", "Alto",  "Depth", "d"],  lado)

    # Material estructural
    p_mat = nuevo_col.LookupParameter("Material estructural") or \
            nuevo_col.LookupParameter("Structural Material") or \
            nuevo_col.LookupParameter("Material")
    if p_mat and mat_id_ha != ElementId.InvalidElementId:
        try:
            p_mat.Set(mat_id_ha)
        except Exception:
            pass

    tipos_creados.append(nombre_col)

# --- Vigas ---
sym_viga = find_symbol(BuiltInCategory.OST_StructuralFraming, _KW_VIGA)
if sym_viga:
    if not sym_viga.IsActive:
        sym_viga.Activate()

    nombre_viga = f"Viga HA {ancho_viga_cm:.0f}x{alto_viga_cm:.0f}cm"
    try:
        nuevo_viga = sym_viga.Duplicate(nombre_viga)
    except Exception:
        nuevo_viga = sym_viga

    ancho = ancho_viga_cm / 100.0
    alto  = alto_viga_cm  / 100.0
    set_param(nuevo_viga, ["b", "Ancho", "Width",  "w"], ancho)
    set_param(nuevo_viga, ["h", "Alto",  "Depth",  "d"], alto)

    p_mat = nuevo_viga.LookupParameter("Material estructural") or \
            nuevo_viga.LookupParameter("Structural Material") or \
            nuevo_viga.LookupParameter("Material")
    if p_mat and mat_id_ha != ElementId.InvalidElementId:
        try:
            p_mat.Set(mat_id_ha)
        except Exception:
            pass

    tipos_creados.append(nombre_viga)

TransactionManager.Instance.TransactionTaskDone()

if not tipos_creados:
    OUT = {
        "resultado": "No se encontraron familias estructurales en el template.",
        "accion_requerida": (
            "Cargar manualmente una familia de columna y viga de HA "
            "desde Insertar → Cargar familia, luego volver a correr este script."
        ),
    }
else:
    OUT = {
        "tipos_creados": tipos_creados,
        "nota": "Verificar secciones en Propiedades de tipo antes de correr 04_estructura.dyn",
    }
# ----------------------------------------
