# Dynamo graph 01_niveles_grilla.dyn (Dynamo 4.0.0.0)
# Crea Levels y Grids en Revit 2027. Generado por py-building-gen. Ejecutar primero.

pisos_tipo = CodeBlock { 6 }
altura_pb_m = CodeBlock { 3.5 }
altura_tipo_m = CodeBlock { 2.8 }
tiene_subsuelo = CodeBlock { false }
cant_subsuelos = CodeBlock { 0 }
tiene_azotea = CodeBlock { true }
crear_niveles = Python()  # PythonNet3; unwired: IN[0], IN[1], IN[2], IN[3], IN[4], IN[5]
# ---------- crear_niveles.python (83 lines) ----------
import clr
clr.AddReference("RevitAPI")
clr.AddReference("RevitAPIUI")
from Autodesk.Revit.DB import (
    Level, XYZ, Line, Grid,
    FilteredElementCollector,
    UnitUtils, UnitTypeId,
)
import Autodesk.Revit.DB as DB

clr.AddReference("RevitNodes")
import Revit
clr.ImportExtensions(Revit.GeometryConversion)
clr.ImportExtensions(Revit.Elements)

clr.AddReference("System")
from System.Collections.Generic import List

clr.AddReference("RevitServices")
from RevitServices.Persistence import DocumentManager
from RevitServices.Transactions import TransactionManager
doc  = DocumentManager.Instance.CurrentDBDocument
uidoc = DocumentManager.Instance.CurrentUIApplication.ActiveUIDocument

# --- Parámetros desde nodos Code Block ---
pisos_tipo   = int(IN[0])   if IN[0] is not None else 6
altura_pb    = float(IN[1]) if IN[1] is not None else 3.5
altura_tipo  = float(IN[2]) if IN[2] is not None else 2.8
tiene_sub    = bool(IN[3])  if IN[3] is not None else False
cant_sub     = int(IN[4])   if IN[4] is not None else 0
tiene_azotea = bool(IN[5])  if IN[5] is not None else True

def m_to_ft(m: float) -> float:
    """Convierte metros a pies (unidad interna de Revit)."""
    return UnitUtils.ConvertToInternalUnits(m, UnitTypeId.Meters)

niveles_creados = []
eliminados = []

TransactionManager.Instance.EnsureInTransaction(doc)

# Eliminar niveles por defecto del template (Nivel 1, Nivel 2, Level 1, Level 2, etc.)
levels_existentes = FilteredElementCollector(doc).OfClass(Level).ToElements()
keywords_default = ("nivel 1", "nivel 2", "level 1", "level 2", "nivel1", "nivel2")
for lvl_ex in levels_existentes:
    if lvl_ex.Name.lower().strip() in keywords_default:
        try:
            doc.Delete(lvl_ex.Id)
            eliminados.append(lvl_ex.Name)
        except Exception:
            pass

# Subsuelos (debajo de +-0.00)
for i in range(cant_sub, 0, -1):
    elev_m = -i * altura_tipo
    nombre = f"SS{i:02d}"
    lvl = Level.Create(doc, m_to_ft(elev_m))
    lvl.Name = nombre
    niveles_creados.append({"nombre": nombre, "elevacion_m": elev_m})

# Planta baja (±0.00)
lvl_pb = Level.Create(doc, m_to_ft(0.0))
lvl_pb.Name = "PB"
niveles_creados.append({"nombre": "PB", "elevacion_m": 0.0})

# Pisos tipo
for i in range(1, pisos_tipo + 1):
    elev_m = altura_pb + (i - 1) * altura_tipo
    nombre = f"P{i:02d}"
    lvl = Level.Create(doc, m_to_ft(elev_m))
    lvl.Name = nombre
    niveles_creados.append({"nombre": nombre, "elevacion_m": elev_m})

# Azotea
if tiene_azotea:
    elev_m = altura_pb + pisos_tipo * altura_tipo
    lvl = Level.Create(doc, m_to_ft(elev_m))
    lvl.Name = "AZO"
    niveles_creados.append({"nombre": "AZO", "elevacion_m": elev_m})

TransactionManager.Instance.TransactionTaskDone()

OUT = {"eliminados": eliminados, "niveles_creados": niveles_creados}
# ----------------------------------------
frente_m = CodeBlock { 10.0 }
fondo_m = CodeBlock { 24.0 }
crear_grilla = Python()  # PythonNet3; unwired: IN[0], IN[1]
# ---------- crear_grilla.python (63 lines) ----------
import clr
clr.AddReference("RevitAPI")
clr.AddReference("RevitAPIUI")
from Autodesk.Revit.DB import (
    Grid, Line, XYZ,
    UnitUtils, UnitTypeId,
)
import Autodesk.Revit.DB as DB

clr.AddReference("RevitNodes")
import Revit
clr.ImportExtensions(Revit.GeometryConversion)
clr.ImportExtensions(Revit.Elements)

clr.AddReference("System")
from System.Collections.Generic import List

clr.AddReference("RevitServices")
from RevitServices.Persistence import DocumentManager
from RevitServices.Transactions import TransactionManager
doc  = DocumentManager.Instance.CurrentDBDocument

# --- Parámetros ---
frente_m = float(IN[0]) if IN[0] is not None else 10.0
fondo_m  = float(IN[1]) if IN[1] is not None else 24.0
paso_m   = 5.0          # módulo de grilla estructural (5.00 m típico CABA)

def m_to_ft(m: float) -> float:
    return UnitUtils.ConvertToInternalUnits(m, UnitTypeId.Meters)

grillas_creadas = []

TransactionManager.Instance.EnsureInTransaction(doc)

# Ejes verticales (paralelos al fondo, dirección Y) — A, B, C ...
x = 0.0
col_idx = 0
while x <= frente_m + 0.001:
    nombre = chr(ord("A") + col_idx)
    p1 = XYZ(m_to_ft(x), m_to_ft(-1.0), 0)
    p2 = XYZ(m_to_ft(x), m_to_ft(fondo_m + 1.0), 0)
    grid = Grid.Create(doc, Line.CreateBound(p1, p2))
    grid.Name = nombre
    grillas_creadas.append(nombre)
    x += paso_m
    col_idx += 1

# Ejes horizontales (paralelos al frente, dirección X) — 1, 2, 3 ...
y = 0.0
row_idx = 1
while y <= fondo_m + 0.001:
    nombre = str(row_idx)
    p1 = XYZ(m_to_ft(-1.0), m_to_ft(y), 0)
    p2 = XYZ(m_to_ft(frente_m + 1.0), m_to_ft(y), 0)
    grid = Grid.Create(doc, Line.CreateBound(p1, p2))
    grid.Name = nombre
    grillas_creadas.append(nombre)
    y += paso_m
    row_idx += 1

TransactionManager.Instance.TransactionTaskDone()

OUT = grillas_creadas
# ----------------------------------------
