# Dynamo graph 03_losas.dyn (Dynamo 4.0.0.0)
# Crea losas de hormigón armado por nivel.

frente_m = CodeBlock { 10.0 }
fondo_m = CodeBlock { 24.0 }
pisos_tipo = CodeBlock { 6 }
tiene_azotea = CodeBlock { true }
espesor_cm = CodeBlock { 30.0 }
nombre_losa = CodeBlock { "Losa HA H-21 - 30cm" }
nombre_losa_azo = CodeBlock { "Losa azotea HA H-21 - 30cm" }
crear_losas = Python()  # PythonNet3; unwired: IN[0], IN[1], IN[2], IN[3], IN[4], IN[5], IN[6]
# ---------- crear_losas.python (77 lines) ----------
import clr
clr.AddReference("RevitAPI")
from Autodesk.Revit.DB import (
    Floor, FloorType, Level, CurveLoop, Line, XYZ,
    FilteredElementCollector,
    UnitUtils, UnitTypeId,
)

clr.AddReference("RevitNodes")
import Revit
clr.ImportExtensions(Revit.GeometryConversion)
clr.ImportExtensions(Revit.Elements)

clr.AddReference("System")
from System.Collections.Generic import List

clr.AddReference("RevitServices")
from RevitServices.Persistence import DocumentManager
from RevitServices.Transactions import TransactionManager
doc  = DocumentManager.Instance.CurrentDBDocument

frente_m      = float(IN[0]) if IN[0] is not None else 10.0
fondo_m       = float(IN[1]) if IN[1] is not None else 24.0
pisos_tipo    = int(IN[2])   if IN[2] is not None else 6
tiene_azotea  = bool(IN[3])  if IN[3] is not None else True
espesor_cm    = float(IN[4]) if IN[4] is not None else 30.0
nombre_losa   = str(IN[5])   if IN[5] is not None else "Losa HA H-21 - 30cm"
nombre_losa_azo = str(IN[6]) if IN[6] is not None else "Losa azotea HA H-21 - 30cm"

def m_to_ft(m):
    return UnitUtils.ConvertToInternalUnits(m, UnitTypeId.Meters)

def get_floor_type(nombre_exacto):
    tipos = FilteredElementCollector(doc).OfClass(FloorType).ToElements()
    # 1° intento: nombre exacto creado por 00_familias.dyn
    match = next((t for t in tipos if t.Name == nombre_exacto), None)
    if match:
        return match
    # fallback: búsqueda por keyword
    _kw = ("concrete", "hormigon", "hormigón", "ha ", "losa")
    match = next((t for t in tipos if any(k in t.Name.lower() for k in _kw)), None)
    return match or tipos[0]

def get_level(nombre):
    levels = FilteredElementCollector(doc).OfClass(Level).ToElements()
    match = next((l for l in levels if l.Name == nombre), None)
    return match or sorted(levels, key=lambda l: l.Elevation)[0]

def contorno_losa():
    loop = CurveLoop()
    pts = [
        XYZ(m_to_ft(0),          m_to_ft(0),          0),
        XYZ(m_to_ft(frente_m),   m_to_ft(0),          0),
        XYZ(m_to_ft(frente_m),   m_to_ft(fondo_m),    0),
        XYZ(m_to_ft(0),          m_to_ft(fondo_m),    0),
    ]
    for i in range(len(pts)):
        loop.Append(Line.CreateBound(pts[i], pts[(i + 1) % len(pts)]))
    return loop

ft_tipo = get_floor_type(nombre_losa)
ft_azo  = get_floor_type(nombre_losa_azo)
losas_creadas = []

TransactionManager.Instance.EnsureInTransaction(doc)
for i in range(1, pisos_tipo + 1):
    nom = f"P{i:02d}"
    lvl = get_level(nom)
    losa = Floor.Create(doc, [contorno_losa()], ft_tipo.Id, lvl.Id)
    losas_creadas.append({"nivel": nom, "id": losa.Id.Value})
if tiene_azotea:
    lvl = get_level("AZO")
    losa = Floor.Create(doc, [contorno_losa()], ft_azo.Id, lvl.Id)
    losas_creadas.append({"nivel": "AZO", "id": losa.Id.Value})
TransactionManager.Instance.TransactionTaskDone()

OUT = losas_creadas
# ----------------------------------------
