# Dynamo graph 04_estructura.dyn (Dynamo 4.0.0.0)
# Crea columnas y vigas de H° A° según predimensionado CIRSOC 201-2005.

frente_m = CodeBlock { 10.0 }
fondo_m = CodeBlock { 24.0 }
lado_col_cm = CodeBlock { 35 }
pisos_tipo = CodeBlock { 6 }
nombre_col = CodeBlock { "Columna HA 35x35cm" }
crear_columnas = Python()  # PythonNet3; unwired: IN[0], IN[1], IN[2], IN[3], IN[4]
# ---------- crear_columnas.python (82 lines) ----------
import clr
clr.AddReference("RevitAPI")
from Autodesk.Revit.DB import (
    FamilySymbol, Level, XYZ,
    FilteredElementCollector, BuiltInCategory,
    UnitUtils, UnitTypeId,
)
from Autodesk.Revit.DB.Structure import StructuralType

clr.AddReference("RevitNodes")
import Revit
clr.ImportExtensions(Revit.GeometryConversion)
clr.ImportExtensions(Revit.Elements)

clr.AddReference("System")
from System.Collections.Generic import List

clr.AddReference("RevitServices")
from RevitServices.Persistence import DocumentManager
from RevitServices.Transactions import TransactionManager
doc  = DocumentManager.Instance.CurrentDBDocument

frente_m       = float(IN[0]) if IN[0] is not None else 10.0
fondo_m        = float(IN[1]) if IN[1] is not None else 24.0
lado_col_cm    = float(IN[2]) if IN[2] is not None else 35.0  # sección cuadrada en cm (predimensionado)
pisos_tipo     = int(IN[3])   if IN[3] is not None else 6
nombre_col_tipo = str(IN[4])  if IN[4] is not None else "Columna HA 35x35cm"  # creado por 00_familias.dyn
paso_m         = 5.0

def m_to_ft(m):
    return UnitUtils.ConvertToInternalUnits(m, UnitTypeId.Meters)

def get_col_symbol():
    col = (FilteredElementCollector(doc)
           .OfClass(FamilySymbol)
           .OfCategory(BuiltInCategory.OST_StructuralColumns)
           .ToElements())
    # 1° intento: tipo exacto creado por 00_familias.dyn
    match = next((s for s in col if s.Name == nombre_col_tipo), None)
    if match:
        return match
    # 2° intento: familia con keyword de hormigón
    _kw = ("concrete", "hormigon", "hormigón", "ha ", "h.a")
    match = next((s for s in col if any(k in s.FamilyName.lower() for k in _kw)), None)
    return match or (col[0] if col else None)

def get_level(nombre):
    levels = FilteredElementCollector(doc).OfClass(Level).ToElements()
    match = next((l for l in levels if l.Name == nombre), None)
    return match or sorted(levels, key=lambda l: l.Elevation)[0]

sym = get_col_symbol()
columnas = []

if sym:
    # Ajustar parámetro de sección si el tipo lo permite
    TransactionManager.Instance.EnsureInTransaction(doc)
    try:
        lado_ft = m_to_ft(lado_col_cm / 100)
        sym.LookupParameter("b").Set(lado_ft)
        sym.LookupParameter("h").Set(lado_ft)
    except Exception:
        pass

    if not sym.IsActive:
        sym.Activate()

    for nombre_nivel in ["PB"] + [f"P{i:02d}" for i in range(1, pisos_tipo + 1)]:
        lvl = get_level(nombre_nivel)
        x = 0.0
        while x <= frente_m + 0.001:
            y = 0.0
            while y <= fondo_m + 0.001:
                pt = XYZ(m_to_ft(x), m_to_ft(y), 0)
                inst = doc.Create.NewFamilyInstance(pt, sym, lvl, StructuralType.Column)
                columnas.append(inst.Id.Value)
                y += paso_m
            x += paso_m

    TransactionManager.Instance.TransactionTaskDone()

OUT = f"{len(columnas)} columnas {lado_col_cm:.0f}x{lado_col_cm:.0f}cm creadas"
# ----------------------------------------
frente_m_2 = CodeBlock { 10.0 }
fondo_m_2 = CodeBlock { 24.0 }
ancho_viga_cm = CodeBlock { 45 }
alto_viga_cm = CodeBlock { 85 }
pisos_tipo_2 = CodeBlock { 6 }
nombre_viga = CodeBlock { "Viga HA 45x85cm" }
crear_vigas = Python()  # PythonNet3; unwired: IN[0], IN[1], IN[2], IN[3], IN[4], IN[5]
# ---------- crear_vigas.python (100 lines) ----------
import clr
clr.AddReference("RevitAPI")
from Autodesk.Revit.DB import (
    FamilySymbol, Level, XYZ, Line,
    FilteredElementCollector, BuiltInCategory,
    UnitUtils, UnitTypeId,
)
from Autodesk.Revit.DB.Structure import StructuralType

clr.AddReference("RevitNodes")
import Revit
clr.ImportExtensions(Revit.GeometryConversion)
clr.ImportExtensions(Revit.Elements)

clr.AddReference("System")
from System.Collections.Generic import List

clr.AddReference("RevitServices")
from RevitServices.Persistence import DocumentManager
from RevitServices.Transactions import TransactionManager
doc  = DocumentManager.Instance.CurrentDBDocument

frente_m        = float(IN[0]) if IN[0] is not None else 10.0
fondo_m         = float(IN[1]) if IN[1] is not None else 24.0
ancho_cm        = float(IN[2]) if IN[2] is not None else 45.0
alto_cm         = float(IN[3]) if IN[3] is not None else 85.0
pisos_tipo      = int(IN[4])   if IN[4] is not None else 6
nombre_viga_tipo = str(IN[5])  if IN[5] is not None else "Viga HA 45x85cm"  # creado por 00_familias.dyn
paso_m          = 5.0

def m_to_ft(m):
    return UnitUtils.ConvertToInternalUnits(m, UnitTypeId.Meters)

def get_beam_symbol():
    col = (FilteredElementCollector(doc)
           .OfClass(FamilySymbol)
           .OfCategory(BuiltInCategory.OST_StructuralFraming)
           .ToElements())
    # 1° intento: tipo exacto creado por 00_familias.dyn
    match = next((s for s in col if s.Name == nombre_viga_tipo), None)
    if match:
        return match
    # 2° intento: familia con keyword de hormigón
    _kw = ("concrete", "hormigon", "hormigón", "ha ", "h.a")
    match = next((s for s in col if any(k in s.FamilyName.lower() for k in _kw)), None)
    return match or (col[0] if col else None)

def get_level(nombre):
    levels = FilteredElementCollector(doc).OfClass(Level).ToElements()
    match = next((l for l in levels if l.Name == nombre), None)
    return match or sorted(levels, key=lambda l: l.Elevation)[0]

sym = get_beam_symbol()
vigas = []

if sym:
    TransactionManager.Instance.EnsureInTransaction(doc)
    try:
        sym.LookupParameter("b").Set(m_to_ft(ancho_cm / 100))
        sym.LookupParameter("h").Set(m_to_ft(alto_cm  / 100))
    except Exception:
        pass

    if not sym.IsActive:
        sym.Activate()

    for nombre_nivel in [f"P{i:02d}" for i in range(1, pisos_tipo + 1)]:
        lvl = get_level(nombre_nivel)

        # Vigas en dirección X (paralelas al frente) — una por eje Y
        y = 0.0
        while y <= fondo_m + 0.001:
            x = 0.0
            while x + paso_m <= frente_m + 0.001:
                p1 = XYZ(m_to_ft(x),        m_to_ft(y), 0)
                p2 = XYZ(m_to_ft(x + paso_m), m_to_ft(y), 0)
                inst = doc.Create.NewFamilyInstance(
                    Line.CreateBound(p1, p2), sym, lvl, StructuralType.Beam
                )
                vigas.append(inst.Id.Value)
                x += paso_m
            y += paso_m

        # Vigas en dirección Y (paralelas al fondo)
        x = 0.0
        while x <= frente_m + 0.001:
            y = 0.0
            while y + paso_m <= fondo_m + 0.001:
                p1 = XYZ(m_to_ft(x), m_to_ft(y),        0)
                p2 = XYZ(m_to_ft(x), m_to_ft(y + paso_m), 0)
                inst = doc.Create.NewFamilyInstance(
                    Line.CreateBound(p1, p2), sym, lvl, StructuralType.Beam
                )
                vigas.append(inst.Id.Value)
                y += paso_m
            x += paso_m

    TransactionManager.Instance.TransactionTaskDone()

OUT = f"{len(vigas)} vigas {ancho_cm:.0f}x{alto_cm:.0f}cm creadas"
# ----------------------------------------
