# Dynamo graph 05_aberturas.dyn (Dynamo 4.0.0.0)
# Coloca puertas y ventanas en muros exteriores.

frente_m = CodeBlock { 10.0 }
pisos_tipo = CodeBlock { 6 }
crear_aberturas = Python()  # PythonNet3; unwired: IN[0], IN[1]
# ---------- crear_aberturas.python (127 lines) ----------
import clr
clr.AddReference("RevitAPI")
from Autodesk.Revit.DB import (
    FamilySymbol, FamilyInstance, Wall, Level,
    FilteredElementCollector, BuiltInCategory,
    XYZ, BuiltInParameter,
    UnitUtils, UnitTypeId,
    FailureHandlingOptions, FailureSeverity,
)
from Autodesk.Revit.DB.Structure import StructuralType as ST

clr.AddReference("RevitNodes")
import Revit
clr.ImportExtensions(Revit.GeometryConversion)
clr.ImportExtensions(Revit.Elements)

clr.AddReference("System")
from System.Collections.Generic import List

clr.AddReference("RevitServices")
from RevitServices.Persistence import DocumentManager
from RevitServices.Transactions import TransactionManager
doc  = DocumentManager.Instance.CurrentDBDocument

frente_m   = float(IN[0]) if IN[0] is not None else 10.0
pisos_tipo = int(IN[1])   if IN[1] is not None else 6

def m_to_ft(m):
    return UnitUtils.ConvertToInternalUnits(m, UnitTypeId.Meters)

_KW_PUERTAS  = ("door", "puerta", "single", "simple")
_KW_VENTANAS = ("window", "ventana", "fixed", "fija", "doble", "double")

def get_symbol(categoria, keyword):
    col = FilteredElementCollector(doc).OfClass(FamilySymbol).OfCategory(categoria).ToElements()
    # Buscar con keyword original y sus equivalentes en español/inglés
    kw_map = {
        "door":   _KW_PUERTAS,
        "window": _KW_VENTANAS,
    }
    keywords = kw_map.get(keyword.lower(), (keyword.lower(),))
    match = next((s for s in col if any(k in s.FamilyName.lower() for k in keywords)), None)
    return match or (col[0] if col else None)

def get_level(nombre):
    levels = FilteredElementCollector(doc).OfClass(Level).ToElements()
    match = next((l for l in levels if l.Name == nombre), None)
    return match or sorted(levels, key=lambda l: l.Elevation)[0]

def get_muro_frente(nivel_id):
    """Busca el muro de fachada principal: corre en X a Y≈0."""
    col = FilteredElementCollector(doc).OfClass(Wall).ToElements()
    muros_nivel = [w for w in col if w.LevelId == nivel_id]
    for w in muros_nivel:
        try:
            curve = w.Location.Curve
            p1 = curve.GetEndPoint(0)
            p2 = curve.GetEndPoint(1)
            # Fachada frente: ambos extremos en Y≈0, corre en X
            if abs(p1.Y) < 0.5 and abs(p2.Y) < 0.5 and abs(p2.X - p1.X) > 1.0:
                return w
        except Exception:
            continue
    return muros_nivel[0] if muros_nivel else None

def midpoint_on_wall(muro):
    """Punto central sobre la curva del muro, a ras del nivel."""
    curve = muro.Location.Curve
    pt = curve.Evaluate(0.5, True)   # 0.5 normalizado = punto medio
    return XYZ(pt.X, pt.Y, 0.0)

sym_puerta  = get_symbol(BuiltInCategory.OST_Doors,   "door")
sym_ventana = get_symbol(BuiltInCategory.OST_Windows, "window")

aberturas = []

TransactionManager.Instance.EnsureInTransaction(doc)

for sym in [sym_puerta, sym_ventana]:
    if sym and not sym.IsActive:
        sym.Activate()

def place_hosted(symbol, muro, lvl, sill_h_m=None):
    """Coloca una abertura hosteada en el punto medio del muro con Z=0."""
    mid_pt = muro.Location.Curve.Evaluate(0.5, True)
    pos = XYZ(mid_pt.X, mid_pt.Y, 0.0)
    inst = doc.Create.NewFamilyInstance(pos, symbol, muro, lvl, ST.NonStructural)
    if sill_h_m is not None:
        for pname in (BuiltInParameter.INSTANCE_SILL_HEIGHT_PARAM,):
            p = inst.get_Parameter(pname)
            if p and not p.IsReadOnly:
                p.Set(m_to_ft(sill_h_m))
                break
        # fallback por nombre
        for nombre in ("Altura inferior", "Sill Height", "Alfeizar"):
            p = inst.LookupParameter(nombre)
            if p and not p.IsReadOnly:
                p.Set(m_to_ft(sill_h_m))
                break
    return inst

# Puerta de entrada en PB
if sym_puerta:
    lvl_pb = get_level("PB")
    muro_pb = get_muro_frente(lvl_pb.Id)
    if muro_pb:
        try:
            inst = place_hosted(sym_puerta, muro_pb, lvl_pb)
            aberturas.append({"tipo": "puerta_entrada", "id": inst.Id.Value})
        except Exception as e:
            aberturas.append({"tipo": "puerta_entrada", "error": str(e)})

# Ventanas en pisos tipo (una por fachada principal)
if sym_ventana:
    for i in range(1, pisos_tipo + 1):
        lvl = get_level(f"P{i:02d}")
        muro = get_muro_frente(lvl.Id)
        if muro:
            try:
                inst = place_hosted(sym_ventana, muro, lvl, sill_h_m=0.90)
                aberturas.append({"tipo": f"ventana_P{i:02d}", "id": inst.Id.Value})
            except Exception as e:
                aberturas.append({"tipo": f"ventana_P{i:02d}", "error": str(e)})

TransactionManager.Instance.TransactionTaskDone()

OUT = aberturas
# ----------------------------------------
