# Dynamo graph 10_schedules.dyn (Dynamo 4.0.0.0)
# Crea tablas de cómputo (áreas, puertas, ventanas, estructura) para documentación y presupuesto.

pisos_tipo = CodeBlock { 6 }
crear_schedules = Python()  # PythonNet3; unwired: IN[0]
# ---------- crear_schedules.python (54 lines) ----------
import clr
clr.AddReference("RevitAPI")
from Autodesk.Revit.DB import (
    ViewSchedule, ScheduleFieldType, BuiltInParameter,
    ScheduleDefinition, FilteredElementCollector,
    BuiltInCategory, ScheduleSortGroupField,
    ElementId,
)

clr.AddReference("RevitNodes")
import Revit
clr.ImportExtensions(Revit.GeometryConversion)
clr.ImportExtensions(Revit.Elements)

clr.AddReference("System")
from System.Collections.Generic import List

clr.AddReference("RevitServices")
from RevitServices.Persistence import DocumentManager
from RevitServices.Transactions import TransactionManager
doc  = DocumentManager.Instance.CurrentDBDocument

pisos_tipo = int(IN[0]) if IN[0] is not None else 6

def crear_schedule(nombre, categoria):
    try:
        sch = ViewSchedule.CreateSchedule(doc, ElementId(categoria))
        sch.Name = nombre
        return sch
    except Exception:
        return None

schedules_creados = []

TransactionManager.Instance.EnsureInTransaction(doc)

config = [
    ("CÓMPUTO - ÁREAS POR NIVEL",    int(BuiltInCategory.OST_Rooms)),
    ("CÓMPUTO - PUERTAS",            int(BuiltInCategory.OST_Doors)),
    ("CÓMPUTO - VENTANAS",           int(BuiltInCategory.OST_Windows)),
    ("CÓMPUTO - COLUMNAS",           int(BuiltInCategory.OST_StructuralColumns)),
    ("CÓMPUTO - VIGAS",              int(BuiltInCategory.OST_StructuralFraming)),
    ("CÓMPUTO - MUROS",              int(BuiltInCategory.OST_Walls)),
    ("CÓMPUTO - LOSAS",              int(BuiltInCategory.OST_Floors)),
]

for nombre, cat_id in config:
    sch = crear_schedule(nombre, cat_id)
    if sch:
        schedules_creados.append({"nombre": nombre, "id": sch.Id.Value})

TransactionManager.Instance.TransactionTaskDone()

OUT = schedules_creados
# ----------------------------------------
