# Dynamo graph 02_muros_perimetrales.dyn (Dynamo 4.0.0.0)
# Crea muros exteriores e interiores por nivel.

frente_m = CodeBlock { 10.0 }
fondo_m = CodeBlock { 24.0 }
altura_pb_m = CodeBlock { 3.5 }
altura_tipo_m = CodeBlock { 2.8 }
pisos_tipo = CodeBlock { 6 }
nombre_muro_ext = CodeBlock { "Muro exterior - 200mm" }
nombre_tabique = CodeBlock { "Tabique interior - 100mm" }
crear_muros = Python()  # PythonNet3; unwired: IN[0], IN[1], IN[2], IN[3], IN[4], IN[5], IN[6]
# ---------- crear_muros.python (84 lines) ----------
import clr
clr.AddReference("RevitAPI")
from Autodesk.Revit.DB import (
    Wall, WallType, Level, Line, XYZ,
    FilteredElementCollector,
    UnitUtils, UnitTypeId,
)

clr.AddReference("RevitNodes")
import Revit
clr.ImportExtensions(Revit.GeometryConversion)
clr.ImportExtensions(Revit.Elements)

clr.AddReference("System")
from System.Collections.Generic import List

clr.AddReference("RevitServices")
from RevitServices.Persistence import DocumentManager
from RevitServices.Transactions import TransactionManager
doc  = DocumentManager.Instance.CurrentDBDocument

frente_m        = float(IN[0]) if IN[0] is not None else 10.0
fondo_m         = float(IN[1]) if IN[1] is not None else 24.0
altura_pb       = float(IN[2]) if IN[2] is not None else 3.5
altura_tipo     = float(IN[3]) if IN[3] is not None else 2.8
pisos_tipo      = int(IN[4])   if IN[4] is not None else 6
nombre_muro_ext = str(IN[5])   if IN[5] is not None else "Muro exterior - 200mm"
nombre_tabique  = str(IN[6])   if IN[6] is not None else "Tabique interior - 100mm"

def m_to_ft(m):
    return UnitUtils.ConvertToInternalUnits(m, UnitTypeId.Meters)

def get_wall_type(nombre_exacto, fallback_keyword):
    tipos = FilteredElementCollector(doc).OfClass(WallType).ToElements()
    # 1° intento: nombre exacto creado por 00_familias.dyn
    match = next((t for t in tipos if t.Name == nombre_exacto), None)
    if match:
        return match
    # fallback: búsqueda por keyword (si 00_familias no se corrió aún)
    match = next((t for t in tipos if fallback_keyword.lower() in t.Name.lower()), None)
    return match or tipos[0]

def get_level(nombre):
    levels = FilteredElementCollector(doc).OfClass(Level).ToElements()
    match = next((l for l in levels if l.Name == nombre), None)
    return match or sorted(levels, key=lambda l: l.Elevation)[0]

wt_ext = get_wall_type(nombre_muro_ext, "200")
wt_int = get_wall_type(nombre_tabique,  "100")

muros_creados = []

def crear_muros_nivel(nombre_nivel, altura_m, es_pb):
    lvl = get_level(nombre_nivel)
    h   = m_to_ft(altura_m)
    f   = m_to_ft(frente_m)
    fo  = m_to_ft(fondo_m)

    # Perímetro exterior (4 muros)
    perimetro = [
        (XYZ(0, 0, 0),  XYZ(f, 0, 0)),    # frente
        (XYZ(f, 0, 0),  XYZ(f, fo, 0)),   # derecha
        (XYZ(f, fo, 0), XYZ(0, fo, 0)),   # contrafrente
        (XYZ(0, fo, 0), XYZ(0, 0, 0)),    # izquierda (medianera)
    ]
    for p1, p2 in perimetro:
        w = Wall.Create(doc, Line.CreateBound(p1, p2), wt_ext.Id, lvl.Id, h, 0, False, False)
        muros_creados.append(w.Id.Value)

    # Tabique de hall central (simplificado: a 1/3 del fondo)
    y_hall = m_to_ft(fondo_m / 3)
    w_hall = Wall.Create(
        doc, Line.CreateBound(XYZ(0, y_hall, 0), XYZ(f, y_hall, 0)),
        wt_int.Id, lvl.Id, h, 0, False, False,
    )
    muros_creados.append(w_hall.Id.Value)

TransactionManager.Instance.EnsureInTransaction(doc)
crear_muros_nivel("PB", altura_pb, es_pb=True)
for i in range(1, pisos_tipo + 1):
    crear_muros_nivel(f"P{i:02d}", altura_tipo, es_pb=False)
TransactionManager.Instance.TransactionTaskDone()

OUT = muros_creados
# ----------------------------------------
