# Dynamo graph 06_escaleras_ascensores.dyn (Dynamo 4.0.0.0)
# Crea shafts de escaleras y ascensores.

frente_m = CodeBlock { 10.0 }
fondo_m = CodeBlock { 24.0 }
pisos_tipo = CodeBlock { 6 }
cant_asc = CodeBlock { 1 }
cant_esc = CodeBlock { 1 }
crear_circulación = Python()  # PythonNet3; unwired: IN[0], IN[1], IN[2], IN[3], IN[4]
# ---------- crear_circulación.python (70 lines) ----------
import clr
clr.AddReference("RevitAPI")
from Autodesk.Revit.DB import (
    Opening, CurveArray, Level, XYZ, Line,
    FilteredElementCollector,
    UnitUtils, UnitTypeId,
)

clr.AddReference("RevitNodes")
import Revit
clr.ImportExtensions(Revit.GeometryConversion)
clr.ImportExtensions(Revit.Elements)

clr.AddReference("System")
from System.Collections.Generic import List

clr.AddReference("RevitServices")
from RevitServices.Persistence import DocumentManager
from RevitServices.Transactions import TransactionManager
doc  = DocumentManager.Instance.CurrentDBDocument

frente_m      = float(IN[0]) if IN[0] is not None else 10.0
fondo_m       = float(IN[1]) if IN[1] is not None else 24.0
pisos_tipo    = int(IN[2])   if IN[2] is not None else 6
cant_asc      = int(IN[3])   if IN[3] is not None else 1
cant_esc      = int(IN[4])   if IN[4] is not None else 1

def m_to_ft(m):
    return UnitUtils.ConvertToInternalUnits(m, UnitTypeId.Meters)

def get_levels():
    levels = FilteredElementCollector(doc).OfClass(Level).ToElements()
    return sorted(levels, key=lambda l: l.Elevation)

def rect_curve_array(x0, y0, ancho, largo):
    arr = CurveArray()
    pts = [
        XYZ(m_to_ft(x0),         m_to_ft(y0),         0),
        XYZ(m_to_ft(x0 + ancho), m_to_ft(y0),         0),
        XYZ(m_to_ft(x0 + ancho), m_to_ft(y0 + largo), 0),
        XYZ(m_to_ft(x0),         m_to_ft(y0 + largo), 0),
    ]
    for i in range(len(pts)):
        arr.Append(Line.CreateBound(pts[i], pts[(i + 1) % len(pts)]))
    return arr

nucleos = []
levels = get_levels()
lvl_pb = next((l for l in levels if l.Name == "PB"), levels[0])
lvl_techo = levels[-1]

TransactionManager.Instance.EnsureInTransaction(doc)

# Caja(s) de escalera — esquina posterior derecha del edificio
for i in range(cant_esc):
    x0 = frente_m - 3.0 - i * 3.5
    arr = rect_curve_array(x0, fondo_m * 0.65, 2.80, 5.50)
    op = doc.Create.NewOpening(lvl_pb, lvl_techo, arr)
    nucleos.append({"tipo": f"escalera_{i+1}", "id": op.Id.Value})

# Caja(s) de ascensor — al lado de la escalera
for i in range(cant_asc):
    x0 = frente_m - 3.0 - cant_esc * 3.5 - i * 2.2
    arr = rect_curve_array(x0, fondo_m * 0.65, 1.80, 2.10)
    op = doc.Create.NewOpening(lvl_pb, lvl_techo, arr)
    nucleos.append({"tipo": f"ascensor_{i+1}", "id": op.Id.Value})

TransactionManager.Instance.TransactionTaskDone()

OUT = nucleos
# ----------------------------------------
