# Dynamo graph 07_instalaciones_mep.dyn (Dynamo 4.0.0.0)
# Crea espacios MEP por nivel e inventaría sistemas disponibles en la plantilla.

pisos_tipo = CodeBlock { 6 }
frente_m = CodeBlock { 10.0 }
fondo_m = CodeBlock { 24.0 }
inst_san = CodeBlock { true }
inst_elec = CodeBlock { true }
inst_gas = CodeBlock { true }
inst_inc = CodeBlock { true }
inst_term = CodeBlock { false }
espacios_mep = Python()  # PythonNet3; unwired: IN[0], IN[1], IN[2], IN[3], IN[4], IN[5], IN[6], IN[7]
# ---------- espacios_mep.python (70 lines) ----------
import clr
clr.AddReference("RevitAPI")
clr.AddReference("RevitAPIUI")
from Autodesk.Revit.DB import (
    Level, XYZ, FilteredElementCollector,
    UnitUtils, UnitTypeId,
)
from Autodesk.Revit.DB.Mechanical import Space

clr.AddReference("RevitNodes")
import Revit
clr.ImportExtensions(Revit.GeometryConversion)
clr.ImportExtensions(Revit.Elements)

clr.AddReference("System")
from System.Collections.Generic import List

clr.AddReference("RevitServices")
from RevitServices.Persistence import DocumentManager
from RevitServices.Transactions import TransactionManager
doc  = DocumentManager.Instance.CurrentDBDocument

pisos_tipo = int(IN[0])   if IN[0] is not None else 6
frente_m   = float(IN[1]) if IN[1] is not None else 10.0
fondo_m    = float(IN[2]) if IN[2] is not None else 24.0
inst_san   = bool(IN[3])  if IN[3] is not None else True
inst_elec  = bool(IN[4])  if IN[4] is not None else True
inst_gas   = bool(IN[5])  if IN[5] is not None else True
inst_inc   = bool(IN[6])  if IN[6] is not None else True
inst_term  = bool(IN[7])  if IN[7] is not None else False

def m_to_ft(m):
    return UnitUtils.ConvertToInternalUnits(m, UnitTypeId.Meters)

def get_levels_tipo():
    levels = FilteredElementCollector(doc).OfClass(Level).ToElements()
    return [l for l in levels if l.Name.startswith("P") and l.Name[1:].isdigit()]

spaces_creados = []

TransactionManager.Instance.EnsureInTransaction(doc)

for lvl in get_levels_tipo():
    # Espacio central de servicios (shaft de instalaciones)
    pt = XYZ(m_to_ft(frente_m * 0.5), m_to_ft(fondo_m * 0.5), lvl.Elevation + 0.1)
    try:
        sp = Space(doc, lvl, pt)
        sp.Number = lvl.Name
        sp.LookupParameter("Name") and sp.LookupParameter("Name").Set(f"Zona MEP {lvl.Name}")
        spaces_creados.append({"nivel": lvl.Name, "id": sp.Id.Value})
    except Exception as e:
        spaces_creados.append({"nivel": lvl.Name, "error": str(e)})

TransactionManager.Instance.TransactionTaskDone()

instalaciones_activas = []
if inst_san:  instalaciones_activas.append("Sanitaria")
if inst_elec: instalaciones_activas.append("Eléctrica")
if inst_gas:  instalaciones_activas.append("Gas")
if inst_inc:  instalaciones_activas.append("Incendio")
if inst_term: instalaciones_activas.append("Termomecánica")

OUT = {
    "spaces": spaces_creados,
    "instalaciones_a_modelar": instalaciones_activas,
    "nota": (
        "Espacios MEP creados por nivel. "
        "Completar redes de tuberías y conductos manualmente en Revit MEP."
    ),
}
# ----------------------------------------
inst_san_2 = CodeBlock { true }
inst_elec_2 = CodeBlock { true }
inst_gas_2 = CodeBlock { true }
inst_inc_2 = CodeBlock { true }
inst_term_2 = CodeBlock { false }
sistemas_mep = Python()  # PythonNet3; unwired: IN[0], IN[1], IN[2], IN[3], IN[4]
# ---------- sistemas_mep.python (40 lines) ----------
import clr
clr.AddReference("RevitAPI")
from Autodesk.Revit.DB import (
    MEPSystemType, FilteredElementCollector,
    BuiltInCategory,
)
from Autodesk.Revit.DB.Plumbing import PipingSystemType
from Autodesk.Revit.DB.Mechanical import MechanicalSystemType

clr.AddReference("RevitNodes")
import Revit
clr.ImportExtensions(Revit.GeometryConversion)
clr.ImportExtensions(Revit.Elements)

clr.AddReference("System")
from System.Collections.Generic import List

clr.AddReference("RevitServices")
from RevitServices.Persistence import DocumentManager
from RevitServices.Transactions import TransactionManager
doc  = DocumentManager.Instance.CurrentDBDocument

inst_san  = bool(IN[0]) if IN[0] is not None else True
inst_elec = bool(IN[1]) if IN[1] is not None else True
inst_gas  = bool(IN[2]) if IN[2] is not None else True
inst_inc  = bool(IN[3]) if IN[3] is not None else True
inst_term = bool(IN[4]) if IN[4] is not None else False

sistemas = []

def listar_sistemas(cls, nombre_sistema):
    col = FilteredElementCollector(doc).OfClass(cls).ToElements()
    return [{"sistema": nombre_sistema, "tipo": s.Name} for s in col]

if inst_san or inst_inc:
    sistemas += listar_sistemas(PipingSystemType, "Plomería / Incendio")
if inst_term:
    sistemas += listar_sistemas(MechanicalSystemType, "Termomecánica")

OUT = sistemas if sistemas else ["Sin sistemas MEP definidos en la plantilla"]
# ----------------------------------------
