# Dynamo graph 08_vistas.dyn (Dynamo 4.0.0.0)
# Crea plantas, cortes, alzados y vista 3D para documentación técnica.

pisos_tipo = CodeBlock { 6 }
tiene_azotea = CodeBlock { true }
crear_plantas = Python()  # PythonNet3; unwired: IN[0], IN[1]
# ---------- crear_plantas.python (65 lines) ----------
import clr
clr.AddReference("RevitAPI")
from Autodesk.Revit.DB import (
    ViewPlan, ViewFamilyType, ViewFamily, Level,
    FilteredElementCollector,
    ElementId, XYZ, UnitUtils, UnitTypeId,
)

clr.AddReference("RevitNodes")
import Revit
clr.ImportExtensions(Revit.GeometryConversion)
clr.ImportExtensions(Revit.Elements)

clr.AddReference("System")
from System.Collections.Generic import List

clr.AddReference("RevitServices")
from RevitServices.Persistence import DocumentManager
from RevitServices.Transactions import TransactionManager
doc  = DocumentManager.Instance.CurrentDBDocument

pisos_tipo   = int(IN[0])  if IN[0] is not None else 6
tiene_azotea = bool(IN[1]) if IN[1] is not None else True

def get_view_family_type(familia):
    tipos = FilteredElementCollector(doc).OfClass(ViewFamilyType).ToElements()
    return next((t for t in tipos if t.ViewFamily == familia), None)

def get_level(nombre):
    levels = FilteredElementCollector(doc).OfClass(Level).ToElements()
    return next((l for l in levels if l.Name == nombre), None)

vft_planta = get_view_family_type(ViewFamily.FloorPlan)
plantas = []

if vft_planta:
    TransactionManager.Instance.EnsureInTransaction(doc)

    nombres_nivel = ["PB"] + [f"P{i:02d}" for i in range(1, pisos_tipo + 1)]
    if tiene_azotea:
        nombres_nivel.append("AZO")

    margen_ft = UnitUtils.ConvertToInternalUnits(1.0,  UnitTypeId.Meters)
    frente_ft = UnitUtils.ConvertToInternalUnits(10.0, UnitTypeId.Meters)
    fondo_ft  = UnitUtils.ConvertToInternalUnits(24.0, UnitTypeId.Meters)

    for nombre in nombres_nivel:
        lvl = get_level(nombre)
        if lvl:
            vista = ViewPlan.Create(doc, vft_planta.Id, lvl.Id)
            vista.Name = f"PLANTA {nombre}"
            vista.Scale = 100
            try:
                bbox = vista.CropBox
                bbox.Min = XYZ(-margen_ft, -margen_ft, bbox.Min.Z)
                bbox.Max = XYZ(frente_ft + margen_ft, fondo_ft + margen_ft, bbox.Max.Z)
                vista.CropBox = bbox
                vista.CropBoxActive = True
            except Exception:
                pass
            plantas.append({"nivel": nombre, "id": vista.Id.Value})

    TransactionManager.Instance.TransactionTaskDone()

OUT = plantas
# ----------------------------------------
frente_m = CodeBlock { 10.0 }
fondo_m = CodeBlock { 24.0 }
altura_total_m = CodeBlock { 20.299999999999997 }
crear_cortes_y_alzados = Python()  # PythonNet3; unwired: IN[0], IN[1], IN[2]
# ---------- crear_cortes_y_alzados.python (89 lines) ----------
import clr
clr.AddReference("RevitAPI")
from Autodesk.Revit.DB import (
    ViewSection, ViewFamilyType, ViewFamily, BoundingBoxXYZ,
    XYZ, Transform, FilteredElementCollector,
    UnitUtils, UnitTypeId,
)

clr.AddReference("RevitNodes")
import Revit
clr.ImportExtensions(Revit.GeometryConversion)
clr.ImportExtensions(Revit.Elements)

clr.AddReference("System")
from System.Collections.Generic import List

clr.AddReference("RevitServices")
from RevitServices.Persistence import DocumentManager
from RevitServices.Transactions import TransactionManager
doc  = DocumentManager.Instance.CurrentDBDocument

frente_m    = float(IN[0]) if IN[0] is not None else 10.0
fondo_m     = float(IN[1]) if IN[1] is not None else 24.0
altura_total = float(IN[2]) if IN[2] is not None else 20.3

def m_to_ft(m):
    return UnitUtils.ConvertToInternalUnits(m, UnitTypeId.Meters)

def get_vft_section():
    tipos = FilteredElementCollector(doc).OfClass(ViewFamilyType).ToElements()
    return next((t for t in tipos if t.ViewFamily == ViewFamily.Section), None)

vft = get_vft_section()
vistas = []

if vft:
    TransactionManager.Instance.EnsureInTransaction(doc)

    margen = m_to_ft(1.0)
    h      = m_to_ft(altura_total + 1.0)

    # Corte transversal — a mitad del fondo, mirando hacia frente (eje X)
    bbox_trans = BoundingBoxXYZ()
    xform = Transform.Identity
    xform.BasisX = XYZ(1, 0, 0)
    xform.BasisY = XYZ(0, 0, 1)
    xform.BasisZ = XYZ(0, -1, 0)
    xform.Origin = XYZ(m_to_ft(frente_m / 2), m_to_ft(fondo_m / 2), 0)
    bbox_trans.Transform = xform
    bbox_trans.Min = XYZ(-m_to_ft(frente_m / 2) - margen, 0, -margen)
    bbox_trans.Max = XYZ( m_to_ft(frente_m / 2) + margen, h,  margen)
    v = ViewSection.CreateSection(doc, vft.Id, bbox_trans)
    v.Name = "CORTE A-A"
    v.Scale = 100
    vistas.append({"tipo": "corte_transversal", "id": v.Id.Value})

    # Corte longitudinal — a mitad del frente, mirando hacia el fondo (eje Y)
    bbox_long = BoundingBoxXYZ()
    xform2 = Transform.Identity
    xform2.BasisX = XYZ(0, 1, 0)
    xform2.BasisY = XYZ(0, 0, 1)
    xform2.BasisZ = XYZ(1, 0, 0)
    xform2.Origin = XYZ(m_to_ft(frente_m / 2), m_to_ft(fondo_m / 2), 0)
    bbox_long.Transform = xform2
    bbox_long.Min = XYZ(-m_to_ft(fondo_m / 2) - margen, 0, -margen)
    bbox_long.Max = XYZ( m_to_ft(fondo_m / 2) + margen, h,  margen)
    v2 = ViewSection.CreateSection(doc, vft.Id, bbox_long)
    v2.Name = "CORTE B-B"
    v2.Scale = 100
    vistas.append({"tipo": "corte_longitudinal", "id": v2.Id.Value})

    # Alzado frontal (fachada principal)
    bbox_fach = BoundingBoxXYZ()
    xform3 = Transform.Identity
    xform3.BasisX = XYZ(1, 0, 0)
    xform3.BasisY = XYZ(0, 0, 1)
    xform3.BasisZ = XYZ(0, 1, 0)
    xform3.Origin = XYZ(m_to_ft(frente_m / 2), m_to_ft(-1.5), 0)
    bbox_fach.Transform = xform3
    bbox_fach.Min = XYZ(-m_to_ft(frente_m / 2) - margen, 0, -margen)
    bbox_fach.Max = XYZ( m_to_ft(frente_m / 2) + margen, h,  m_to_ft(fondo_m + 2))
    v3 = ViewSection.CreateSection(doc, vft.Id, bbox_fach)
    v3.Name = "FACHADA PRINCIPAL"
    v3.Scale = 100
    vistas.append({"tipo": "fachada", "id": v3.Id.Value})

    TransactionManager.Instance.TransactionTaskDone()

OUT = vistas
# ----------------------------------------
crear_vista_3d = Python()  # PythonNet3
# ---------- crear_vista_3d.python (35 lines) ----------
import clr
clr.AddReference("RevitAPI")
from Autodesk.Revit.DB import (
    View3D, ViewFamilyType, ViewFamily,
    FilteredElementCollector,
)

clr.AddReference("RevitNodes")
import Revit
clr.ImportExtensions(Revit.GeometryConversion)
clr.ImportExtensions(Revit.Elements)

clr.AddReference("System")
from System.Collections.Generic import List

clr.AddReference("RevitServices")
from RevitServices.Persistence import DocumentManager
from RevitServices.Transactions import TransactionManager
doc  = DocumentManager.Instance.CurrentDBDocument

def get_vft_3d():
    tipos = FilteredElementCollector(doc).OfClass(ViewFamilyType).ToElements()
    return next((t for t in tipos if t.ViewFamily == ViewFamily.ThreeDimensional), None)

vft = get_vft_3d()
resultado = []

if vft:
    TransactionManager.Instance.EnsureInTransaction(doc)
    v3d = View3D.CreateIsometric(doc, vft.Id)
    v3d.Name = "3D - Vista General"
    resultado.append({"tipo": "3d_isometrica", "id": v3d.Id.Value})
    TransactionManager.Instance.TransactionTaskDone()

OUT = resultado
# ----------------------------------------
