# Dynamo graph 09_sheets.dyn (Dynamo 4.0.0.0)
# Crea láminas A3 con title block IRAM 4505 y coloca las vistas de documentación.

nombre_proyecto = CodeBlock { "Edificio Caballito" }
autor = CodeBlock { "Federico A. Casado" }
escala_planta = CodeBlock { 100 }
crear_sheets = Python()  # PythonNet3; unwired: IN[0], IN[1], IN[2]
# ---------- crear_sheets.python (126 lines) ----------
import clr
clr.AddReference("RevitAPI")
from Autodesk.Revit.DB import (
    ViewSheet, FamilySymbol, ViewPlan, ViewSection, View3D,
    FilteredElementCollector, BuiltInCategory,
    Viewport, XYZ,
    UnitUtils, UnitTypeId,
)

clr.AddReference("RevitNodes")
import Revit
clr.ImportExtensions(Revit.GeometryConversion)
clr.ImportExtensions(Revit.Elements)

clr.AddReference("System")
from System.Collections.Generic import List

clr.AddReference("RevitServices")
from RevitServices.Persistence import DocumentManager
from RevitServices.Transactions import TransactionManager
doc  = DocumentManager.Instance.CurrentDBDocument

proyecto   = str(IN[0]) if IN[0] is not None else "Edificio Caballito"
autor      = str(IN[1]) if IN[1] is not None else "Federico A. Casado"
escala_planta = int(IN[2]) if IN[2] is not None else 100

def m_to_ft(m):
    return UnitUtils.ConvertToInternalUnits(m, UnitTypeId.Meters)

def get_title_block():
    col = (FilteredElementCollector(doc)
           .OfClass(FamilySymbol)
           .OfCategory(BuiltInCategory.OST_TitleBlocks)
           .ToElements())
    # Buscar IRAM A3 primero, luego A3 genérico
    for keyword in ["iram", "A3", "a3"]:
        match = next((s for s in col if keyword.lower() in s.Name.lower()), None)
        if match:
            return match
    return col[0] if col else None

def get_views_by_type(cls):
    return FilteredElementCollector(doc).OfClass(cls).ToElements()

tb = get_title_block()
sheets_creados = []

if not tb:
    OUT = {"error": "No se encontró title block en la plantilla. Cargar familia IRAM A3."}
else:
    TransactionManager.Instance.EnsureInTransaction(doc)

    if not tb.IsActive:
        tb.Activate()

    # Organización de láminas según portfolio
    config_laminas = [
        {"numero": "A-01", "titulo": "PLANTA BAJA",             "filtro": "PB"},
        {"numero": "A-02", "titulo": "PLANTAS TIPO",            "filtro": "P01"},
        {"numero": "A-03", "titulo": "PLANTA AZOTEA",           "filtro": "AZO"},
        {"numero": "A-04", "titulo": "CORTES",                  "filtro": "CORTE"},
        {"numero": "A-05", "titulo": "FACHADA PRINCIPAL",       "filtro": "FACHADA"},
        {"numero": "E-01", "titulo": "ESTRUCTURA - PLANTA TIPO","filtro": "P01"},
        {"numero": "M-01", "titulo": "VISTA 3D GENERAL",        "filtro": "3D"},
    ]

    # Obtener todas las vistas disponibles
    todas_vistas = (
        list(get_views_by_type(ViewPlan)) +
        list(get_views_by_type(ViewSection)) +
        list(get_views_by_type(View3D))
    )

    sheets_existentes = {s.SheetNumber: s for s in FilteredElementCollector(doc).OfClass(ViewSheet).ToElements()}

    for cfg in config_laminas:
        if cfg["numero"] in sheets_existentes:
            sheet = sheets_existentes[cfg["numero"]]
        else:
            sheet = ViewSheet.Create(doc, tb.Id)
            sheet.SheetNumber = cfg["numero"]
            sheet.Name = cfg["titulo"]

        # Metadatos del sheet — nombres en inglés y español según idioma de Revit
        _meta = [
            (["Drawn By",    "Dibujado por",   "Elaborado por"], autor),
            (["Designed By", "Diseñado por",   "Proyectado por"], autor),
            (["Project Name","Nombre del proyecto", "Proyecto"], proyecto),
        ]
        for nombres_param, valor in _meta:
            for nombre in nombres_param:
                p = sheet.LookupParameter(nombre)
                if p:
                    p.Set(valor)
                    break

        # Colocar vista correspondiente (centrada en A3)
        filtro = cfg["filtro"].lower()
        vista_match = next(
            (v for v in todas_vistas
             if filtro in v.Name.lower()
             and Viewport.CanAddViewToSheet(doc, sheet.Id, v.Id)),
            None,
        )
        if vista_match:
            # Centrar en el área real de la lámina usando Outline
            try:
                ol = sheet.Outline
                centro = XYZ(
                    (ol.Min.U + ol.Max.U) / 2.0,
                    (ol.Min.V + ol.Max.V) / 2.0,
                    0,
                )
            except Exception:
                centro = XYZ(m_to_ft(0.210), m_to_ft(0.148), 0)
            Viewport.Create(doc, sheet.Id, vista_match.Id, centro)

        sheets_creados.append({
            "numero": cfg["numero"],
            "titulo": cfg["titulo"],
            "id": sheet.Id.Value,
        })

    TransactionManager.Instance.TransactionTaskDone()

    OUT = sheets_creados
# ----------------------------------------
