# Dynamo graph 00_familias.dyn (Dynamo 4.0.0.0)
# Crea materiales, wall types, floor types y tipos estructurales. Ejecutar PRIMERO, antes de 01_niveles_grilla.dyn.

tipo_hormigon = CodeBlock { "H-21"; }
tipo_acero = CodeBlock { "ADN 420"; }
crear_materiales = Python(IN[0]=tipo_hormigon, IN[1]=tipo_acero)  # PythonNet3
# ---------- crear_materiales.python (113 lines) ----------
def _fi(v, d=0.0): return float(v) if v is not None else float(d)
def _ii(v, d=0):   return int(v)   if v is not None else int(d)
def _si(v, d=""):  return str(v)   if v is not None else str(d)
# --- py-building-gen: auto-reporte (inicio) ---
import os as _pbg_os, json as _pbg_json, datetime as _pbg_dt
_PBG_DIR = 'C:\\Users\\feder\\OneDrive\\Escritorio\\py-building-gen\\output\\dynamo\\edificio_caballito_int\\_reports'
_PBG_SCRIPT = '00_familias'
_PBG_NODE = 'Crear Materiales'
_PBG_KEY = '00_familias__00_crear_materiales'
def _pbg_warnings():
    try:
        _d = globals().get("doc", None)
        if _d is None:
            return []
        return [w.GetDescriptionText() for w in _d.GetWarnings()]
    except Exception:
        return []
def _pbg_report(_status, _out=None):
    try:
        _pbg_os.makedirs(_PBG_DIR, exist_ok=True)
        _rec = {
            "script": _PBG_SCRIPT,
            "nodo": _PBG_NODE,
            "key": _PBG_KEY,
            "status": _status,
            "timestamp": _pbg_dt.datetime.now().isoformat(timespec="seconds"),
            "out": _out,
            "warnings": _pbg_warnings() if _status == "ok" else [],
        }
        with open(_pbg_os.path.join(_PBG_DIR, _PBG_KEY + ".json"), "w", encoding="utf-8") as _f:
            _pbg_json.dump(_rec, _f, ensure_ascii=False, indent=2, default=str)
    except Exception:
        pass
_pbg_report("started")
# --- fin auto-reporte (inicio) ---

import clr
clr.AddReference("RevitAPI")
from Autodesk.Revit.DB import (
    Material, Color, FillPatternElement,
    FilteredElementCollector, Transaction,
    BuiltInParameter, ElementId,
)

clr.AddReference("RevitServices")
from RevitServices.Persistence import DocumentManager
doc  = DocumentManager.Instance.CurrentDBDocument

tipo_hormigon = _si(IN[0])   # "H-21" | "H-25" | "H-30"
tipo_acero    = _si(IN[1])   # "ADN 420" | "AL 220"

def color(r, g, b):
    return Color(r, g, b)

def get_or_create_material(nombre, r, g, b):
    col = FilteredElementCollector(doc).OfClass(Material).ToElements()
    mat = next((m for m in col if m.Name == nombre), None)
    if mat:
        return mat
    mat_id = Material.Create(doc, nombre)
    mat = doc.GetElement(mat_id)
    mat.Color = color(r, g, b)
    return mat

materiales_creados = []

with Transaction(doc, "py-building-gen: Materiales") as t:
    t.Start()

    # Hormigones según tipo seleccionado (+ los otros para referencia)
    for nombre, rgb in [
        ("Hormigón H-21",  (180, 180, 180)),
        ("Hormigón H-25",  (160, 160, 160)),
        ("Hormigón H-30",  (140, 140, 140)),
    ]:
        m = get_or_create_material(nombre, *rgb)
        materiales_creados.append(m.Name)

    # Aceros
    for nombre, rgb in [
        ("Acero ADN 420", (80,  80,  80)),
        ("Acero AL 220",  (100, 100, 100)),
    ]:
        m = get_or_create_material(nombre, *rgb)
        materiales_creados.append(m.Name)

    # Mampostería y terminaciones
    for nombre, rgb in [
        ("Ladrillo cerámico",    (195, 100,  60)),
        ("Mortero de cemento",   (220, 210, 200)),
        ("Revoque grueso",       (230, 220, 210)),
        ("Revoque fino / yeso",  (245, 240, 235)),
        ("Pintura látex blanca", (255, 255, 255)),
        ("Cámara de aire",       (200, 230, 255)),
        ("Membrana asfáltica",   ( 30,  30,  30)),
    ]:
        m = get_or_create_material(nombre, *rgb)
        materiales_creados.append(m.Name)

    t.Commit()

OUT = {
    "materiales_creados": materiales_creados,
    "tipo_hormigon_proyecto": tipo_hormigon,
    "tipo_acero_proyecto": tipo_acero,
}


# --- py-building-gen: auto-reporte (cierre) ---
try:
    _pbg_report("ok", _out=globals().get("OUT", None))
except Exception:
    pass
# ----------------------------------------
crear_wall_types = Python()  # PythonNet3
# ---------- crear_wall_types.python (151 lines) ----------
def _fi(v, d=0.0): return float(v) if v is not None else float(d)
def _ii(v, d=0):   return int(v)   if v is not None else int(d)
def _si(v, d=""):  return str(v)   if v is not None else str(d)
# --- py-building-gen: auto-reporte (inicio) ---
import os as _pbg_os, json as _pbg_json, datetime as _pbg_dt
_PBG_DIR = 'C:\\Users\\feder\\OneDrive\\Escritorio\\py-building-gen\\output\\dynamo\\edificio_caballito_int\\_reports'
_PBG_SCRIPT = '00_familias'
_PBG_NODE = 'Crear Wall Types'
_PBG_KEY = '00_familias__01_crear_wall_types'
def _pbg_warnings():
    try:
        _d = globals().get("doc", None)
        if _d is None:
            return []
        return [w.GetDescriptionText() for w in _d.GetWarnings()]
    except Exception:
        return []
def _pbg_report(_status, _out=None):
    try:
        _pbg_os.makedirs(_PBG_DIR, exist_ok=True)
        _rec = {
            "script": _PBG_SCRIPT,
            "nodo": _PBG_NODE,
            "key": _PBG_KEY,
            "status": _status,
            "timestamp": _pbg_dt.datetime.now().isoformat(timespec="seconds"),
            "out": _out,
            "warnings": _pbg_warnings() if _status == "ok" else [],
        }
        with open(_pbg_os.path.join(_PBG_DIR, _PBG_KEY + ".json"), "w", encoding="utf-8") as _f:
            _pbg_json.dump(_rec, _f, ensure_ascii=False, indent=2, default=str)
    except Exception:
        pass
_pbg_report("started")
# --- fin auto-reporte (inicio) ---

import clr
clr.AddReference("RevitAPI")
from Autodesk.Revit.DB import (
    WallType, CompoundStructure, CompoundStructureLayer,
    MaterialFunctionAssignment, Material, ElementId,
    FilteredElementCollector, Transaction,
    UnitUtils, UnitTypeId,
)
import System
from System.Collections.Generic import List as NetList

clr.AddReference("RevitServices")
from RevitServices.Persistence import DocumentManager
doc  = DocumentManager.Instance.CurrentDBDocument

def m_to_ft(m):
    return UnitUtils.ConvertToInternalUnits(m, UnitTypeId.Meters)

def get_material_id(nombre):
    col = FilteredElementCollector(doc).OfClass(Material).ToElements()
    mat = next((m for m in col if m.Name == nombre), None)
    return mat.Id if mat else ElementId.InvalidElementId

def get_or_duplicate_wall_type(nombre_base, nombre_nuevo):
    wts = FilteredElementCollector(doc).OfClass(WallType).ToElements()
    existente = next((wt for wt in wts if wt.Name == nombre_nuevo), None)
    if existente:
        return existente
    base = next((wt for wt in wts if nombre_base.lower() in wt.Name.lower()), wts[0])
    return base.Duplicate(nombre_nuevo)

def build_compound_structure(capas):
    net_layers = NetList[CompoundStructureLayer]()
    for espesor_m, funcion, nombre_mat in capas:
        mat_id = get_material_id(nombre_mat)
        net_layers.Add(CompoundStructureLayer(m_to_ft(espesor_m), funcion, mat_id))
    return CompoundStructure.CreateSimpleCompoundStructure(net_layers)

FA = MaterialFunctionAssignment  # alias
tipos_creados = []

# Buscar keyword para muro genérico en español e inglés
_kw_muro = ("generic", "genérico", "generico", "basic", "básico", "basico")

with Transaction(doc, "py-building-gen: Tipos de muro") as t:
    t.Start()

    # 1. Muro exterior 200mm
    wt_ext = get_or_duplicate_wall_type("genér", "Muro exterior - 200mm")
    capas_ext = [
        (0.015, FA.Finish1,    "Revoque fino / yeso"),
        (0.170, FA.Structure,  "Ladrillo cerámico"),
        (0.015, FA.Finish2,    "Revoque grueso"),
    ]
    wt_ext.SetCompoundStructure(build_compound_structure(capas_ext))
    tipos_creados.append("Muro exterior - 200mm")

    # 2. Tabique interior 100mm
    wt_tab = get_or_duplicate_wall_type("genér", "Tabique interior - 100mm")
    capas_tab = [
        (0.013, FA.Finish1,    "Revoque fino / yeso"),
        (0.074, FA.Structure,  "Ladrillo cerámico"),
        (0.013, FA.Finish2,    "Revoque fino / yeso"),
    ]
    wt_tab.SetCompoundStructure(build_compound_structure(capas_tab))
    tipos_creados.append("Tabique interior - 100mm")

    # 3. Medianera 200mm (sin revoque exterior — va contra pared lindante)
    wt_med = get_or_duplicate_wall_type("genér", "Medianera - 200mm")
    capas_med = [
        (0.185, FA.Structure,  "Ladrillo cerámico"),
        (0.015, FA.Finish2,    "Revoque grueso"),
    ]
    wt_med.SetCompoundStructure(build_compound_structure(capas_med))
    tipos_creados.append("Medianera - 200mm")

    # 4. Muro cortafuego 200mm (REI-120 — divisoria entre departamentos, CABA Art. 6.1)
    wt_cf = get_or_duplicate_wall_type("genér", "Muro cortafuego - 200mm")
    capas_cf = [
        (0.020, FA.Finish1,   "Revoque fino / yeso"),
        (0.160, FA.Structure, "Ladrillo cerámico"),
        (0.020, FA.Finish2,   "Revoque fino / yeso"),
    ]
    wt_cf.SetCompoundStructure(build_compound_structure(capas_cf))
    tipos_creados.append("Muro cortafuego - 200mm")

    # 5. Muro shaft HA 300mm (REI-180 — caja escalera y ascensor)
    wt_sh = get_or_duplicate_wall_type("genér", "Muro shaft HA - 300mm")
    capas_sh = [
        (0.300, FA.Structure, "Hormigón H-25"),
    ]
    wt_sh.SetCompoundStructure(build_compound_structure(capas_sh))
    tipos_creados.append("Muro shaft HA - 300mm")

    # 6. Tabique de baño 100mm (ladrillo + membrana hidrófuga)
    wt_ban = get_or_duplicate_wall_type("genér", "Tabique baño - 100mm")
    capas_ban = [
        (0.010, FA.Finish1,   "Revoque fino / yeso"),
        (0.074, FA.Structure, "Ladrillo cerámico"),
        (0.010, FA.Substrate, "Mortero de cemento"),
        (0.006, FA.Finish2,   "Membrana asfáltica"),
    ]
    wt_ban.SetCompoundStructure(build_compound_structure(capas_ban))
    tipos_creados.append("Tabique baño - 100mm")

    t.Commit()

OUT = tipos_creados


# --- py-building-gen: auto-reporte (cierre) ---
try:
    _pbg_report("ok", _out=globals().get("OUT", None))
except Exception:
    pass
# ----------------------------------------
espesor_losa_cm = CodeBlock { 30; }
tipo_hormigon_2 = CodeBlock { "H-21"; }
crear_floor_types = Python(IN[0]=espesor_losa_cm, IN[1]=tipo_hormigon_2)  # PythonNet3
# ---------- crear_floor_types.python (172 lines) ----------
def _fi(v, d=0.0): return float(v) if v is not None else float(d)
def _ii(v, d=0):   return int(v)   if v is not None else int(d)
def _si(v, d=""):  return str(v)   if v is not None else str(d)
# --- py-building-gen: auto-reporte (inicio) ---
import os as _pbg_os, json as _pbg_json, datetime as _pbg_dt
_PBG_DIR = 'C:\\Users\\feder\\OneDrive\\Escritorio\\py-building-gen\\output\\dynamo\\edificio_caballito_int\\_reports'
_PBG_SCRIPT = '00_familias'
_PBG_NODE = 'Crear Floor Types'
_PBG_KEY = '00_familias__02_crear_floor_types'
def _pbg_warnings():
    try:
        _d = globals().get("doc", None)
        if _d is None:
            return []
        return [w.GetDescriptionText() for w in _d.GetWarnings()]
    except Exception:
        return []
def _pbg_report(_status, _out=None):
    try:
        _pbg_os.makedirs(_PBG_DIR, exist_ok=True)
        _rec = {
            "script": _PBG_SCRIPT,
            "nodo": _PBG_NODE,
            "key": _PBG_KEY,
            "status": _status,
            "timestamp": _pbg_dt.datetime.now().isoformat(timespec="seconds"),
            "out": _out,
            "warnings": _pbg_warnings() if _status == "ok" else [],
        }
        with open(_pbg_os.path.join(_PBG_DIR, _PBG_KEY + ".json"), "w", encoding="utf-8") as _f:
            _pbg_json.dump(_rec, _f, ensure_ascii=False, indent=2, default=str)
    except Exception:
        pass
_pbg_report("started")
# --- fin auto-reporte (inicio) ---

import clr
clr.AddReference("RevitAPI")
from Autodesk.Revit.DB import (
    FloorType, CompoundStructure, CompoundStructureLayer,
    MaterialFunctionAssignment, Material, ElementId,
    FilteredElementCollector, ElementCategoryFilter,
    BuiltInCategory, Transaction,
    UnitUtils, UnitTypeId, OpeningWrappingCondition,
)
import System
from System.Collections.Generic import List as NetList

clr.AddReference("RevitServices")
from RevitServices.Persistence import DocumentManager
doc  = DocumentManager.Instance.CurrentDBDocument

espesor_losa_cm = _fi(IN[0], 20.0)
tipo_hormigon   = _si(IN[1], "H-21")

def m_to_ft(m):
    return UnitUtils.ConvertToInternalUnits(m, UnitTypeId.Meters)

def get_material_id(nombre):
    col = FilteredElementCollector(doc).OfClass(Material).ToElements()
    mat = next((m for m in col if m.Name == nombre), None)
    return mat.Id if mat else ElementId.InvalidElementId

def get_or_duplicate_floor_type(nombre_nuevo):
    cat_filter = ElementCategoryFilter(BuiltInCategory.OST_Floors)
    fts = (FilteredElementCollector(doc)
           .OfClass(FloorType)
           .WherePasses(cat_filter)
           .ToElements())
    existente = next((ft for ft in fts if ft.Name == nombre_nuevo), None)
    if existente:
        return existente
    if not fts:
        raise Exception("No se encontraron FloorTypes OST_Floors en el modelo.")
    return fts[0].Duplicate(nombre_nuevo)

FA = MaterialFunctionAssignment

def build_layers(capas):
    """Construye NetList[CompoundStructureLayer] y devuelve (net, idx_estructura).

    Regla de Revit: las capas de MEMBRANA deben tener espesor CERO. Cualquier otro
    valor invalida el CompoundStructure.
    """
    net = NetList[CompoundStructureLayer]()
    idx_struct = 0
    for i, (esp, func, mat_nombre) in enumerate(capas):
        mat_id = get_material_id(mat_nombre)
        espesor_ft = 0.0 if func == FA.Membrane else m_to_ft(esp)
        net.Add(CompoundStructureLayer(espesor_ft, func, mat_id))
        if func == FA.Structure:
            idx_struct = i
    return net, idx_struct

def construir_cs(ft, capas):
    """Reemplaza capas en el CS existente del FloorType y fija la capa estructural."""
    net, idx_struct = build_layers(capas)
    cs = ft.GetCompoundStructure()
    if cs is None:
        cs = CompoundStructure.CreateSimpleCompoundStructure(net)
    else:
        cs.SetLayers(net)
    # Tras SetLayers el índice estructural puede quedar apuntando a otra capa
    try:
        cs.StructuralMaterialIndex = idx_struct
    except Exception:
        pass
    return cs

def validar_cs(cs):
    """Llama a CompoundStructure.IsValid y devuelve (ok, [errores...]).

    IsValid(doc, out errors, out faultyLayers) → PythonNet3 lo expone como tupla.
    """
    try:
        chk = cs.IsValid(doc)
    except Exception as e:
        return (None, ["IsValid lanzo excepcion: " + str(e)])
    if isinstance(chk, tuple):
        ok = chk[0]
        errs = []
        for extra in chk[1:]:
            if extra is None:
                continue
            try:
                errs.extend([str(x) for x in extra])
            except Exception:
                errs.append(str(extra))
        return (ok, errs)
    return (chk, [])

espesor_m = espesor_losa_cm / 100.0
nombre_mat_ha = f"Hormigón {tipo_hormigon}"

definiciones = [
    (f"Losa HA {tipo_hormigon} - {espesor_losa_cm:.0f}cm", [
        (0.030,     FA.Substrate, "Mortero de cemento"),
        (espesor_m, FA.Structure, nombre_mat_ha),
    ]),
    (f"Losa azotea HA {tipo_hormigon} - {espesor_losa_cm:.0f}cm", [
        (0.000,     FA.Membrane,  "Membrana asfáltica"),   # membrana = espesor cero
        (0.020,     FA.Substrate, "Mortero de cemento"),
        (espesor_m, FA.Structure, nombre_mat_ha),
    ]),
]

tipos_creados = []
diagnostico = []

with Transaction(doc, "py-building-gen: Tipos de losa") as t:
    t.Start()
    for nombre, capas in definiciones:
        ft = get_or_duplicate_floor_type(nombre)
        cs = construir_cs(ft, capas)
        ok, errs = validar_cs(cs)
        if ok:
            ft.SetCompoundStructure(cs)
            tipos_creados.append(nombre)
        else:
            # No hacemos SetCompoundStructure (lanzaria y cortaria la transaccion).
            # Reportamos el error exacto para diagnostico.
            diagnostico.append({"tipo": nombre, "valido": str(ok), "errores": errs})
    t.Commit()

OUT = {"creados": tipos_creados, "diagnostico": diagnostico}


# --- py-building-gen: auto-reporte (cierre) ---
try:
    _pbg_report("ok", _out=globals().get("OUT", None))
except Exception:
    pass
# ----------------------------------------
lado_col_cm = CodeBlock { 35; }
ancho_viga_cm = CodeBlock { 45; }
alto_viga_cm = CodeBlock { 85; }
tipo_hormigon_3 = CodeBlock { "H-21"; }
crear_tipos_estructurales = Python(IN[0]=lado_col_cm, IN[1]=ancho_viga_cm, IN[2]=alto_viga_cm, IN[3]=tipo_hormigon_3)  # PythonNet3
# ---------- crear_tipos_estructurales.python (165 lines) ----------
def _fi(v, d=0.0): return float(v) if v is not None else float(d)
def _ii(v, d=0):   return int(v)   if v is not None else int(d)
def _si(v, d=""):  return str(v)   if v is not None else str(d)
# --- py-building-gen: auto-reporte (inicio) ---
import os as _pbg_os, json as _pbg_json, datetime as _pbg_dt
_PBG_DIR = 'C:\\Users\\feder\\OneDrive\\Escritorio\\py-building-gen\\output\\dynamo\\edificio_caballito_int\\_reports'
_PBG_SCRIPT = '00_familias'
_PBG_NODE = 'Crear Tipos Estructurales'
_PBG_KEY = '00_familias__03_crear_tipos_estructurales'
def _pbg_warnings():
    try:
        _d = globals().get("doc", None)
        if _d is None:
            return []
        return [w.GetDescriptionText() for w in _d.GetWarnings()]
    except Exception:
        return []
def _pbg_report(_status, _out=None):
    try:
        _pbg_os.makedirs(_PBG_DIR, exist_ok=True)
        _rec = {
            "script": _PBG_SCRIPT,
            "nodo": _PBG_NODE,
            "key": _PBG_KEY,
            "status": _status,
            "timestamp": _pbg_dt.datetime.now().isoformat(timespec="seconds"),
            "out": _out,
            "warnings": _pbg_warnings() if _status == "ok" else [],
        }
        with open(_pbg_os.path.join(_PBG_DIR, _PBG_KEY + ".json"), "w", encoding="utf-8") as _f:
            _pbg_json.dump(_rec, _f, ensure_ascii=False, indent=2, default=str)
    except Exception:
        pass
_pbg_report("started")
# --- fin auto-reporte (inicio) ---

import clr
clr.AddReference("RevitAPI")
from Autodesk.Revit.DB import (
    FamilySymbol, Material, ElementId,
    FilteredElementCollector, BuiltInCategory,
    Transaction, UnitUtils, UnitTypeId,
)

clr.AddReference("RevitServices")
from RevitServices.Persistence import DocumentManager
doc  = DocumentManager.Instance.CurrentDBDocument

lado_col_cm   = _fi(IN[0], 35.0)
ancho_viga_cm = _fi(IN[1], 25.0)
alto_viga_cm  = _fi(IN[2], 50.0)
tipo_hormigon = _si(IN[3], "H-21")

def m_to_ft(m):
    return UnitUtils.ConvertToInternalUnits(m, UnitTypeId.Meters)

def get_material_id(nombre):
    col = FilteredElementCollector(doc).OfClass(Material).ToElements()
    mat = next((m for m in col if m.Name == nombre), None)
    return mat.Id if mat else ElementId.InvalidElementId

_KW_COL  = ("concrete", "hormigon", "hormigón", "pilar", "column", "ha ", "rectangular")
_KW_VIGA = ("concrete", "hormigon", "hormigón", "viga",  "beam",   "ha ", "rectangular")

def find_symbol(categoria, keywords):
    col = (FilteredElementCollector(doc)
           .OfClass(FamilySymbol)
           .OfCategory(categoria)
           .ToElements())
    match = next((s for s in col if any(k in s.FamilyName.lower() for k in keywords)), None)
    return match or (col[0] if col else None)

def set_param(symbol, nombres, valor_m):
    """Intenta asignar un parámetro de sección por múltiples nombres posibles."""
    for nombre in nombres:
        p = symbol.LookupParameter(nombre)
        if p and not p.IsReadOnly:
            try:
                p.Set(m_to_ft(valor_m))
                return True
            except Exception:
                pass
    return False

mat_id_ha = get_material_id(f"Hormigón {tipo_hormigon}")
tipos_creados = []

with Transaction(doc, "py-building-gen: Tipos estructurales") as t:
    t.Start()

    # --- Columnas ---
    sym_col = find_symbol(BuiltInCategory.OST_StructuralColumns, _KW_COL)
    if sym_col:
        if not sym_col.IsActive:
            sym_col.Activate()

        nombre_col = f"Columna HA {lado_col_cm:.0f}x{lado_col_cm:.0f}cm"
        try:
            nuevo_col = sym_col.Duplicate(nombre_col)
        except Exception:
            nuevo_col = sym_col

        # Parámetros de sección (nombres varían según familia y versión)
        lado = lado_col_cm / 100.0
        set_param(nuevo_col, ["b", "Ancho", "Width", "w"],  lado)
        set_param(nuevo_col, ["h", "Alto",  "Depth", "d"],  lado)

        # Material estructural
        p_mat = nuevo_col.LookupParameter("Material estructural") or                 nuevo_col.LookupParameter("Structural Material") or                 nuevo_col.LookupParameter("Material")
        if p_mat and mat_id_ha != ElementId.InvalidElementId:
            try:
                p_mat.Set(mat_id_ha)
            except Exception:
                pass

        tipos_creados.append(nombre_col)

    # --- Vigas ---
    sym_viga = find_symbol(BuiltInCategory.OST_StructuralFraming, _KW_VIGA)
    if sym_viga:
        if not sym_viga.IsActive:
            sym_viga.Activate()

        nombre_viga = f"Viga HA {ancho_viga_cm:.0f}x{alto_viga_cm:.0f}cm"
        try:
            nuevo_viga = sym_viga.Duplicate(nombre_viga)
        except Exception:
            nuevo_viga = sym_viga

        ancho = ancho_viga_cm / 100.0
        alto  = alto_viga_cm  / 100.0
        set_param(nuevo_viga, ["b", "Ancho", "Width",  "w"], ancho)
        set_param(nuevo_viga, ["h", "Alto",  "Depth",  "d"], alto)

        p_mat = nuevo_viga.LookupParameter("Material estructural") or                 nuevo_viga.LookupParameter("Structural Material") or                 nuevo_viga.LookupParameter("Material")
        if p_mat and mat_id_ha != ElementId.InvalidElementId:
            try:
                p_mat.Set(mat_id_ha)
            except Exception:
                pass

        tipos_creados.append(nombre_viga)

    t.Commit()

if not tipos_creados:
    OUT = {
        "resultado": "No se encontraron familias estructurales en el template.",
        "accion_requerida": (
            "Cargar manualmente una familia de columna y viga de HA "
            "desde Insertar → Cargar familia, luego volver a correr este script."
        ),
    }
else:
    OUT = {
        "tipos_creados": tipos_creados,
        "nota": "Verificar secciones en Propiedades de tipo antes de correr 04_estructura.dyn",
    }


# --- py-building-gen: auto-reporte (cierre) ---
try:
    _pbg_report("ok", _out=globals().get("OUT", None))
except Exception:
    pass
# ----------------------------------------
lado_zap_cm = CodeBlock { 245; }
espesor_zap_cm = CodeBlock { 50; }
tipo_hormigon_4 = CodeBlock { "H-21"; }
familias_dir = CodeBlock { "C:/Users/feder/OneDrive/Escritorio/py-building-gen/data/familias"; }
crear_resolver_familia_zapata = Python(IN[0]=lado_zap_cm, IN[1]=espesor_zap_cm, IN[2]=tipo_hormigon_4, IN[3]=familias_dir)  # PythonNet3
# ---------- crear_resolver_familia_zapata.python (224 lines) ----------
def _fi(v, d=0.0): return float(v) if v is not None else float(d)
def _ii(v, d=0):   return int(v)   if v is not None else int(d)
def _si(v, d=""):  return str(v)   if v is not None else str(d)
# --- py-building-gen: auto-reporte (inicio) ---
import os as _pbg_os, json as _pbg_json, datetime as _pbg_dt
_PBG_DIR = 'C:\\Users\\feder\\OneDrive\\Escritorio\\py-building-gen\\output\\dynamo\\edificio_caballito_int\\_reports'
_PBG_SCRIPT = '00_familias'
_PBG_NODE = 'Crear/Resolver Familia Zapata'
_PBG_KEY = '00_familias__04_crear_resolver_familia_zapata'
def _pbg_warnings():
    try:
        _d = globals().get("doc", None)
        if _d is None:
            return []
        return [w.GetDescriptionText() for w in _d.GetWarnings()]
    except Exception:
        return []
def _pbg_report(_status, _out=None):
    try:
        _pbg_os.makedirs(_PBG_DIR, exist_ok=True)
        _rec = {
            "script": _PBG_SCRIPT,
            "nodo": _PBG_NODE,
            "key": _PBG_KEY,
            "status": _status,
            "timestamp": _pbg_dt.datetime.now().isoformat(timespec="seconds"),
            "out": _out,
            "warnings": _pbg_warnings() if _status == "ok" else [],
        }
        with open(_pbg_os.path.join(_PBG_DIR, _PBG_KEY + ".json"), "w", encoding="utf-8") as _f:
            _pbg_json.dump(_rec, _f, ensure_ascii=False, indent=2, default=str)
    except Exception:
        pass
_pbg_report("started")
# --- fin auto-reporte (inicio) ---

import clr, os
clr.AddReference("RevitAPI")
from Autodesk.Revit.DB import (
    FamilySymbol, Family, Material, ElementId,
    FilteredElementCollector, BuiltInCategory,
    Transaction, UnitUtils, UnitTypeId,
    IFamilyLoadOptions, FamilySource,
    XYZ, Line, CurveArray, CurveArrArray, Plane, SketchPlane,
)
clr.AddReference("RevitServices")
from RevitServices.Persistence import DocumentManager

doc = DocumentManager.Instance.CurrentDBDocument
app = doc.Application

lado_zap_cm    = _fi(IN[0], 120.0)
espesor_zap_cm = _fi(IN[1], 50.0)
tipo_hormigon  = _si(IN[2], "H-21")
familias_dir   = _si(IN[3], "")

lado_m      = lado_zap_cm / 100.0
espesor_m   = espesor_zap_cm / 100.0
nombre_tipo = "Zapata HA %dx%dcm" % (int(round(lado_zap_cm)), int(round(lado_zap_cm)))
CAT     = BuiltInCategory.OST_StructuralFoundation
KW_RFA  = ("zapata", "footing", "fundac", "base", "foundation")
KW_RFT  = ("structural foundation", "base estructural", "cimentaci", "foundation")
log = []

def m_to_ft(m):
    return UnitUtils.ConvertToInternalUnits(m, UnitTypeId.Meters)

def get_material_id(nombre):
    col = FilteredElementCollector(doc).OfClass(Material).ToElements()
    mat = next((m for m in col if m.Name == nombre), None)
    return mat.Id if mat else ElementId.InvalidElementId

def foundation_syms():
    return list(FilteredElementCollector(doc)
                .OfClass(FamilySymbol).OfCategory(CAT).ToElements())

# IFamilyLoadOptions — en PythonNet3 los parametros 'out' se devuelven como tupla
# (mismo patron que CompoundStructure.IsValid en _CODE_LOSA_TIPO).
class _Opts(IFamilyLoadOptions):
    def OnFamilyFound(self, familyInUse, overwriteParameterValues):
        return (True, True)
    def OnSharedFamilyFound(self, sharedFamily, familyInUse, source, overwriteParameterValues):
        return (True, FamilySource.Family, True)

def set_seccion(sym):
    for n in ("Width", "Ancho", "b", "w", "Length", "Largo", "l"):
        p = sym.LookupParameter(n)
        if p and not p.IsReadOnly:
            try: p.Set(m_to_ft(lado_m))
            except Exception: pass
    for n in ("Thickness", "Espesor", "h", "d", "t", "Depth"):
        p = sym.LookupParameter(n)
        if p and not p.IsReadOnly:
            try: p.Set(m_to_ft(espesor_m)); break
            except Exception: pass
    mat_id = get_material_id("Hormigón " + tipo_hormigon)
    if mat_id != ElementId.InvalidElementId:
        p = (sym.LookupParameter("Material estructural")
             or sym.LookupParameter("Structural Material")
             or sym.LookupParameter("Material"))
        if p and not p.IsReadOnly:
            try: p.Set(mat_id)
            except Exception: pass

# ── Tier 1: familia .rfa propia versionada en data/familias/ ───────────────────
def tier_rfa():
    if not familias_dir or not os.path.isdir(familias_dir):
        return None
    rfas = []
    for root, dirs, files in os.walk(familias_dir):
        for f in files:
            low = f.lower()
            if low.endswith(".rfa") and any(k in low for k in KW_RFA):
                rfas.append(os.path.join(root, f))
    for path in rfas:
        antes = set(s.Id.Value for s in foundation_syms())
        try:
            doc.LoadFamily(path, _Opts())   # LoadFamily abre su propia transaccion
        except Exception as e:
            log.append("rfa fail %s: %s" % (os.path.basename(path), e))
            continue
        nuevos = [s for s in foundation_syms() if s.Id.Value not in antes]
        if nuevos:
            return nuevos[0]
        existentes = foundation_syms()      # ya estaba cargada
        if existentes:
            return existentes[0]
    return None

# ── Tier 2: familia de fundacion ya presente en el template ────────────────────
def tier_template():
    syms = foundation_syms()
    return syms[0] if syms else None

# ── Tier 3: autogenerar familia parametrica (extrusion de caja desde .rft) ─────
def find_rft():
    base = app.FamilyTemplatePath
    if not base or not os.path.isdir(base):
        return None
    cands = []
    for root, dirs, files in os.walk(base):
        for f in files:
            low = f.lower()
            if low.endswith(".rft") and any(k in low for k in KW_RFT):
                cands.append(os.path.join(root, f))
    # preferir base aislada: penalizar plantillas de losa/corrida
    cands.sort(key=lambda p: any(b in p.lower() for b in ("slab", "wall", "losa", "corrid")))
    return cands[0] if cands else None

def tier_autogen():
    rft = find_rft()
    if not rft:
        log.append("Sin .rft de fundacion en FamilyTemplatePath=%s" % app.FamilyTemplatePath)
        return None
    famdoc = app.NewFamilyDocument(rft)
    try:
        with Transaction(famdoc, "py-building-gen: geometria zapata") as t:
            t.Start()
            half = m_to_ft(lado_m / 2.0)
            pts = [XYZ(-half, -half, 0), XYZ(half, -half, 0),
                   XYZ(half, half, 0), XYZ(-half, half, 0)]
            ca = CurveArray()
            for i in range(4):
                ca.Append(Line.CreateBound(pts[i], pts[(i + 1) % 4]))
            caa = CurveArrArray(); caa.Append(ca)
            sk = SketchPlane.Create(famdoc, Plane.CreateByNormalAndOrigin(XYZ.BasisZ, XYZ.Zero))
            famdoc.FamilyCreate.NewExtrusion(True, caa, sk, m_to_ft(espesor_m))
            t.Commit()
        antes = set(s.Id.Value for s in foundation_syms())
        famdoc.LoadFamily(doc, _Opts())
        famdoc.Close(False)
        nuevos = [s for s in foundation_syms() if s.Id.Value not in antes]
        if nuevos:
            return nuevos[0]
        return foundation_syms()[0] if foundation_syms() else None
    except Exception as e:
        log.append("autogen fail: %s" % e)
        try: famdoc.Close(False)
        except Exception: pass
        return None

# ── Cascada ─────────────────────────────────────────────────────────────────
base_sym = None
metodo = None
for nombre_metodo, fn in (("rfa_propia", tier_rfa),
                          ("template", tier_template),
                          ("autogenerada", tier_autogen)):
    base_sym = fn()
    if base_sym is not None:
        metodo = nombre_metodo
        break

if base_sym is None:
    OUT = {
        "resultado": "No se pudo resolver una familia de fundacion.",
        "log": log,
        "accion_requerida": ("Colocar una familia .rfa de zapata en data/familias/ "
                             "o cargar una plantilla de fundacion en Revit."),
    }
else:
    with Transaction(doc, "py-building-gen: Tipo de zapata") as t:
        t.Start()
        sym = next((s for s in foundation_syms() if s.Name == nombre_tipo), None)
        if sym is None:
            try:
                sym = base_sym.Duplicate(nombre_tipo)
            except Exception:
                sym = base_sym
        set_seccion(sym)
        if not sym.IsActive:
            sym.Activate()
        t.Commit()
    OUT = {
        "tipo_creado": nombre_tipo, "metodo": metodo,
        "familia": sym.Family.Name, "lado_cm": lado_zap_cm,
        "espesor_cm": espesor_zap_cm, "log": log,
    }


# --- py-building-gen: auto-reporte (cierre) ---
try:
    _pbg_report("ok", _out=globals().get("OUT", None))
except Exception:
    pass
# ----------------------------------------
