# Dynamo graph 01_niveles_grilla.dyn (Dynamo 4.0.0.0)
# Crea Levels y Grids en Revit 2027. Generado por py-building-gen. Ejecutar primero.

pisos_tipo = CodeBlock { 6; }
altura_pb_m = CodeBlock { 3.5; }
altura_tipo_m = CodeBlock { 2.8; }
tiene_subsuelo = CodeBlock { false; }
cant_subsuelos = CodeBlock { 0; }
tiene_azotea = CodeBlock { true; }
crear_niveles = Python(IN[0]=pisos_tipo, IN[1]=altura_pb_m, IN[2]=altura_tipo_m, IN[3]=tiene_subsuelo, IN[4]=cant_subsuelos, IN[5]=tiene_azotea)  # PythonNet3
# ---------- crear_niveles.python (107 lines) ----------
def _fi(v, d=0.0): return float(v) if v is not None else float(d)
def _ii(v, d=0):   return int(v)   if v is not None else int(d)
def _si(v, d=""):  return str(v)   if v is not None else str(d)
# --- py-building-gen: auto-reporte (inicio) ---
import os as _pbg_os, json as _pbg_json, datetime as _pbg_dt
_PBG_DIR = 'C:\\Users\\feder\\OneDrive\\Escritorio\\py-building-gen\\output\\dynamo\\edificio_caballito_int\\_reports'
_PBG_SCRIPT = '01_niveles_grilla'
_PBG_NODE = 'Crear Niveles'
_PBG_KEY = '01_niveles_grilla__00_crear_niveles'
def _pbg_warnings():
    try:
        _d = globals().get("doc", None)
        if _d is None:
            return []
        return [w.GetDescriptionText() for w in _d.GetWarnings()]
    except Exception:
        return []
def _pbg_report(_status, _out=None):
    try:
        _pbg_os.makedirs(_PBG_DIR, exist_ok=True)
        _rec = {
            "script": _PBG_SCRIPT,
            "nodo": _PBG_NODE,
            "key": _PBG_KEY,
            "status": _status,
            "timestamp": _pbg_dt.datetime.now().isoformat(timespec="seconds"),
            "out": _out,
            "warnings": _pbg_warnings() if _status == "ok" else [],
        }
        with open(_pbg_os.path.join(_PBG_DIR, _PBG_KEY + ".json"), "w", encoding="utf-8") as _f:
            _pbg_json.dump(_rec, _f, ensure_ascii=False, indent=2, default=str)
    except Exception:
        pass
_pbg_report("started")
# --- fin auto-reporte (inicio) ---

import clr
clr.AddReference("RevitAPI")
clr.AddReference("RevitAPIUI")
clr.AddReference("RevitServices")
from RevitServices.Persistence import DocumentManager
from Autodesk.Revit.DB import (
    Level, Transaction, XYZ, Line, Grid,
    UnitUtils, UnitTypeId,
)
import Autodesk.Revit.DB as DB

clr.AddReference("RevitServices")
from RevitServices.Persistence import DocumentManager
doc  = DocumentManager.Instance.CurrentDBDocument
uidoc = DocumentManager.Instance.CurrentUIDocument

# --- Parámetros desde nodos Code Block ---
pisos_tipo   = _ii(IN[0])
altura_pb    = _fi(IN[1])   # metros
altura_tipo  = _fi(IN[2])   # metros
tiene_sub    = bool(IN[3])
cant_sub     = _ii(IN[4])
tiene_azotea = bool(IN[5])

def m_to_ft(m: float) -> float:
    """Convierte metros a pies (unidad interna de Revit)."""
    return UnitUtils.ConvertToInternalUnits(m, UnitTypeId.Meters)

niveles_creados = []

with Transaction(doc, "py-building-gen: Niveles") as t:
    t.Start()

    # Subsuelos (debajo de +-0.00)
    for i in range(cant_sub, 0, -1):
        elev_m = -i * altura_tipo
        nombre = f"SS{i:02d}"
        lvl = Level.Create(doc, m_to_ft(elev_m))
        lvl.Name = nombre
        niveles_creados.append({"nombre": nombre, "elevacion_m": elev_m})

    # Planta baja (±0.00)
    lvl_pb = Level.Create(doc, m_to_ft(0.0))
    lvl_pb.Name = "PB"
    niveles_creados.append({"nombre": "PB", "elevacion_m": 0.0})

    # Pisos tipo
    for i in range(1, pisos_tipo + 1):
        elev_m = altura_pb + (i - 1) * altura_tipo
        nombre = f"P{i:02d}"
        lvl = Level.Create(doc, m_to_ft(elev_m))
        lvl.Name = nombre
        niveles_creados.append({"nombre": nombre, "elevacion_m": elev_m})

    # Azotea
    if tiene_azotea:
        elev_m = altura_pb + pisos_tipo * altura_tipo
        lvl = Level.Create(doc, m_to_ft(elev_m))
        lvl.Name = "AZO"
        niveles_creados.append({"nombre": "AZO", "elevacion_m": elev_m})

    t.Commit()

OUT = niveles_creados


# --- py-building-gen: auto-reporte (cierre) ---
try:
    _pbg_report("ok", _out=globals().get("OUT", None))
except Exception:
    pass
# ----------------------------------------
frente_m = CodeBlock { 10.0; }
fondo_m = CodeBlock { 24.0; }
crear_grilla = Python(IN[0]=frente_m, IN[1]=fondo_m)  # PythonNet3
# ---------- crear_grilla.python (127 lines) ----------
def _fi(v, d=0.0): return float(v) if v is not None else float(d)
def _ii(v, d=0):   return int(v)   if v is not None else int(d)
def _si(v, d=""):  return str(v)   if v is not None else str(d)
# --- py-building-gen: auto-reporte (inicio) ---
import os as _pbg_os, json as _pbg_json, datetime as _pbg_dt
_PBG_DIR = 'C:\\Users\\feder\\OneDrive\\Escritorio\\py-building-gen\\output\\dynamo\\edificio_caballito_int\\_reports'
_PBG_SCRIPT = '01_niveles_grilla'
_PBG_NODE = 'Crear Grilla'
_PBG_KEY = '01_niveles_grilla__01_crear_grilla'
def _pbg_warnings():
    try:
        _d = globals().get("doc", None)
        if _d is None:
            return []
        return [w.GetDescriptionText() for w in _d.GetWarnings()]
    except Exception:
        return []
def _pbg_report(_status, _out=None):
    try:
        _pbg_os.makedirs(_PBG_DIR, exist_ok=True)
        _rec = {
            "script": _PBG_SCRIPT,
            "nodo": _PBG_NODE,
            "key": _PBG_KEY,
            "status": _status,
            "timestamp": _pbg_dt.datetime.now().isoformat(timespec="seconds"),
            "out": _out,
            "warnings": _pbg_warnings() if _status == "ok" else [],
        }
        with open(_pbg_os.path.join(_PBG_DIR, _PBG_KEY + ".json"), "w", encoding="utf-8") as _f:
            _pbg_json.dump(_rec, _f, ensure_ascii=False, indent=2, default=str)
    except Exception:
        pass
_pbg_report("started")
# --- fin auto-reporte (inicio) ---

import clr
clr.AddReference("RevitAPI")
clr.AddReference("RevitServices")
from RevitServices.Persistence import DocumentManager
from Autodesk.Revit.DB import (
    Grid, Line, XYZ, Transaction,
    FilteredElementCollector,
    UnitUtils, UnitTypeId,
)
doc = DocumentManager.Instance.CurrentDBDocument

frente_m = _fi(IN[0])
fondo_m  = _fi(IN[1])
PASO     = 5.0    # m — modulo objetivo entre ejes
MIN_BAY  = 2.5    # m — bahia minima; si el resto es menor, se absorbe

def m_to_ft(m):
    return UnitUtils.ConvertToInternalUnits(m, UnitTypeId.Meters)

def ejes(span, paso=PASO, min_bay=MIN_BAY):
    """Posiciones de eje en [0, span]: modulo de 5m + eje de cierre en el borde.

    Siempre incluye 0 y span (medianeras/fachada). Si el ultimo paño quedaria
    mas chico que min_bay, se fusiona con el anterior (evita bahias minusculas).
    """
    if span <= paso + 1e-9:
        return [0.0, round(span, 4)]
    pos = []
    x = 0.0
    while x < span - 1e-6:
        pos.append(round(x, 4))
        x += paso
    resto = span - pos[-1]
    if resto < min_bay and len(pos) >= 2:
        pos.pop()            # absorber: la ultima bahia queda paso+resto
    pos.append(round(span, 4))
    return pos

def es_grid_nuestro(nombre):
    # Ejes de py-building-gen: una sola letra A-Z, o solo digitos
    return (len(nombre) == 1 and nombre.isalpha()) or nombre.isdigit()

xs = ejes(frente_m)   # ejes verticales (A, B, C…) a lo ancho del frente
ys = ejes(fondo_m)    # ejes horizontales (1, 2, 3…) a lo largo del fondo
grillas_creadas = []

with Transaction(doc, "py-building-gen: Grilla") as t:
    t.Start()

    # Idempotencia: borrar ejes previos de py-building-gen y reposicionarlos.
    # (Grid.Create + asignar un nombre ya usado lanza error al re-correr.)
    for g in list(FilteredElementCollector(doc).OfClass(Grid).ToElements()):
        if es_grid_nuestro(g.Name):
            try: doc.Delete(g.Id)
            except Exception: pass

    # Ejes verticales A, B, C … (x constante, corren en Y)
    for i, x in enumerate(xs):
        nombre = chr(ord("A") + i)
        p1 = XYZ(m_to_ft(x), m_to_ft(-1.0), 0)
        p2 = XYZ(m_to_ft(x), m_to_ft(fondo_m + 1.0), 0)
        g = Grid.Create(doc, Line.CreateBound(p1, p2))
        g.Name = nombre
        grillas_creadas.append(nombre)

    # Ejes horizontales 1, 2, 3 … (y constante, corren en X)
    for i, y in enumerate(ys):
        nombre = str(i + 1)
        p1 = XYZ(m_to_ft(-1.0), m_to_ft(y), 0)
        p2 = XYZ(m_to_ft(frente_m + 1.0), m_to_ft(y), 0)
        g = Grid.Create(doc, Line.CreateBound(p1, p2))
        g.Name = nombre
        grillas_creadas.append(nombre)

    t.Commit()

OUT = {
    "ejes": grillas_creadas,
    "total": len(grillas_creadas),
    "frente_m_recibido": frente_m,
    "fondo_m_recibido": fondo_m,
    "x_ejes_m": [round(v, 2) for v in xs],
    "y_ejes_m": [round(v, 2) for v in ys],
}


# --- py-building-gen: auto-reporte (cierre) ---
try:
    _pbg_report("ok", _out=globals().get("OUT", None))
except Exception:
    pass
# ----------------------------------------
pisos_tipo_2 = CodeBlock { 6; }
tiene_azotea_2 = CodeBlock { true; }
plantas_por_disciplina = Python(IN[0]=pisos_tipo_2, IN[1]=tiene_azotea_2)  # PythonNet3
# ---------- plantas_por_disciplina.python (99 lines) ----------
def _fi(v, d=0.0): return float(v) if v is not None else float(d)
def _ii(v, d=0):   return int(v)   if v is not None else int(d)
def _si(v, d=""):  return str(v)   if v is not None else str(d)
# --- py-building-gen: auto-reporte (inicio) ---
import os as _pbg_os, json as _pbg_json, datetime as _pbg_dt
_PBG_DIR = 'C:\\Users\\feder\\OneDrive\\Escritorio\\py-building-gen\\output\\dynamo\\edificio_caballito_int\\_reports'
_PBG_SCRIPT = '01_niveles_grilla'
_PBG_NODE = 'Plantas por Disciplina'
_PBG_KEY = '01_niveles_grilla__02_plantas_por_disciplina'
def _pbg_warnings():
    try:
        _d = globals().get("doc", None)
        if _d is None:
            return []
        return [w.GetDescriptionText() for w in _d.GetWarnings()]
    except Exception:
        return []
def _pbg_report(_status, _out=None):
    try:
        _pbg_os.makedirs(_PBG_DIR, exist_ok=True)
        _rec = {
            "script": _PBG_SCRIPT,
            "nodo": _PBG_NODE,
            "key": _PBG_KEY,
            "status": _status,
            "timestamp": _pbg_dt.datetime.now().isoformat(timespec="seconds"),
            "out": _out,
            "warnings": _pbg_warnings() if _status == "ok" else [],
        }
        with open(_pbg_os.path.join(_PBG_DIR, _PBG_KEY + ".json"), "w", encoding="utf-8") as _f:
            _pbg_json.dump(_rec, _f, ensure_ascii=False, indent=2, default=str)
    except Exception:
        pass
_pbg_report("started")
# --- fin auto-reporte (inicio) ---

import clr
clr.AddReference("RevitAPI")
from Autodesk.Revit.DB import (
    ViewPlan, ViewFamilyType, ViewFamily, Level,
    FilteredElementCollector, Transaction,
)
clr.AddReference("RevitServices")
from RevitServices.Persistence import DocumentManager

doc = DocumentManager.Instance.CurrentDBDocument

pisos_tipo   = _ii(IN[0])
tiene_azotea = bool(IN[1])

def get_vft(familia):
    tipos = FilteredElementCollector(doc).OfClass(ViewFamilyType).ToElements()
    return next((t for t in tipos if t.ViewFamily == familia), None)

def get_level(nombre):
    levels = FilteredElementCollector(doc).OfClass(Level).ToElements()
    return next((l for l in levels if l.Name == nombre), None)

vft_arq = get_vft(ViewFamily.FloorPlan)
vft_est = get_vft(ViewFamily.StructuralPlan)   # planta estructural
vft_mep = get_vft(ViewFamily.FloorPlan)         # reutiliza FloorPlan para MEP

niveles = ["PB"] + [f"P{i:02d}" for i in range(1, pisos_tipo + 1)]
if tiene_azotea:
    niveles.append("AZO")

vistas = []

with Transaction(doc, "py-building-gen: Plantas por disciplina") as t:
    t.Start()
    for nom in niveles:
        lvl = get_level(nom)
        if lvl is None:
            continue
        for vft, prefijo in [(vft_arq, "PLANTA"), (vft_est, "EST"), (vft_mep, "MEP")]:
            if vft is None:
                continue
            nombre_vista = f"{prefijo} {nom}"
            # Verificar si ya existe una vista con ese nombre
            existente = next(
                (v for v in FilteredElementCollector(doc).OfClass(ViewPlan).ToElements()
                 if v.Name == nombre_vista), None
            )
            if existente:
                vistas.append({"nivel": nom, "tipo": prefijo, "id": existente.Id.Value, "nuevo": False})
                continue
            vista = ViewPlan.Create(doc, vft.Id, lvl.Id)
            vista.Name = nombre_vista
            vistas.append({"nivel": nom, "tipo": prefijo, "id": vista.Id.Value, "nuevo": True})
    t.Commit()

OUT = {"total": len(vistas), "detalle": vistas}


# --- py-building-gen: auto-reporte (cierre) ---
try:
    _pbg_report("ok", _out=globals().get("OUT", None))
except Exception:
    pass
# ----------------------------------------
