# Dynamo graph 02_muros_perimetrales.dyn (Dynamo 4.0.0.0)
# Crea muros exteriores, núcleo, pasillo, divisorias y tabiques internos por nivel.

frente_m = CodeBlock { 10.0; }
fondo_m = CodeBlock { 24.0; }
altura_pb_m = CodeBlock { 3.5; }
altura_tipo_m = CodeBlock { 2.8; }
pisos_tipo = CodeBlock { 6; }
cant_depto_tipo = CodeBlock { 2; }
tipologias = CodeBlock { "2amb:1,3amb:1"; }
cant_escaleras = CodeBlock { 1; }
cant_ascensores = CodeBlock { 1; }
nombre_muro_ext = CodeBlock { "Muro exterior - 200mm"; }
nombre_tabique = CodeBlock { "Tabique interior - 100mm"; }
nombre_cortafuego = CodeBlock { "Muro cortafuego - 200mm"; }
crear_muros_v2 = Python(IN[0]=frente_m, IN[1]=fondo_m, IN[2]=altura_pb_m, IN[3]=altura_tipo_m, IN[4]=pisos_tipo, IN[5]=cant_depto_tipo, IN[6]=tipologias, IN[7]=cant_escaleras, IN[8]=cant_ascensores, IN[9]=nombre_muro_ext, IN[10]=nombre_tabique, IN[11]=nombre_cortafuego)  # PythonNet3
# ---------- crear_muros_v2.python (251 lines) ----------
def _fi(v, d=0.0): return float(v) if v is not None else float(d)
def _ii(v, d=0):   return int(v)   if v is not None else int(d)
def _si(v, d=""):  return str(v)   if v is not None else str(d)
# --- py-building-gen: auto-reporte (inicio) ---
import os as _pbg_os, json as _pbg_json, datetime as _pbg_dt
_PBG_DIR = 'C:\\Users\\feder\\OneDrive\\Escritorio\\py-building-gen\\output\\dynamo\\edificio_caballito_int\\_reports'
_PBG_SCRIPT = '02_muros_perimetrales'
_PBG_NODE = 'Crear Muros v2'
_PBG_KEY = '02_muros_perimetrales__00_crear_muros_v2'
def _pbg_warnings():
    try:
        _d = globals().get("doc", None)
        if _d is None:
            return []
        return [w.GetDescriptionText() for w in _d.GetWarnings()]
    except Exception:
        return []
def _pbg_report(_status, _out=None):
    try:
        _pbg_os.makedirs(_PBG_DIR, exist_ok=True)
        _rec = {
            "script": _PBG_SCRIPT,
            "nodo": _PBG_NODE,
            "key": _PBG_KEY,
            "status": _status,
            "timestamp": _pbg_dt.datetime.now().isoformat(timespec="seconds"),
            "out": _out,
            "warnings": _pbg_warnings() if _status == "ok" else [],
        }
        with open(_pbg_os.path.join(_PBG_DIR, _PBG_KEY + ".json"), "w", encoding="utf-8") as _f:
            _pbg_json.dump(_rec, _f, ensure_ascii=False, indent=2, default=str)
    except Exception:
        pass
_pbg_report("started")
# --- fin auto-reporte (inicio) ---

import clr
import json
clr.AddReference("RevitAPI")
from Autodesk.Revit.DB import (
    Wall, WallType, Level, Line, XYZ,
    FilteredElementCollector, Transaction,
    UnitUtils, UnitTypeId,
)
clr.AddReference("RevitServices")
from RevitServices.Persistence import DocumentManager

doc = DocumentManager.Instance.CurrentDBDocument

frente_m          = _fi(IN[0])
fondo_m           = _fi(IN[1])
altura_pb         = _fi(IN[2])
altura_tipo       = _fi(IN[3])
pisos_tipo        = _ii(IN[4])
cant_depto_tipo   = _ii(IN[5])
tipologias_str    = _si(IN[6])   # "2amb:1,3amb:1" (quote-free para Code Block)
cant_escaleras    = _ii(IN[7])
cant_ascensores   = _ii(IN[8])
nombre_muro_ext   = _si(IN[9])   # "Muro exterior - 200mm"
nombre_tabique    = _si(IN[10])  # "Tabique interior - 100mm"
nombre_cortafuego = _si(IN[11])  # "Muro cortafuego - 200mm"

# Tipología por departamento (aplanada, izquierda a derecha).
# Formato quote-free "tipo:cant,tipo:cant" — DesignScript no soporta comillas
# escapadas en Code Blocks de forma confiable (bugs Dynamo #7425/#7781/#9117).
apts = []
for _par in tipologias_str.split(","):
    _par = _par.strip()
    if not _par:
        continue
    _tipo, _, _cant = _par.partition(":")
    _tipo = _tipo.strip() or "2amb"
    try:
        _n = int(_cant)
    except Exception:
        _n = 1
    for _ in range(_n):
        apts.append(_tipo)

# ── Constantes normativa CABA ─────────────────────────────────────────────────
ESC_ANCHO    = 3.00   # m — caja escalera
ESC_FONDO    = 5.50   # m — profundidad del núcleo
ASC_ANCHO    = 2.00   # m — caja ascensor
PASILLO_PROF = 1.20   # m — pasillo común mínimo (Art. 4.8 CABA)

# ── Geometría derivada ────────────────────────────────────────────────────────
_n_apts      = max(cant_depto_tipo, 1)
ancho_nucleo = cant_escaleras * ESC_ANCHO + cant_ascensores * ASC_ANCHO
x_nucleo     = (frente_m - ancho_nucleo) / 2.0
y_nucleo     = fondo_m - ESC_FONDO        # frente del shaft (y positivo = hacia atrás)
y_pasillo    = y_nucleo - PASILLO_PROF    # límite depto / pasillo
apt_ancho    = frente_m / _n_apts

# Proporciones internas por tipología (fracción del fondo útil)
_PROP_LIVING = {                          # fin de zona living (0 = sin separación)
    "1amb": 0.00, "estudio": 0.00,
    "2amb": 0.40, "3amb": 0.38, "4amb": 0.35, "duplex": 0.35,
}
_PROP_SERV = {                            # inicio de zona servicio (cocina + baños)
    "1amb": 0.65, "estudio": 0.70,
    "2amb": 0.70, "3amb": 0.68, "4amb": 0.65, "duplex": 0.65,
}

# ── Helpers ───────────────────────────────────────────────────────────────────
def m_to_ft(m):
    return UnitUtils.ConvertToInternalUnits(m, UnitTypeId.Meters)

def get_wall_type(nombre_exacto, fallback_kw):
    tipos = FilteredElementCollector(doc).OfClass(WallType).ToElements()
    match = next((wt for wt in tipos if wt.Name == nombre_exacto), None)
    if match:
        return match
    return next((wt for wt in tipos if fallback_kw.lower() in wt.Name.lower()), tipos[0])

def get_level(nombre):
    levels = FilteredElementCollector(doc).OfClass(Level).ToElements()
    match = next((l for l in levels if l.Name == nombre), None)
    return match or sorted(levels, key=lambda l: l.Elevation)[0]

def make_wall(lvl, x1, y1, x2, y2, h_m, wt):
    """Crea un muro Wall; retorna None si la longitud es prácticamente cero."""
    p1 = XYZ(m_to_ft(x1), m_to_ft(y1), 0)
    p2 = XYZ(m_to_ft(x2), m_to_ft(y2), 0)
    if p1.DistanceTo(p2) < 1e-3:
        return None
    return Wall.Create(doc, Line.CreateBound(p1, p2), wt.Id, lvl.Id, m_to_ft(h_m), 0, False, False)

# ── Segmentos por zona ────────────────────────────────────────────────────────
wt_ext = get_wall_type(nombre_muro_ext,    "200")
wt_tab = get_wall_type(nombre_tabique,     "100")
wt_cf  = get_wall_type(nombre_cortafuego,  "cortafuego")

def segs_perimetro():
    """4 muros exteriores del edificio."""
    return [
        (0,        0,       frente_m, 0,       wt_ext),
        (frente_m, 0,       frente_m, fondo_m, wt_ext),
        (frente_m, fondo_m, 0,        fondo_m, wt_ext),
        (0,        fondo_m, 0,        0,       wt_ext),
    ]

def segs_nucleo():
    """Paredes del núcleo de escalera + ascensor (shaft)."""
    x0 = x_nucleo
    x1 = x_nucleo + ancho_nucleo
    segs = []
    # Frente del shaft (cara al pasillo)
    segs.append((x0, y_nucleo, x1, y_nucleo, wt_ext))
    # Laterales del shaft (sólo si no coinciden con medianeras)
    if x0 > 0.02:
        segs.append((x0, y_nucleo, x0, fondo_m, wt_ext))
    if x1 < frente_m - 0.02:
        segs.append((x1, y_nucleo, x1, fondo_m, wt_ext))
    # División entre escalera y ascensor
    if cant_escaleras > 0 and cant_ascensores > 0:
        x_div = x_nucleo + cant_escaleras * ESC_ANCHO
        segs.append((x_div, y_nucleo, x_div, fondo_m, wt_ext))
    return segs

def segs_pasillo():
    """Muro separando los departamentos del pasillo común."""
    return [(0, y_pasillo, frente_m, y_pasillo, wt_tab)]

def segs_divisorias():
    """Muros cortafuego verticales entre departamentos (REI-120, CABA Art. 6.1)."""
    segs = []
    for i in range(1, _n_apts):
        x = apt_ancho * i
        segs.append((x, 0, x, y_pasillo, wt_cf))
    return segs

def segs_internos_apt(apt_idx):
    """Tabiques internos de un departamento según su tipología."""
    if apt_idx >= len(apts):
        return []
    tipo = apts[apt_idx]
    x0 = apt_ancho * apt_idx
    x1 = x0 + apt_ancho

    pct_living = _PROP_LIVING.get(tipo, _PROP_LIVING["2amb"])
    pct_serv   = _PROP_SERV.get(tipo, _PROP_SERV["2amb"])
    y_living   = y_pasillo * pct_living   # 0 → sin muro living/dorm
    y_serv     = y_pasillo * pct_serv

    segs = []

    if tipo in ("1amb", "estudio"):
        # Un solo ambiente + zona servicio al fondo
        segs.append((x0, y_serv, x1, y_serv, wt_tab))
        x_cx = x0 + apt_ancho * 0.55
        segs.append((x_cx, y_serv, x_cx, y_pasillo, wt_tab))

    elif tipo == "2amb":
        # Living | Dormitorio | Servicio
        segs.append((x0, y_living, x1, y_living, wt_tab))
        segs.append((x0, y_serv,   x1, y_serv,   wt_tab))
        x_cx = x0 + apt_ancho * 0.55
        segs.append((x_cx, y_serv, x_cx, y_pasillo, wt_tab))

    elif tipo == "3amb":
        # Living | Dorm1 + Dorm2 | Servicio
        segs.append((x0,              y_living, x1, y_living, wt_tab))
        segs.append((x0 + apt_ancho * 0.50, y_living,
                     x0 + apt_ancho * 0.50, y_serv,   wt_tab))
        segs.append((x0, y_serv, x1, y_serv, wt_tab))
        x_cx = x0 + apt_ancho * 0.55
        segs.append((x_cx, y_serv, x_cx, y_pasillo, wt_tab))

    elif tipo in ("4amb", "duplex"):
        # Living | Dorm1 + Dorm2 + Dorm3 | Servicio
        segs.append((x0, y_living, x1, y_living, wt_tab))
        segs.append((x0 + apt_ancho * 0.33, y_living,
                     x0 + apt_ancho * 0.33, y_serv,   wt_tab))
        segs.append((x0 + apt_ancho * 0.67, y_living,
                     x0 + apt_ancho * 0.67, y_serv,   wt_tab))
        segs.append((x0, y_serv, x1, y_serv, wt_tab))
        x_cx = x0 + apt_ancho * 0.55
        segs.append((x_cx, y_serv, x_cx, y_pasillo, wt_tab))

    return segs

# ── Crear muros por nivel ─────────────────────────────────────────────────────
muros_creados = []

def crear_nivel(nombre_nivel, altura_m, es_pb=False):
    lvl = get_level(nombre_nivel)
    todos = list(segs_perimetro()) + list(segs_nucleo()) + list(segs_pasillo())
    if not es_pb:
        todos.extend(segs_divisorias())
        for i in range(_n_apts):
            todos.extend(segs_internos_apt(i))
    for x1, y1, x2, y2, wt in todos:
        w = make_wall(lvl, x1, y1, x2, y2, altura_m, wt)
        if w:
            muros_creados.append({"nivel": nombre_nivel, "id": w.Id.Value})

with Transaction(doc, "py-building-gen: Muros v2") as t:
    t.Start()
    crear_nivel("PB", altura_pb, es_pb=True)
    for i in range(1, pisos_tipo + 1):
        crear_nivel(f"P{i:02d}", altura_tipo)
    t.Commit()

OUT = {"total": len(muros_creados), "detalle": muros_creados}


# --- py-building-gen: auto-reporte (cierre) ---
try:
    _pbg_report("ok", _out=globals().get("OUT", None))
except Exception:
    pass
# ----------------------------------------
