# Dynamo graph 03_losas.dyn (Dynamo 4.0.0.0)
# Crea losas HA por nivel con hueco de shaft para escalera y ascensor.

frente_m = CodeBlock { 10.0; }
fondo_m = CodeBlock { 24.0; }
pisos_tipo = CodeBlock { 6; }
tiene_azotea = CodeBlock { true; }
espesor_cm = CodeBlock { 30.0; }
nombre_losa = CodeBlock { "Losa HA H-21 - 30cm"; }
nombre_losa_azo = CodeBlock { "Losa azotea HA H-21 - 30cm"; }
cant_escaleras = CodeBlock { 1; }
cant_ascensores = CodeBlock { 1; }
crear_losas_v2 = Python(IN[0]=frente_m, IN[1]=fondo_m, IN[2]=pisos_tipo, IN[3]=tiene_azotea, IN[4]=espesor_cm, IN[5]=nombre_losa, IN[6]=nombre_losa_azo, IN[7]=cant_escaleras, IN[8]=cant_ascensores)  # PythonNet3
# ---------- crear_losas_v2.python (153 lines) ----------
def _fi(v, d=0.0): return float(v) if v is not None else float(d)
def _ii(v, d=0):   return int(v)   if v is not None else int(d)
def _si(v, d=""):  return str(v)   if v is not None else str(d)
# --- py-building-gen: auto-reporte (inicio) ---
import os as _pbg_os, json as _pbg_json, datetime as _pbg_dt
_PBG_DIR = 'C:\\Users\\feder\\OneDrive\\Escritorio\\py-building-gen\\output\\dynamo\\edificio_caballito_int\\_reports'
_PBG_SCRIPT = '03_losas'
_PBG_NODE = 'Crear Losas v2'
_PBG_KEY = '03_losas__00_crear_losas_v2'
def _pbg_warnings():
    try:
        _d = globals().get("doc", None)
        if _d is None:
            return []
        return [w.GetDescriptionText() for w in _d.GetWarnings()]
    except Exception:
        return []
def _pbg_report(_status, _out=None):
    try:
        _pbg_os.makedirs(_PBG_DIR, exist_ok=True)
        _rec = {
            "script": _PBG_SCRIPT,
            "nodo": _PBG_NODE,
            "key": _PBG_KEY,
            "status": _status,
            "timestamp": _pbg_dt.datetime.now().isoformat(timespec="seconds"),
            "out": _out,
            "warnings": _pbg_warnings() if _status == "ok" else [],
        }
        with open(_pbg_os.path.join(_PBG_DIR, _PBG_KEY + ".json"), "w", encoding="utf-8") as _f:
            _pbg_json.dump(_rec, _f, ensure_ascii=False, indent=2, default=str)
    except Exception:
        pass
_pbg_report("started")
# --- fin auto-reporte (inicio) ---

import clr
clr.AddReference("RevitAPI")
from Autodesk.Revit.DB import (
    Floor, FloorType, Level, CurveLoop, Line, XYZ,
    FilteredElementCollector, ElementCategoryFilter,
    BuiltInCategory, Transaction,
    UnitUtils, UnitTypeId,
)
import System
from System.Collections.Generic import List as NetList
clr.AddReference("RevitServices")
from RevitServices.Persistence import DocumentManager

doc = DocumentManager.Instance.CurrentDBDocument

frente_m        = _fi(IN[0])
fondo_m         = _fi(IN[1])
pisos_tipo      = _ii(IN[2])
tiene_azotea    = bool(IN[3])
espesor_cm      = _fi(IN[4])
nombre_losa     = _si(IN[5])
nombre_losa_azo = _si(IN[6])
cant_escaleras  = _ii(IN[7])
cant_ascensores = _ii(IN[8])

# ── Shaft geometry (same constants as Script 02) ──────────────────────────────
ESC_ANCHO = 3.00; ESC_FONDO = 5.50; ASC_ANCHO = 2.00
ancho_nucleo = cant_escaleras * ESC_ANCHO + cant_ascensores * ASC_ANCHO
x_nucleo     = (frente_m - ancho_nucleo) / 2.0
y_nucleo     = fondo_m - ESC_FONDO

def m_to_ft(m):
    return UnitUtils.ConvertToInternalUnits(m, UnitTypeId.Meters)

def get_floor_type(nombre_exacto):
    cat_filter = ElementCategoryFilter(BuiltInCategory.OST_Floors)
    tipos = (FilteredElementCollector(doc)
             .OfClass(FloorType)
             .WherePasses(cat_filter)
             .ToElements())
    match = next((t for t in tipos if t.Name == nombre_exacto), None)
    if match:
        return match
    _kw = ("concrete", "hormigon", "hormigón", "ha ", "losa")
    match = next((t for t in tipos if any(k in t.Name.lower() for k in _kw)), None)
    return match or tipos[0]

def get_level(nombre):
    levels = FilteredElementCollector(doc).OfClass(Level).ToElements()
    match = next((l for l in levels if l.Name == nombre), None)
    return match or sorted(levels, key=lambda l: l.Elevation)[0]

def curve_loops_losa():
    """Contorno de la losa como un único loop contra-horario.

    El núcleo (escalera + ascensor) está contra la medianera de fondo, así que su
    borde trasero coincide con la arista trasera de la losa. Un loop interior que
    comparte esa arista NO es un hueco válido (Revit: "curve loops intersect").
    Por eso el contorno se recorta en U alrededor del shaft en vez de perforarlo.
    """
    F  = m_to_ft(frente_m)
    D  = m_to_ft(fondo_m)

    # Recorte en U sólo si el shaft existe y queda holgura a ambos lados.
    margen = m_to_ft(0.02)
    x0 = m_to_ft(x_nucleo)
    x1 = m_to_ft(x_nucleo + ancho_nucleo)
    yn = m_to_ft(y_nucleo)
    notch = ancho_nucleo > 0.1 and x0 > margen and x1 < F - margen

    if notch:
        # CCW: perímetro con entrante rectangular en el borde de fondo.
        pts = [
            XYZ(0,  0,  0),
            XYZ(F,  0,  0),
            XYZ(F,  D,  0),
            XYZ(x1, D,  0),
            XYZ(x1, yn, 0),
            XYZ(x0, yn, 0),
            XYZ(x0, D,  0),
            XYZ(0,  D,  0),
        ]
    else:
        pts = [XYZ(0, 0, 0), XYZ(F, 0, 0), XYZ(F, D, 0), XYZ(0, D, 0)]

    loop = CurveLoop()
    n = len(pts)
    for i in range(n):
        loop.Append(Line.CreateBound(pts[i], pts[(i+1) % n]))

    return [loop]

ft_tipo = get_floor_type(nombre_losa)
ft_azo  = get_floor_type(nombre_losa_azo)
losas_creadas = []

with Transaction(doc, "py-building-gen: Losas v2") as t:
    t.Start()
    for i in range(1, pisos_tipo + 1):
        nom = f"P{i:02d}"
        lvl = get_level(nom)
        losa = Floor.Create(doc, NetList[CurveLoop](curve_loops_losa()), ft_tipo.Id, lvl.Id)
        losas_creadas.append({"nivel": nom, "id": losa.Id.Value})
    if tiene_azotea:
        lvl = get_level("AZO")
        losa = Floor.Create(doc, NetList[CurveLoop](curve_loops_losa()), ft_azo.Id, lvl.Id)
        losas_creadas.append({"nivel": "AZO", "id": losa.Id.Value})
    t.Commit()

OUT = {"total": len(losas_creadas), "detalle": losas_creadas}


# --- py-building-gen: auto-reporte (cierre) ---
try:
    _pbg_report("ok", _out=globals().get("OUT", None))
except Exception:
    pass
# ----------------------------------------
