# Dynamo graph 04_estructura.dyn (Dynamo 4.0.0.0)
# Crea columnas (con reducción de sección), vigas y zapatas aisladas según CIRSOC 201-2005.

frente_m = CodeBlock { 10.0; }
fondo_m = CodeBlock { 24.0; }
lado_col_cm = CodeBlock { 35; }
pisos_tipo = CodeBlock { 6; }
nombre_col = CodeBlock { "Columna HA 35x35cm"; }
crear_columnas_v2 = Python(IN[0]=frente_m, IN[1]=fondo_m, IN[2]=lado_col_cm, IN[3]=pisos_tipo, IN[4]=nombre_col)  # PythonNet3
# ---------- crear_columnas_v2.python (158 lines) ----------
def _fi(v, d=0.0): return float(v) if v is not None else float(d)
def _ii(v, d=0):   return int(v)   if v is not None else int(d)
def _si(v, d=""):  return str(v)   if v is not None else str(d)
# --- py-building-gen: auto-reporte (inicio) ---
import os as _pbg_os, json as _pbg_json, datetime as _pbg_dt
_PBG_DIR = 'C:\\Users\\feder\\OneDrive\\Escritorio\\py-building-gen\\output\\dynamo\\edificio_caballito_int\\_reports'
_PBG_SCRIPT = '04_estructura'
_PBG_NODE = 'Crear Columnas v2'
_PBG_KEY = '04_estructura__00_crear_columnas_v2'
def _pbg_warnings():
    try:
        _d = globals().get("doc", None)
        if _d is None:
            return []
        return [w.GetDescriptionText() for w in _d.GetWarnings()]
    except Exception:
        return []
def _pbg_report(_status, _out=None):
    try:
        _pbg_os.makedirs(_PBG_DIR, exist_ok=True)
        _rec = {
            "script": _PBG_SCRIPT,
            "nodo": _PBG_NODE,
            "key": _PBG_KEY,
            "status": _status,
            "timestamp": _pbg_dt.datetime.now().isoformat(timespec="seconds"),
            "out": _out,
            "warnings": _pbg_warnings() if _status == "ok" else [],
        }
        with open(_pbg_os.path.join(_PBG_DIR, _PBG_KEY + ".json"), "w", encoding="utf-8") as _f:
            _pbg_json.dump(_rec, _f, ensure_ascii=False, indent=2, default=str)
    except Exception:
        pass
_pbg_report("started")
# --- fin auto-reporte (inicio) ---

import clr
clr.AddReference("RevitAPI")
from Autodesk.Revit.DB import (
    FamilySymbol, Level, XYZ,
    FilteredElementCollector, BuiltInCategory,
    Transaction, UnitUtils, UnitTypeId,
)
from Autodesk.Revit.DB.Structure import StructuralType
clr.AddReference("RevitServices")
from RevitServices.Persistence import DocumentManager

doc = DocumentManager.Instance.CurrentDBDocument

frente_m        = _fi(IN[0])
fondo_m         = _fi(IN[1])
lado_col_cm     = _fi(IN[2])
pisos_tipo      = _ii(IN[3])
nombre_col_tipo = _si(IN[4])
paso_m          = 5.0

def m_to_ft(m):
    return UnitUtils.ConvertToInternalUnits(m, UnitTypeId.Meters)

def get_all_col_syms():
    return list(FilteredElementCollector(doc)
           .OfClass(FamilySymbol)
           .OfCategory(BuiltInCategory.OST_StructuralColumns)
           .ToElements())

def get_col_symbol():
    col = get_all_col_syms()
    match = next((s for s in col if s.Name == nombre_col_tipo), None)
    if match:
        return match
    _kw = ("concrete","hormigon","hormigón","ha ","h.a","rectangular")
    match = next((s for s in col if any(k in s.FamilyName.lower() for k in _kw)), None)
    return match or (col[0] if col else None)

def get_level(nombre):
    levels = FilteredElementCollector(doc).OfClass(Level).ToElements()
    return next((l for l in levels if l.Name == nombre), None)            or sorted(levels, key=lambda l: l.Elevation)[0]

def set_section(sym, lado_m):
    lado_ft = m_to_ft(lado_m)
    for n in ("b","Ancho","Width","w"):
        p = sym.LookupParameter(n)
        if p and not p.IsReadOnly:
            try: p.Set(lado_ft); break
            except Exception: pass
    for n in ("h","Alto","Depth","d"):
        p = sym.LookupParameter(n)
        if p and not p.IsReadOnly:
            try: p.Set(lado_ft); break
            except Exception: pass

# ── Secciones: inferior (pisos bajos) y superior (pisos altos, −5cm) ─────────
# Cada grupo usa su propio FamilySymbol para que la sección no se pise.
lado_inf_m = lado_col_cm / 100.0
lado_sup_m = max(0.25, lado_inf_m - 0.05)
piso_corte = pisos_tipo // 2 + 1
misma_seccion = (lado_inf_m == lado_sup_m)

nombre_inf = f"Col HA {lado_inf_m*100:.0f}x{lado_inf_m*100:.0f}cm"
nombre_sup = f"Col HA {lado_sup_m*100:.0f}x{lado_sup_m*100:.0f}cm"

sym_base = get_col_symbol()
columnas  = []

if sym_base:
    with Transaction(doc, "py-building-gen: Columnas v2") as t:
        t.Start()

        todos = get_all_col_syms()

        # Tipo inferior
        sym_inf = next((s for s in todos if s.Name == nombre_inf), None)
        if sym_inf is None:
            sym_inf = sym_base.Duplicate(nombre_inf)
            set_section(sym_inf, lado_inf_m)
        if not sym_inf.IsActive:
            sym_inf.Activate()

        # Tipo superior (solo si difiere del inferior)
        if misma_seccion:
            sym_sup = sym_inf
        else:
            sym_sup = next((s for s in todos if s.Name == nombre_sup), None)
            if sym_sup is None:
                sym_sup = sym_base.Duplicate(nombre_sup)
                set_section(sym_sup, lado_sup_m)
            if not sym_sup.IsActive:
                sym_sup.Activate()

        for idx_piso, nombre_nivel in enumerate(
            ["PB"] + [f"P{i:02d}" for i in range(1, pisos_tipo + 1)]
        ):
            lvl = get_level(nombre_nivel)
            sym_local = sym_sup if idx_piso >= piso_corte else sym_inf
            x = 0.0
            while x <= frente_m + 0.001:
                y = 0.0
                while y <= fondo_m + 0.001:
                    pt = XYZ(m_to_ft(x), m_to_ft(y), 0)
                    inst = doc.Create.NewFamilyInstance(pt, sym_local, lvl, StructuralType.Column)
                    columnas.append(inst.Id.Value)
                    y += paso_m
                x += paso_m

        t.Commit()

OUT = {
    "total": len(columnas),
    "seccion_inferior": f"{lado_inf_m*100:.0f}x{lado_inf_m*100:.0f}cm (pisos 1-{piso_corte-1})",
    "seccion_superior": f"{lado_sup_m*100:.0f}x{lado_sup_m*100:.0f}cm (pisos {piso_corte}-{pisos_tipo})",
}


# --- py-building-gen: auto-reporte (cierre) ---
try:
    _pbg_report("ok", _out=globals().get("OUT", None))
except Exception:
    pass
# ----------------------------------------
frente_m_2 = CodeBlock { 10.0; }
fondo_m_2 = CodeBlock { 24.0; }
ancho_viga_cm = CodeBlock { 45; }
alto_viga_cm = CodeBlock { 85; }
pisos_tipo_2 = CodeBlock { 6; }
nombre_viga = CodeBlock { "Viga HA 45x85cm"; }
crear_vigas = Python(IN[0]=frente_m_2, IN[1]=fondo_m_2, IN[2]=ancho_viga_cm, IN[3]=alto_viga_cm, IN[4]=pisos_tipo_2, IN[5]=nombre_viga)  # PythonNet3
# ---------- crear_vigas.python (140 lines) ----------
def _fi(v, d=0.0): return float(v) if v is not None else float(d)
def _ii(v, d=0):   return int(v)   if v is not None else int(d)
def _si(v, d=""):  return str(v)   if v is not None else str(d)
# --- py-building-gen: auto-reporte (inicio) ---
import os as _pbg_os, json as _pbg_json, datetime as _pbg_dt
_PBG_DIR = 'C:\\Users\\feder\\OneDrive\\Escritorio\\py-building-gen\\output\\dynamo\\edificio_caballito_int\\_reports'
_PBG_SCRIPT = '04_estructura'
_PBG_NODE = 'Crear Vigas'
_PBG_KEY = '04_estructura__01_crear_vigas'
def _pbg_warnings():
    try:
        _d = globals().get("doc", None)
        if _d is None:
            return []
        return [w.GetDescriptionText() for w in _d.GetWarnings()]
    except Exception:
        return []
def _pbg_report(_status, _out=None):
    try:
        _pbg_os.makedirs(_PBG_DIR, exist_ok=True)
        _rec = {
            "script": _PBG_SCRIPT,
            "nodo": _PBG_NODE,
            "key": _PBG_KEY,
            "status": _status,
            "timestamp": _pbg_dt.datetime.now().isoformat(timespec="seconds"),
            "out": _out,
            "warnings": _pbg_warnings() if _status == "ok" else [],
        }
        with open(_pbg_os.path.join(_PBG_DIR, _PBG_KEY + ".json"), "w", encoding="utf-8") as _f:
            _pbg_json.dump(_rec, _f, ensure_ascii=False, indent=2, default=str)
    except Exception:
        pass
_pbg_report("started")
# --- fin auto-reporte (inicio) ---

import clr
clr.AddReference("RevitAPI")
from Autodesk.Revit.DB import (
    FamilySymbol, Level, XYZ, Line,
    FilteredElementCollector, BuiltInCategory,
    Transaction, UnitUtils, UnitTypeId,
)
from Autodesk.Revit.DB.Structure import StructuralType

clr.AddReference("RevitServices")
from RevitServices.Persistence import DocumentManager
doc  = DocumentManager.Instance.CurrentDBDocument

frente_m        = _fi(IN[0])
fondo_m         = _fi(IN[1])
ancho_cm        = _fi(IN[2])
alto_cm         = _fi(IN[3])
pisos_tipo      = _ii(IN[4])
nombre_viga_tipo = _si(IN[5])   # "Viga HA 45x85cm"  (creado por 00_familias.dyn)
paso_m          = 5.0

def m_to_ft(m):
    return UnitUtils.ConvertToInternalUnits(m, UnitTypeId.Meters)

def get_beam_symbol():
    col = (FilteredElementCollector(doc)
           .OfClass(FamilySymbol)
           .OfCategory(BuiltInCategory.OST_StructuralFraming)
           .ToElements())
    # 1° intento: tipo exacto creado por 00_familias.dyn
    match = next((s for s in col if s.Name == nombre_viga_tipo), None)
    if match:
        return match
    # 2° intento: familia con keyword de hormigón
    _kw = ("concrete", "hormigon", "hormigón", "ha ", "h.a")
    match = next((s for s in col if any(k in s.FamilyName.lower() for k in _kw)), None)
    return match or (col[0] if col else None)

def get_level(nombre):
    levels = FilteredElementCollector(doc).OfClass(Level).ToElements()
    match = next((l for l in levels if l.Name == nombre), None)
    return match or sorted(levels, key=lambda l: l.Elevation)[0]

sym = get_beam_symbol()
vigas = []

if sym:
    try:
        sym.LookupParameter("b").Set(m_to_ft(ancho_cm / 100))
        sym.LookupParameter("h").Set(m_to_ft(alto_cm  / 100))
    except Exception:
        pass

    if not sym.IsActive:
        sym.Activate()

    with Transaction(doc, "py-building-gen: Vigas") as t:
        t.Start()

        for nombre_nivel in [f"P{i:02d}" for i in range(1, pisos_tipo + 1)]:
            lvl = get_level(nombre_nivel)
            # La curva de una viga vive en coordenadas del modelo: el Level solo
            # fija el "Nivel de referencia", NO la altura física. Sin este z las
            # vigas de todos los pisos se apilan en z=0 → "ejemplares idénticos".
            z = lvl.Elevation

            # Vigas en dirección X (paralelas al frente) — una por eje Y
            y = 0.0
            while y <= fondo_m + 0.001:
                x = 0.0
                while x + paso_m <= frente_m + 0.001:
                    p1 = XYZ(m_to_ft(x),        m_to_ft(y), z)
                    p2 = XYZ(m_to_ft(x + paso_m), m_to_ft(y), z)
                    inst = doc.Create.NewFamilyInstance(
                        Line.CreateBound(p1, p2), sym, lvl, StructuralType.Beam
                    )
                    vigas.append(inst.Id.Value)
                    x += paso_m
                y += paso_m

            # Vigas en dirección Y (paralelas al fondo)
            x = 0.0
            while x <= frente_m + 0.001:
                y = 0.0
                while y + paso_m <= fondo_m + 0.001:
                    p1 = XYZ(m_to_ft(x), m_to_ft(y),        z)
                    p2 = XYZ(m_to_ft(x), m_to_ft(y + paso_m), z)
                    inst = doc.Create.NewFamilyInstance(
                        Line.CreateBound(p1, p2), sym, lvl, StructuralType.Beam
                    )
                    vigas.append(inst.Id.Value)
                    y += paso_m
                x += paso_m

        t.Commit()

OUT = {"total_vigas": len(vigas), "seccion": f"{ancho_cm:.0f}x{alto_cm:.0f}cm"}


# --- py-building-gen: auto-reporte (cierre) ---
try:
    _pbg_report("ok", _out=globals().get("OUT", None))
except Exception:
    pass
# ----------------------------------------
frente_m_3 = CodeBlock { 10.0; }
fondo_m_3 = CodeBlock { 24.0; }
ancho_vf_cm = CodeBlock { 45; }
alto_vf_cm = CodeBlock { 85; }
tiene_subsuelo = CodeBlock { false; }
nombre_viga_2 = CodeBlock { "Viga HA 45x85cm"; }
vigas_de_fundación = Python(IN[0]=frente_m_3, IN[1]=fondo_m_3, IN[2]=ancho_vf_cm, IN[3]=alto_vf_cm, IN[4]=tiene_subsuelo, IN[5]=nombre_viga_2)  # PythonNet3
# ---------- vigas_de_fundación.python (128 lines) ----------
def _fi(v, d=0.0): return float(v) if v is not None else float(d)
def _ii(v, d=0):   return int(v)   if v is not None else int(d)
def _si(v, d=""):  return str(v)   if v is not None else str(d)
# --- py-building-gen: auto-reporte (inicio) ---
import os as _pbg_os, json as _pbg_json, datetime as _pbg_dt
_PBG_DIR = 'C:\\Users\\feder\\OneDrive\\Escritorio\\py-building-gen\\output\\dynamo\\edificio_caballito_int\\_reports'
_PBG_SCRIPT = '04_estructura'
_PBG_NODE = 'Vigas de Fundación'
_PBG_KEY = '04_estructura__02_vigas_de_fundaci_n'
def _pbg_warnings():
    try:
        _d = globals().get("doc", None)
        if _d is None:
            return []
        return [w.GetDescriptionText() for w in _d.GetWarnings()]
    except Exception:
        return []
def _pbg_report(_status, _out=None):
    try:
        _pbg_os.makedirs(_PBG_DIR, exist_ok=True)
        _rec = {
            "script": _PBG_SCRIPT,
            "nodo": _PBG_NODE,
            "key": _PBG_KEY,
            "status": _status,
            "timestamp": _pbg_dt.datetime.now().isoformat(timespec="seconds"),
            "out": _out,
            "warnings": _pbg_warnings() if _status == "ok" else [],
        }
        with open(_pbg_os.path.join(_PBG_DIR, _PBG_KEY + ".json"), "w", encoding="utf-8") as _f:
            _pbg_json.dump(_rec, _f, ensure_ascii=False, indent=2, default=str)
    except Exception:
        pass
_pbg_report("started")
# --- fin auto-reporte (inicio) ---

import clr
clr.AddReference("RevitAPI")
from Autodesk.Revit.DB import (
    FamilySymbol, Level, XYZ, Line,
    FilteredElementCollector, BuiltInCategory,
    Transaction, UnitUtils, UnitTypeId,
)
from Autodesk.Revit.DB.Structure import StructuralType
clr.AddReference("RevitServices")
from RevitServices.Persistence import DocumentManager

doc = DocumentManager.Instance.CurrentDBDocument

frente_m        = _fi(IN[0])
fondo_m         = _fi(IN[1])
ancho_vf_cm     = _fi(IN[2])   # sección viga de fundación (CIRSOC: ≥ 30×60cm)
alto_vf_cm      = _fi(IN[3])
tiene_subsuelo  = bool(IN[4])
nombre_viga_tipo = _si(IN[5])
paso_m          = 5.0
Z_OFFSET        = -0.30           # m — centro viga a 30cm bajo nivel de fundación

def m_to_ft(m):
    return UnitUtils.ConvertToInternalUnits(m, UnitTypeId.Meters)

def get_beam_symbol():
    col = (FilteredElementCollector(doc)
           .OfClass(FamilySymbol)
           .OfCategory(BuiltInCategory.OST_StructuralFraming)
           .ToElements())
    match = next((s for s in col if s.Name == nombre_viga_tipo), None)
    if match: return match
    _kw = ("concrete","hormigon","hormigón","ha ","h.a","rectangular")
    return next((s for s in col if any(k in s.FamilyName.lower() for k in _kw)), col[0] if col else None)

def get_level(nombre):
    levels = FilteredElementCollector(doc).OfClass(Level).ToElements()
    return next((l for l in levels if l.Name == nombre), None)            or sorted(levels, key=lambda l: l.Elevation)[0]

sym = get_beam_symbol()
vigas_fund = []

if sym:
    try:
        sym.LookupParameter("b").Set(m_to_ft(ancho_vf_cm / 100))
        sym.LookupParameter("h").Set(m_to_ft(alto_vf_cm  / 100))
    except Exception:
        pass
    if not sym.IsActive:
        sym.Activate()

    lvl_fund = get_level("SS01" if tiene_subsuelo else "PB")

    with Transaction(doc, "py-building-gen: Vigas de fundación") as t:
        t.Start()
        z = lvl_fund.Elevation + m_to_ft(Z_OFFSET)

        # Dirección X (paralelas al frente)
        y = 0.0
        while y <= fondo_m + 0.001:
            x = 0.0
            while x + paso_m <= frente_m + 0.001:
                p1 = XYZ(m_to_ft(x),          m_to_ft(y), z)
                p2 = XYZ(m_to_ft(x + paso_m), m_to_ft(y), z)
                inst = doc.Create.NewFamilyInstance(Line.CreateBound(p1, p2), sym, lvl_fund, StructuralType.Beam)
                vigas_fund.append(inst.Id.Value)
                x += paso_m
            y += paso_m

        # Dirección Y (paralelas al fondo)
        x = 0.0
        while x <= frente_m + 0.001:
            y = 0.0
            while y + paso_m <= fondo_m + 0.001:
                p1 = XYZ(m_to_ft(x), m_to_ft(y),          z)
                p2 = XYZ(m_to_ft(x), m_to_ft(y + paso_m), z)
                inst = doc.Create.NewFamilyInstance(Line.CreateBound(p1, p2), sym, lvl_fund, StructuralType.Beam)
                vigas_fund.append(inst.Id.Value)
                y += paso_m
            x += paso_m

        t.Commit()

OUT = {"total_vf": len(vigas_fund), "nivel": "SS01" if tiene_subsuelo else "PB",
       "seccion": f"{ancho_vf_cm:.0f}x{alto_vf_cm:.0f}cm"}


# --- py-building-gen: auto-reporte (cierre) ---
try:
    _pbg_report("ok", _out=globals().get("OUT", None))
except Exception:
    pass
# ----------------------------------------
frente_m_4 = CodeBlock { 10.0; }
fondo_m_4 = CodeBlock { 24.0; }
lado_zapata_cm = CodeBlock { 245; }
altura_pb_m = CodeBlock { 3.5; }
tiene_subsuelo_2 = CodeBlock { false; }
nombre_zapata = CodeBlock { "Zapata HA 245x245cm"; }
crear_zapatas = Python(IN[0]=frente_m_4, IN[1]=fondo_m_4, IN[2]=lado_zapata_cm, IN[3]=altura_pb_m, IN[4]=tiene_subsuelo_2, IN[5]=nombre_zapata)  # PythonNet3
# ---------- crear_zapatas.python (137 lines) ----------
def _fi(v, d=0.0): return float(v) if v is not None else float(d)
def _ii(v, d=0):   return int(v)   if v is not None else int(d)
def _si(v, d=""):  return str(v)   if v is not None else str(d)
# --- py-building-gen: auto-reporte (inicio) ---
import os as _pbg_os, json as _pbg_json, datetime as _pbg_dt
_PBG_DIR = 'C:\\Users\\feder\\OneDrive\\Escritorio\\py-building-gen\\output\\dynamo\\edificio_caballito_int\\_reports'
_PBG_SCRIPT = '04_estructura'
_PBG_NODE = 'Crear Zapatas'
_PBG_KEY = '04_estructura__03_crear_zapatas'
def _pbg_warnings():
    try:
        _d = globals().get("doc", None)
        if _d is None:
            return []
        return [w.GetDescriptionText() for w in _d.GetWarnings()]
    except Exception:
        return []
def _pbg_report(_status, _out=None):
    try:
        _pbg_os.makedirs(_PBG_DIR, exist_ok=True)
        _rec = {
            "script": _PBG_SCRIPT,
            "nodo": _PBG_NODE,
            "key": _PBG_KEY,
            "status": _status,
            "timestamp": _pbg_dt.datetime.now().isoformat(timespec="seconds"),
            "out": _out,
            "warnings": _pbg_warnings() if _status == "ok" else [],
        }
        with open(_pbg_os.path.join(_PBG_DIR, _PBG_KEY + ".json"), "w", encoding="utf-8") as _f:
            _pbg_json.dump(_rec, _f, ensure_ascii=False, indent=2, default=str)
    except Exception:
        pass
_pbg_report("started")
# --- fin auto-reporte (inicio) ---

import clr
clr.AddReference("RevitAPI")
from Autodesk.Revit.DB import (
    FamilySymbol, Level, XYZ,
    FilteredElementCollector, BuiltInCategory,
    Transaction, UnitUtils, UnitTypeId,
)
from Autodesk.Revit.DB.Structure import StructuralType
clr.AddReference("RevitServices")
from RevitServices.Persistence import DocumentManager

doc = DocumentManager.Instance.CurrentDBDocument

frente_m       = _fi(IN[0])
fondo_m        = _fi(IN[1])
lado_zapata_cm = _fi(IN[2])   # lado de la zapata cuadrada (predimensionado)
altura_pb      = _fi(IN[3])
tiene_subsuelo = bool(IN[4])
nombre_zapata  = _si(IN[5], "")   # tipo exacto creado por 00_familias.dyn
paso_m         = 5.0

def m_to_ft(m):
    return UnitUtils.ConvertToInternalUnits(m, UnitTypeId.Meters)

def get_foundation_sym():
    col = (FilteredElementCollector(doc)
           .OfClass(FamilySymbol)
           .OfCategory(BuiltInCategory.OST_StructuralFoundation)
           .ToElements())
    # 1° intento: tipo exacto resuelto/creado por 00_familias.dyn
    match = next((s for s in col if s.Name == nombre_zapata), None)
    if match:
        return match
    _kw = ("pad","isolated","zapata","footing","aislada","foundation")
    match = next((s for s in col if any(k in s.FamilyName.lower() for k in _kw)), None)
    return match or (col[0] if col else None)

def get_level(nombre):
    levels = FilteredElementCollector(doc).OfClass(Level).ToElements()
    return next((l for l in levels if l.Name == nombre), None)            or sorted(levels, key=lambda l: l.Elevation)[0]

sym = get_foundation_sym()
zapatas = []
nom_fund = "SS01" if tiene_subsuelo else "PB"   # nivel de fundación (def. siempre)

if sym:
    # Tamaño de zapata
    lado_ft = m_to_ft(lado_zapata_cm / 100.0)
    for n in ("Width","Ancho","b","w","Length","Largo"):
        p = sym.LookupParameter(n)
        if p and not p.IsReadOnly:
            try: p.Set(lado_ft)
            except Exception: pass
    for n in ("Thickness","Espesor","h","d","Depth"):
        p = sym.LookupParameter(n)
        if p and not p.IsReadOnly:
            try: p.Set(m_to_ft(0.50)); break   # espesor zapata: 0.50m
            except Exception: pass
    if not sym.IsActive:
        sym.Activate()

    # Nivel de fundación: PB si no hay subsuelo, SS01 si hay
    lvl_fund = get_level(nom_fund)

    with Transaction(doc, "py-building-gen: Zapatas") as t:
        t.Start()
        x = 0.0
        while x <= frente_m + 0.001:
            y = 0.0
            while y <= fondo_m + 0.001:
                pt = XYZ(m_to_ft(x), m_to_ft(y), lvl_fund.Elevation)
                inst = doc.Create.NewFamilyInstance(pt, sym, lvl_fund, StructuralType.Footing)
                zapatas.append(inst.Id.Value)
                y += paso_m
            x += paso_m
        t.Commit()

if sym:
    OUT = {
        "total": len(zapatas),
        "lado_cm": lado_zapata_cm,
        "nivel": nom_fund,
        "familia": sym.FamilyName,
    }
else:
    OUT = {
        "total": 0,
        "resultado": "No se encontro familia de fundacion (OST_StructuralFoundation) cargada en el modelo.",
        "accion_requerida": (
            "Cargar una familia de zapata/base estructural (p.ej. "
            "'Base estructural rectangular' o 'Footing-Rectangular') desde "
            "Insertar -> Cargar familia, luego volver a correr 04_estructura.dyn."
        ),
    }


# --- py-building-gen: auto-reporte (cierre) ---
try:
    _pbg_report("ok", _out=globals().get("OUT", None))
except Exception:
    pass
# ----------------------------------------
