# Dynamo graph 05_aberturas.dyn (Dynamo 4.0.0.0)
# Coloca ventanas de living y dormitorios en fachada, puertas de acceso a deptos y puertas interiores.

frente_m = CodeBlock { 10.0; }
fondo_m = CodeBlock { 24.0; }
altura_tipo_m = CodeBlock { 2.8; }
pisos_tipo = CodeBlock { 6; }
cant_depto_tipo = CodeBlock { 2; }
tipologias = CodeBlock { "2amb:1,3amb:1"; }
cant_escaleras = CodeBlock { 1; }
cant_ascensores = CodeBlock { 1; }
crear_aberturas_v2 = Python(IN[0]=frente_m, IN[1]=fondo_m, IN[2]=altura_tipo_m, IN[3]=pisos_tipo, IN[4]=cant_depto_tipo, IN[5]=tipologias, IN[6]=cant_escaleras, IN[7]=cant_ascensores)  # PythonNet3
# ---------- crear_aberturas_v2.python (234 lines) ----------
def _fi(v, d=0.0): return float(v) if v is not None else float(d)
def _ii(v, d=0):   return int(v)   if v is not None else int(d)
def _si(v, d=""):  return str(v)   if v is not None else str(d)
# --- py-building-gen: auto-reporte (inicio) ---
import os as _pbg_os, json as _pbg_json, datetime as _pbg_dt
_PBG_DIR = 'C:\\Users\\feder\\OneDrive\\Escritorio\\py-building-gen\\output\\dynamo\\edificio_caballito_int\\_reports'
_PBG_SCRIPT = '05_aberturas'
_PBG_NODE = 'Crear Aberturas v2'
_PBG_KEY = '05_aberturas__00_crear_aberturas_v2'
def _pbg_warnings():
    try:
        _d = globals().get("doc", None)
        if _d is None:
            return []
        return [w.GetDescriptionText() for w in _d.GetWarnings()]
    except Exception:
        return []
def _pbg_report(_status, _out=None):
    try:
        _pbg_os.makedirs(_PBG_DIR, exist_ok=True)
        _rec = {
            "script": _PBG_SCRIPT,
            "nodo": _PBG_NODE,
            "key": _PBG_KEY,
            "status": _status,
            "timestamp": _pbg_dt.datetime.now().isoformat(timespec="seconds"),
            "out": _out,
            "warnings": _pbg_warnings() if _status == "ok" else [],
        }
        with open(_pbg_os.path.join(_PBG_DIR, _PBG_KEY + ".json"), "w", encoding="utf-8") as _f:
            _pbg_json.dump(_rec, _f, ensure_ascii=False, indent=2, default=str)
    except Exception:
        pass
_pbg_report("started")
# --- fin auto-reporte (inicio) ---

import clr
import json
clr.AddReference("RevitAPI")
from Autodesk.Revit.DB import (
    FamilySymbol, Wall, Level,
    FilteredElementCollector, BuiltInCategory,
    Transaction, XYZ, UnitUtils, UnitTypeId,
)
from Autodesk.Revit.DB.Structure import StructuralType as ST
clr.AddReference("RevitServices")
from RevitServices.Persistence import DocumentManager

doc = DocumentManager.Instance.CurrentDBDocument

frente_m        = _fi(IN[0])
fondo_m         = _fi(IN[1])
altura_tipo     = _fi(IN[2])
pisos_tipo      = _ii(IN[3])
cant_depto_tipo = _ii(IN[4])
tipologias_str  = _si(IN[5])   # "2amb:1,3amb:1" (quote-free para Code Block)
cant_escaleras  = _ii(IN[6])
cant_ascensores = _ii(IN[7])

apts = []
for _par in tipologias_str.split(","):
    _par = _par.strip()
    if not _par:
        continue
    _tipo, _, _cant = _par.partition(":")
    _tipo = _tipo.strip() or "2amb"
    try:
        _n = int(_cant)
    except Exception:
        _n = 1
    for _ in range(_n):
        apts.append(_tipo)

# ── Layout geometry (same constants as Script 02) ─────────────────────────────
ESC_ANCHO = 3.00; ESC_FONDO = 5.50; ASC_ANCHO = 2.00; PASILLO_PROF = 1.20
_n_apts      = max(cant_depto_tipo, 1)
ancho_nucleo = cant_escaleras * ESC_ANCHO + cant_ascensores * ASC_ANCHO
y_nucleo     = fondo_m - ESC_FONDO
y_pasillo    = y_nucleo - PASILLO_PROF
apt_ancho    = frente_m / _n_apts

_PROP_LIVING = {"1amb":0.00,"estudio":0.00,"2amb":0.40,"3amb":0.38,"4amb":0.35,"duplex":0.35}

# ── Helpers ───────────────────────────────────────────────────────────────────
def m_to_ft(m):
    return UnitUtils.ConvertToInternalUnits(m, UnitTypeId.Meters)

def ft_to_m(ft):
    return UnitUtils.ConvertFromInternalUnits(ft, UnitTypeId.Meters)

def get_sym(categoria, keywords):
    col = FilteredElementCollector(doc).OfClass(FamilySymbol).OfCategory(categoria).ToElements()
    match = next((s for s in col if any(k in s.FamilyName.lower() for k in keywords)), None)
    return match or (col[0] if col else None)

def get_level(nombre):
    levels = FilteredElementCollector(doc).OfClass(Level).ToElements()
    return next((l for l in levels if l.Name == nombre), None)

def find_wall_at_y(lvl_id, target_y, tol=0.40):
    """Primer muro horizontal (paralelo a X) con ambos extremos a y ≈ target_y."""
    for w in FilteredElementCollector(doc).OfClass(Wall).ToElements():
        if w.LevelId != lvl_id:
            continue
        loc = w.Location
        if not hasattr(loc, "Curve"):
            continue
        c = loc.Curve
        y1 = ft_to_m(c.GetEndPoint(0).Y)
        y2 = ft_to_m(c.GetEndPoint(1).Y)
        if abs(y1 - target_y) < tol and abs(y2 - target_y) < tol:
            return w
    return None

def set_size(inst, ancho_m, alto_m):
    for name in ("Width", "Ancho", "w", "b"):
        p = inst.LookupParameter(name)
        if p and not p.IsReadOnly:
            try: p.Set(m_to_ft(ancho_m)); break
            except Exception: pass
    for name in ("Height", "Alto", "h", "Height 1"):
        p = inst.LookupParameter(name)
        if p and not p.IsReadOnly:
            try: p.Set(m_to_ft(alto_m)); break
            except Exception: pass

def place(sym, wall, lvl, x, y, z=0.0):
    if wall is None or sym is None:
        return None
    # Z absoluto = elevación del nivel + offset (sill). Sin sumar lvl.Elevation la
    # abertura cae en z absoluto: en pisos altos queda FUERA del muro ("No es
    # posible cortar del muro") y se apila con las de los demás pisos en el mismo
    # punto ("ejemplares idénticos"). lvl.Elevation ya está en pies.
    pt = XYZ(m_to_ft(x), m_to_ft(y), lvl.Elevation + m_to_ft(z))
    try:
        return doc.Create.NewFamilyInstance(pt, sym, wall, lvl, ST.NonStructural)
    except Exception:
        return None

# ── Symbols ───────────────────────────────────────────────────────────────────
sym_p = get_sym(BuiltInCategory.OST_Doors,   ("door","puerta","single","simple","entry"))
sym_v = get_sym(BuiltInCategory.OST_Windows, ("window","ventana","fixed","fija","casement"))

aberturas = []

def crear_nivel(nombre, es_pb=False):
    lvl = get_level(nombre)
    if not lvl:
        return
    w_frente  = find_wall_at_y(lvl.Id, 0.0)
    w_pasillo = find_wall_at_y(lvl.Id, y_pasillo)

    if es_pb:
        # PB: puerta de acceso al edificio. frente/2 cae sobre una divisoria
        # cuando hay un número par de deptos → la corremos al centro del 1er depto.
        x_acc = frente_m / 2.0
        if _n_apts > 1 and _n_apts % 2 == 0:
            x_acc = apt_ancho * 0.5
        if sym_p and w_frente:
            inst = place(sym_p, w_frente, lvl, x_acc, 0.0)
            if inst:
                set_size(inst, 1.20, 2.40)
                aberturas.append({"nivel": nombre, "tipo": "puerta_acceso_edificio", "id": inst.Id.Value})
        return

    for apt_idx in range(_n_apts):
        tipo  = apts[apt_idx] if apt_idx < len(apts) else "2amb"
        x0    = apt_ancho * apt_idx
        x_cen = x0 + apt_ancho / 2.0
        pct_l = _PROP_LIVING.get(tipo, 0.40)
        y_l   = y_pasillo * pct_l   # y-coord del muro living/dorm (0 si no hay)

        # ── 1+2. Ventanas de fachada (living + dormitorios) ───────────────
        # Se reparten en slots NO solapados: 1 living + n_dorms ventanas, cada
        # una centrada en su slot con un gap. Dos huecos que se intersecan en el
        # mismo muro disparan "No es posible cortar del muro", así que el ancho
        # se acota al slot disponible en lugar de usar posiciones fijas.
        n_dorms = {"1amb":0,"estudio":0,"2amb":1,"3amb":2,"4amb":3,"duplex":3}.get(tipo, 1)
        if sym_v and w_frente:
            GAP_W    = 0.30   # m — separación entre borde de ventana y borde de slot
            # Margen contra los muros divisorios/medianeras del apt. Debe cubrir
            # media pared (cortafuego 200mm) + jamba para no caer en la unión de
            # muros ("Conflictos de inserción con muro unido" / "No es posible
            # cortar del muro").
            MARGEN_A = 0.45
            n_win    = 1 + n_dorms
            slot     = (apt_ancho - 2 * MARGEN_A) / n_win
            for k in range(n_win):
                cx = x0 + MARGEN_A + slot * (k + 0.5)
                if k == 0:
                    ancho_w, alto_w, tag = min(2.40, slot - GAP_W), 1.50, "ventana_living"
                else:
                    ancho_w, alto_w, tag = min(1.20, slot - GAP_W), 1.20, "ventana_dorm%d" % k
                if ancho_w < 0.40:        # slot demasiado angosto para una ventana
                    continue
                inst = place(sym_v, w_frente, lvl, cx, 0.0, 0.90)
                if inst:
                    set_size(inst, ancho_w, alto_w)
                    aberturas.append({"nivel": nombre, "tipo": tag, "id": inst.Id.Value})

        # ── 3. Puerta de entrada al depto — muro del pasillo ─────────────
        if sym_p and w_pasillo:
            inst = place(sym_p, w_pasillo, lvl, x_cen, y_pasillo)
            if inst:
                set_size(inst, 0.90, 2.10)
                aberturas.append({"nivel": nombre, "tipo": "puerta_entrada_depto", "id": inst.Id.Value})

        # ── 4. Puertas interiores — muro separador living/dormitorios ─────
        if sym_p and y_l > 0.50:
            w_sep = find_wall_at_y(lvl.Id, y_l)
            if w_sep:
                inst = place(sym_p, w_sep, lvl, x0 + apt_ancho * 0.25, y_l)
                if inst:
                    set_size(inst, 0.80, 2.10)
                    aberturas.append({"nivel": nombre, "tipo": "puerta_int_living_dorm", "id": inst.Id.Value})

with Transaction(doc, "py-building-gen: Aberturas v2") as t:
    t.Start()
    for sym in [sym_p, sym_v]:
        if sym and not sym.IsActive:
            sym.Activate()
    crear_nivel("PB", es_pb=True)
    for i in range(1, pisos_tipo + 1):
        crear_nivel(f"P{i:02d}")
    t.Commit()

OUT = {"total": len(aberturas), "detalle": aberturas}


# --- py-building-gen: auto-reporte (cierre) ---
try:
    _pbg_report("ok", _out=globals().get("OUT", None))
except Exception:
    pass
# ----------------------------------------
