# Dynamo graph 06_escaleras_ascensores.dyn (Dynamo 4.0.0.0)
# Crea escaleras reales (StairsEditScope, 2 tramos + descanso, CABA) y shaft openings para ascensores.

frente_m = CodeBlock { 10.0; }
fondo_m = CodeBlock { 24.0; }
pisos_tipo = CodeBlock { 6; }
cant_esc = CodeBlock { 1; }
cant_asc = CodeBlock { 1; }
altura_pb_m = CodeBlock { 3.5; }
altura_tipo_m = CodeBlock { 2.8; }
escaleras_y_ascensores = Python(IN[0]=frente_m, IN[1]=fondo_m, IN[2]=pisos_tipo, IN[3]=cant_esc, IN[4]=cant_asc, IN[5]=altura_pb_m, IN[6]=altura_tipo_m)  # PythonNet3
# ---------- escaleras_y_ascensores.python (209 lines) ----------
def _fi(v, d=0.0): return float(v) if v is not None else float(d)
def _ii(v, d=0):   return int(v)   if v is not None else int(d)
def _si(v, d=""):  return str(v)   if v is not None else str(d)
# --- py-building-gen: auto-reporte (inicio) ---
import os as _pbg_os, json as _pbg_json, datetime as _pbg_dt
_PBG_DIR = 'C:\\Users\\feder\\OneDrive\\Escritorio\\py-building-gen\\output\\dynamo\\edificio_caballito_int\\_reports'
_PBG_SCRIPT = '06_escaleras_ascensores'
_PBG_NODE = 'Escaleras y Ascensores'
_PBG_KEY = '06_escaleras_ascensores__00_escaleras_y_ascensores'
def _pbg_warnings():
    try:
        _d = globals().get("doc", None)
        if _d is None:
            return []
        return [w.GetDescriptionText() for w in _d.GetWarnings()]
    except Exception:
        return []
def _pbg_report(_status, _out=None):
    try:
        _pbg_os.makedirs(_PBG_DIR, exist_ok=True)
        _rec = {
            "script": _PBG_SCRIPT,
            "nodo": _PBG_NODE,
            "key": _PBG_KEY,
            "status": _status,
            "timestamp": _pbg_dt.datetime.now().isoformat(timespec="seconds"),
            "out": _out,
            "warnings": _pbg_warnings() if _status == "ok" else [],
        }
        with open(_pbg_os.path.join(_PBG_DIR, _PBG_KEY + ".json"), "w", encoding="utf-8") as _f:
            _pbg_json.dump(_rec, _f, ensure_ascii=False, indent=2, default=str)
    except Exception:
        pass
_pbg_report("started")
# --- fin auto-reporte (inicio) ---

import clr
import math
clr.AddReference("RevitAPI")
from Autodesk.Revit.DB import (
    Level, Line, XYZ, FilteredElementCollector,
    Transaction, UnitUtils, UnitTypeId,
    Opening, CurveArray,
    IFailuresPreprocessor, FailureProcessingResult,
)
from Autodesk.Revit.DB.Architecture import (
    Stairs, StairsEditScope, StairsRun, StairsType,
    StairsRunJustification,
)

# Preprocesador de fallos requerido por StairsEditScope.Commit (IFailuresPreprocessor).
# Continúa ante warnings (p.ej. escalones fuera de rango), evita diálogos modales.
class _StairFailures(IFailuresPreprocessor):
    def PreprocessFailures(self, failuresAccessor):
        return FailureProcessingResult.Continue
clr.AddReference("RevitServices")
from RevitServices.Persistence import DocumentManager

doc = DocumentManager.Instance.CurrentDBDocument

frente_m    = _fi(IN[0])
fondo_m     = _fi(IN[1])
pisos_tipo  = _ii(IN[2])
cant_esc    = _ii(IN[3])
cant_asc    = _ii(IN[4])
altura_pb   = _fi(IN[5])
altura_tipo = _fi(IN[6])

# ── Misma geometría que Scripts 02/03/05 ──────────────────────────────────────
ESC_ANCHO = 3.00; ESC_FONDO = 5.50; ASC_ANCHO = 2.00
ancho_nucleo = cant_esc * ESC_ANCHO + cant_asc * ASC_ANCHO
x_nucleo     = (frente_m - ancho_nucleo) / 2.0
y_nucleo     = fondo_m - ESC_FONDO

# ── Geometría de la escalera por piso ────────────────────────────────────────
# 2 tramos rectos + descanso intermedio, dentro del shaft ESC_ANCHO × ESC_FONDO
MARGEN     = 0.10  # m — separación de muros de shaft
DESCANSO   = 1.10  # m — profundidad de descanso (mínimo CABA)
n_risers   = math.ceil(altura_tipo / 0.175)   # contrahuella ~17.5cm → 16 para 2.80m
n_por_tramo = n_risers // 2                    # 8 por tramo
run_len    = (ESC_FONDO - 2 * MARGEN - DESCANSO) / 2   # 2.10m
huella_m   = run_len / n_por_tramo              # ~0.2625m > 25cm CABA ✓

y_r1_ini = y_nucleo + MARGEN
y_r1_fin = y_r1_ini + run_len
y_r2_ini = y_r1_fin + DESCANSO
y_r2_fin = y_r2_ini + run_len

def m_to_ft(m):
    return UnitUtils.ConvertToInternalUnits(m, UnitTypeId.Meters)

def get_level(nombre):
    levels = FilteredElementCollector(doc).OfClass(Level).ToElements()
    return next((l for l in levels if l.Name == nombre), None)            or sorted(levels, key=lambda l: l.Elevation)[0]

def get_levels_sorted():
    levels = FilteredElementCollector(doc).OfClass(Level).ToElements()
    return sorted(levels, key=lambda l: l.Elevation)

def get_stair_type():
    col = FilteredElementCollector(doc).OfClass(StairsType).ToElements()
    return col[0] if col else None

def rect_opening_shaft(x0, y0, ancho, largo):
    arr = CurveArray()
    pts = [
        XYZ(m_to_ft(x0),       m_to_ft(y0),       0),
        XYZ(m_to_ft(x0+ancho), m_to_ft(y0),       0),
        XYZ(m_to_ft(x0+ancho), m_to_ft(y0+largo), 0),
        XYZ(m_to_ft(x0),       m_to_ft(y0+largo), 0),
    ]
    for k in range(4):
        arr.Append(Line.CreateBound(pts[k], pts[(k+1)%4]))
    return arr

# ── Escaleras ────────────────────────────────────────────────────────────────
stair_type = get_stair_type()
escaleras  = []
niveles    = ["PB"] + [f"P{i:02d}" for i in range(1, pisos_tipo + 1)]

if stair_type:
    for i_esc in range(cant_esc):
        x_cen = x_nucleo + i_esc * ESC_ANCHO + ESC_ANCHO / 2.0
        for idx in range(len(niveles) - 1):
            lvl_bot = get_level(niveles[idx])
            lvl_top = get_level(niveles[idx + 1])
            if lvl_bot is None or lvl_top is None:
                continue
            # Riser count y elevaciones derivados de la altura REAL del tramo
            # (PB→P01 usa altura_pb; el resto altura_tipo). lvl.Elevation ya está en pies.
            h_seg_ft = lvl_top.Elevation - lvl_bot.Elevation
            n_seg = max(2, int(round(h_seg_ft / m_to_ft(0.175))))
            if n_seg % 2 != 0:
                n_seg += 1                       # par → dos tramos iguales
            z_base = lvl_bot.Elevation           # base de la escalera (pies, modelo)
            z_mid  = z_base + h_seg_ft / 2.0     # nivel del descanso intermedio

            scope = StairsEditScope(doc, f"Esc{i_esc+1}_{niveles[idx+1]}")
            try:
                # Start crea una escalera vacía con tipo por defecto y devuelve su Id
                stair_id = scope.Start(lvl_bot.Id, lvl_top.Id)
                # Crear los tramos dentro de una Transaction abierta en el scope
                with Transaction(doc, "py-building-gen: Tramos escalera") as tr:
                    tr.Start()
                    stair_elem = doc.GetElement(stair_id)
                    stair_elem.DesiredRisersNumber = n_seg
                    # Tramo 1 — arranca en la base del tramo (Z = z_base)
                    StairsRun.CreateStraightRun(doc, stair_id,
                        Line.CreateBound(XYZ(m_to_ft(x_cen), m_to_ft(y_r1_ini), z_base),
                                         XYZ(m_to_ft(x_cen), m_to_ft(y_r1_fin), z_base)),
                        StairsRunJustification.Center)
                    # Tramo 2 — arranca en el descanso (Z = z_mid)
                    StairsRun.CreateStraightRun(doc, stair_id,
                        Line.CreateBound(XYZ(m_to_ft(x_cen), m_to_ft(y_r2_ini), z_mid),
                                         XYZ(m_to_ft(x_cen), m_to_ft(y_r2_fin), z_mid)),
                        StairsRunJustification.Center)
                    tr.Commit()
                scope.Commit(_StairFailures())
                escaleras.append({"tipo": "escalera_real", "nivel": niveles[idx+1],
                                   "id": stair_id.Value, "risers": n_seg,
                                   "huella_m": round(huella_m, 3)})
            except Exception as e:
                # Cancelar el scope si quedó abierto (idempotente bajo try/except)
                try: scope.Cancel()
                except Exception: pass
                escaleras.append({"tipo": "error", "nivel": niveles[idx+1], "msg": str(e)})
else:
    # Fallback: shaft openings si no hay StairsType en el template
    all_lvls = get_levels_sorted()
    lvl_pb   = next((l for l in all_lvls if l.Name == "PB"), all_lvls[0])
    lvl_top  = all_lvls[-1]
    with Transaction(doc, "py-building-gen: Escalera shaft fallback") as t:
        t.Start()
        for i in range(cant_esc):
            x0 = x_nucleo + i * ESC_ANCHO
            arr = rect_opening_shaft(x0, y_nucleo, ESC_ANCHO, ESC_FONDO)
            op = doc.Create.NewOpening(lvl_pb, lvl_top, arr)
            escaleras.append({"tipo": "shaft_fallback", "id": op.Id.Value})
        t.Commit()

# ── Ascensores: shaft opening (apropiado para cabina de ascensor) ─────────────
ascensores = []
all_lvls = get_levels_sorted()
lvl_pb   = next((l for l in all_lvls if l.Name == "PB"), all_lvls[0])
lvl_top  = all_lvls[-1]

with Transaction(doc, "py-building-gen: Shaft ascensores") as t:
    t.Start()
    for i in range(cant_asc):
        x0 = x_nucleo + cant_esc * ESC_ANCHO + i * ASC_ANCHO
        arr = rect_opening_shaft(x0, y_nucleo, ASC_ANCHO, ESC_FONDO)
        op = doc.Create.NewOpening(lvl_pb, lvl_top, arr)
        ascensores.append({"tipo": f"ascensor_{i+1}", "id": op.Id.Value})
    t.Commit()

OUT = {
    "escaleras": escaleras,
    "ascensores": ascensores,
    "escalera_tipo": stair_type.Name if stair_type else "fallback_shaft",
    "config": {"n_escalones": n_risers, "n_por_tramo": n_por_tramo,
                "huella_m": round(huella_m, 3), "descanso_m": DESCANSO},
}


# --- py-building-gen: auto-reporte (cierre) ---
try:
    _pbg_report("ok", _out=globals().get("OUT", None))
except Exception:
    pass
# ----------------------------------------
