# Dynamo graph 07_instalaciones_mep.dyn (Dynamo 4.0.0.0)
# Crea espacios MEP, matafuegos (NFPA 13) y tableros eléctricos seccionales por nivel.

pisos_tipo = CodeBlock { 6; }
frente_m = CodeBlock { 10.0; }
fondo_m = CodeBlock { 24.0; }
cant_escaleras = CodeBlock { 1; }
cant_ascensores = CodeBlock { 1; }
inst_san = CodeBlock { true; }
inst_elec = CodeBlock { true; }
inst_inc = CodeBlock { true; }
artefactos_mep_v2 = Python(IN[0]=pisos_tipo, IN[1]=frente_m, IN[2]=fondo_m, IN[3]=cant_escaleras, IN[4]=cant_ascensores, IN[5]=inst_san, IN[6]=inst_elec, IN[7]=inst_inc)  # PythonNet3
# ---------- artefactos_mep_v2.python (157 lines) ----------
def _fi(v, d=0.0): return float(v) if v is not None else float(d)
def _ii(v, d=0):   return int(v)   if v is not None else int(d)
def _si(v, d=""):  return str(v)   if v is not None else str(d)
# --- py-building-gen: auto-reporte (inicio) ---
import os as _pbg_os, json as _pbg_json, datetime as _pbg_dt
_PBG_DIR = 'C:\\Users\\feder\\OneDrive\\Escritorio\\py-building-gen\\output\\dynamo\\edificio_caballito_int\\_reports'
_PBG_SCRIPT = '07_instalaciones_mep'
_PBG_NODE = 'Artefactos MEP v2'
_PBG_KEY = '07_instalaciones_mep__00_artefactos_mep_v2'
def _pbg_warnings():
    try:
        _d = globals().get("doc", None)
        if _d is None:
            return []
        return [w.GetDescriptionText() for w in _d.GetWarnings()]
    except Exception:
        return []
def _pbg_report(_status, _out=None):
    try:
        _pbg_os.makedirs(_PBG_DIR, exist_ok=True)
        _rec = {
            "script": _PBG_SCRIPT,
            "nodo": _PBG_NODE,
            "key": _PBG_KEY,
            "status": _status,
            "timestamp": _pbg_dt.datetime.now().isoformat(timespec="seconds"),
            "out": _out,
            "warnings": _pbg_warnings() if _status == "ok" else [],
        }
        with open(_pbg_os.path.join(_PBG_DIR, _PBG_KEY + ".json"), "w", encoding="utf-8") as _f:
            _pbg_json.dump(_rec, _f, ensure_ascii=False, indent=2, default=str)
    except Exception:
        pass
_pbg_report("started")
# --- fin auto-reporte (inicio) ---

import clr
import json
clr.AddReference("RevitAPI")
from Autodesk.Revit.DB import (
    Level, XYZ, UV, FamilySymbol,
    FilteredElementCollector, BuiltInCategory,
    Transaction, UnitUtils, UnitTypeId,
)
from Autodesk.Revit.DB.Structure import StructuralType as ST
clr.AddReference("RevitServices")
from RevitServices.Persistence import DocumentManager

doc = DocumentManager.Instance.CurrentDBDocument

pisos_tipo      = _ii(IN[0])
frente_m        = _fi(IN[1])
fondo_m         = _fi(IN[2])
cant_escaleras  = _ii(IN[3])
cant_ascensores = _ii(IN[4])
inst_san        = bool(IN[5])
inst_elec       = bool(IN[6])
inst_inc        = bool(IN[7])

# ── Layout geometry ────────────────────────────────────────────────────────────
ESC_ANCHO = 3.00; ESC_FONDO = 5.50; ASC_ANCHO = 2.00; PASILLO_PROF = 1.20
ancho_nucleo = cant_escaleras * ESC_ANCHO + cant_ascensores * ASC_ANCHO
x_nucleo     = (frente_m - ancho_nucleo) / 2.0
y_nucleo     = fondo_m - ESC_FONDO
y_pasillo    = y_nucleo - PASILLO_PROF
# Matafuego y tablero: contra pared del pasillo, lado izquierdo del núcleo
x_mat = max(0.30, x_nucleo - 0.50)   # 0.50m antes del shaft
y_mat = y_pasillo + 0.60              # en el pasillo, cerca del inicio del shaft

def m_to_ft(m):
    return UnitUtils.ConvertToInternalUnits(m, UnitTypeId.Meters)

def get_levels_tipo():
    levels = FilteredElementCollector(doc).OfClass(Level).ToElements()
    return sorted(
        [l for l in levels if l.Name.startswith("P") and l.Name[1:].isdigit()],
        key=lambda l: l.Elevation
    )

def get_level(nombre):
    levels = FilteredElementCollector(doc).OfClass(Level).ToElements()
    return next((l for l in levels if l.Name == nombre), None)

def get_sym(categoria, keywords):
    col = FilteredElementCollector(doc).OfClass(FamilySymbol).OfCategory(categoria).ToElements()
    match = next((s for s in col if any(k in s.FamilyName.lower() for k in keywords)), None)
    return match or (col[0] if col else None)

# ── Symbols ────────────────────────────────────────────────────────────────────
_KW_MAT  = ("fire","extintor","matafuego","extinguisher","sprinkler")
_KW_TAB  = ("panel","tablero","board","electrical","distribution","cuadro")

sym_mat = get_sym(BuiltInCategory.OST_FireAlarmDevices,   _KW_MAT) or           get_sym(BuiltInCategory.OST_GenericModel,        _KW_MAT)
sym_tab = get_sym(BuiltInCategory.OST_ElectricalEquipment, _KW_TAB) or           get_sym(BuiltInCategory.OST_GenericModel,         _KW_TAB)

artefactos = []
spaces_creados = []

with Transaction(doc, "py-building-gen: Artefactos MEP v2") as t:
    t.Start()

    # Activar símbolos
    for sym in [sym_mat, sym_tab]:
        if sym and not sym.IsActive:
            sym.Activate()

    for lvl in get_levels_tipo():
        # MEP Space (para análisis de cargas)
        uv_sp = UV(m_to_ft(frente_m * 0.5), m_to_ft(fondo_m * 0.5))
        try:
            sp = doc.Create.NewSpace(lvl, uv_sp)
            p_name = sp.LookupParameter("Name")
            if p_name:
                p_name.Set(f"Zona MEP {lvl.Name}")
            spaces_creados.append({"nivel": lvl.Name, "id": sp.Id.Value})
        except Exception as e:
            spaces_creados.append({"nivel": lvl.Name, "error": str(e)})

        # Matafuego — NFPA 13: 1 por piso en pasillo junto a escalera
        if inst_inc and sym_mat:
            pt = XYZ(m_to_ft(x_mat), m_to_ft(y_mat), lvl.Elevation + m_to_ft(1.50))
            try:
                inst = doc.Create.NewFamilyInstance(pt, sym_mat, lvl, ST.NonStructural)
                artefactos.append({"nivel": lvl.Name, "tipo": "matafuego", "id": inst.Id.Value})
            except Exception:
                pass

        # Tablero eléctrico seccional — 1 por piso en pasillo
        if inst_elec and sym_tab:
            pt = XYZ(m_to_ft(x_mat + 0.60), m_to_ft(y_mat), lvl.Elevation + m_to_ft(1.50))
            try:
                inst = doc.Create.NewFamilyInstance(pt, sym_tab, lvl, ST.NonStructural)
                artefactos.append({"nivel": lvl.Name, "tipo": "tablero_seccional", "id": inst.Id.Value})
            except Exception:
                pass

    t.Commit()

instalaciones = []
if inst_san:  instalaciones.append("Sanitaria")
if inst_elec: instalaciones.append("Eléctrica")
if inst_inc:  instalaciones.append("Incendio")

OUT = {
    "spaces_mep": len(spaces_creados),
    "artefactos": len(artefactos),
    "detalle": artefactos,
    "instalaciones_activas": instalaciones,
    "nota": "Completar redes de tuberías y conductos manualmente en Revit MEP.",
}


# --- py-building-gen: auto-reporte (cierre) ---
try:
    _pbg_report("ok", _out=globals().get("OUT", None))
except Exception:
    pass
# ----------------------------------------
inst_san_2 = CodeBlock { true; }
inst_elec_2 = CodeBlock { true; }
inst_gas = CodeBlock { true; }
inst_inc_2 = CodeBlock { true; }
inst_term = CodeBlock { false; }
sistemas_mep = Python(IN[0]=inst_san_2, IN[1]=inst_elec_2, IN[2]=inst_gas, IN[3]=inst_inc_2, IN[4]=inst_term)  # PythonNet3
# ---------- sistemas_mep.python (74 lines) ----------
def _fi(v, d=0.0): return float(v) if v is not None else float(d)
def _ii(v, d=0):   return int(v)   if v is not None else int(d)
def _si(v, d=""):  return str(v)   if v is not None else str(d)
# --- py-building-gen: auto-reporte (inicio) ---
import os as _pbg_os, json as _pbg_json, datetime as _pbg_dt
_PBG_DIR = 'C:\\Users\\feder\\OneDrive\\Escritorio\\py-building-gen\\output\\dynamo\\edificio_caballito_int\\_reports'
_PBG_SCRIPT = '07_instalaciones_mep'
_PBG_NODE = 'Sistemas MEP'
_PBG_KEY = '07_instalaciones_mep__01_sistemas_mep'
def _pbg_warnings():
    try:
        _d = globals().get("doc", None)
        if _d is None:
            return []
        return [w.GetDescriptionText() for w in _d.GetWarnings()]
    except Exception:
        return []
def _pbg_report(_status, _out=None):
    try:
        _pbg_os.makedirs(_PBG_DIR, exist_ok=True)
        _rec = {
            "script": _PBG_SCRIPT,
            "nodo": _PBG_NODE,
            "key": _PBG_KEY,
            "status": _status,
            "timestamp": _pbg_dt.datetime.now().isoformat(timespec="seconds"),
            "out": _out,
            "warnings": _pbg_warnings() if _status == "ok" else [],
        }
        with open(_pbg_os.path.join(_PBG_DIR, _PBG_KEY + ".json"), "w", encoding="utf-8") as _f:
            _pbg_json.dump(_rec, _f, ensure_ascii=False, indent=2, default=str)
    except Exception:
        pass
_pbg_report("started")
# --- fin auto-reporte (inicio) ---

import clr
clr.AddReference("RevitAPI")
from Autodesk.Revit.DB import (
    MEPSystemType, FilteredElementCollector,
    Transaction, BuiltInCategory,
)
from Autodesk.Revit.DB.Plumbing import PipingSystemType
from Autodesk.Revit.DB.Mechanical import MechanicalSystemType

clr.AddReference("RevitServices")
from RevitServices.Persistence import DocumentManager
doc  = DocumentManager.Instance.CurrentDBDocument

inst_san  = bool(IN[0])
inst_elec = bool(IN[1])
inst_gas  = bool(IN[2])
inst_inc  = bool(IN[3])
inst_term = bool(IN[4])

sistemas = []

def listar_sistemas(cls, nombre_sistema):
    col = FilteredElementCollector(doc).OfClass(cls).ToElements()
    return [{"sistema": nombre_sistema, "tipo": s.Name} for s in col]

if inst_san or inst_inc:
    sistemas += listar_sistemas(PipingSystemType, "Plomería / Incendio")
if inst_term:
    sistemas += listar_sistemas(MechanicalSystemType, "Termomecánica")

OUT = sistemas if sistemas else ["Sin sistemas MEP definidos en la plantilla"]


# --- py-building-gen: auto-reporte (cierre) ---
try:
    _pbg_report("ok", _out=globals().get("OUT", None))
except Exception:
    pass
# ----------------------------------------
