# Dynamo graph 08_vistas.dyn (Dynamo 4.0.0.0)
# Crea plantas, cortes, alzados y vista 3D para documentación técnica.

pisos_tipo = CodeBlock { 6; }
tiene_azotea = CodeBlock { true; }
crear_plantas = Python(IN[0]=pisos_tipo, IN[1]=tiene_azotea)  # PythonNet3
# ---------- crear_plantas.python (96 lines) ----------
def _fi(v, d=0.0): return float(v) if v is not None else float(d)
def _ii(v, d=0):   return int(v)   if v is not None else int(d)
def _si(v, d=""):  return str(v)   if v is not None else str(d)
# --- py-building-gen: auto-reporte (inicio) ---
import os as _pbg_os, json as _pbg_json, datetime as _pbg_dt
_PBG_DIR = 'C:\\Users\\feder\\OneDrive\\Escritorio\\py-building-gen\\output\\dynamo\\edificio_caballito_int\\_reports'
_PBG_SCRIPT = '08_vistas'
_PBG_NODE = 'Crear Plantas'
_PBG_KEY = '08_vistas__00_crear_plantas'
def _pbg_warnings():
    try:
        _d = globals().get("doc", None)
        if _d is None:
            return []
        return [w.GetDescriptionText() for w in _d.GetWarnings()]
    except Exception:
        return []
def _pbg_report(_status, _out=None):
    try:
        _pbg_os.makedirs(_PBG_DIR, exist_ok=True)
        _rec = {
            "script": _PBG_SCRIPT,
            "nodo": _PBG_NODE,
            "key": _PBG_KEY,
            "status": _status,
            "timestamp": _pbg_dt.datetime.now().isoformat(timespec="seconds"),
            "out": _out,
            "warnings": _pbg_warnings() if _status == "ok" else [],
        }
        with open(_pbg_os.path.join(_PBG_DIR, _PBG_KEY + ".json"), "w", encoding="utf-8") as _f:
            _pbg_json.dump(_rec, _f, ensure_ascii=False, indent=2, default=str)
    except Exception:
        pass
_pbg_report("started")
# --- fin auto-reporte (inicio) ---

import clr
clr.AddReference("RevitAPI")
from Autodesk.Revit.DB import (
    ViewPlan, ViewFamilyType, ViewFamily, Level,
    FilteredElementCollector, Transaction,
    ElementId,
)

clr.AddReference("RevitServices")
from RevitServices.Persistence import DocumentManager
doc  = DocumentManager.Instance.CurrentDBDocument

pisos_tipo   = _ii(IN[0])
tiene_azotea = bool(IN[1])

def get_view_family_type(familia):
    tipos = FilteredElementCollector(doc).OfClass(ViewFamilyType).ToElements()
    return next((t for t in tipos if t.ViewFamily == familia), None)

def get_level(nombre):
    levels = FilteredElementCollector(doc).OfClass(Level).ToElements()
    return next((l for l in levels if l.Name == nombre), None)

vft_planta = get_view_family_type(ViewFamily.FloorPlan)
plantas = []

if vft_planta:
    with Transaction(doc, "py-building-gen: Plantas") as t:
        t.Start()

        nombres_nivel = ["PB"] + [f"P{i:02d}" for i in range(1, pisos_tipo + 1)]
        if tiene_azotea:
            nombres_nivel.append("AZO")

        for nombre in nombres_nivel:
            lvl = get_level(nombre)
            if lvl is None:
                continue
            nombre_vista = f"PLANTA {nombre}"
            existente = next(
                (v for v in FilteredElementCollector(doc).OfClass(ViewPlan).ToElements()
                 if v.Name == nombre_vista), None
            )
            if existente:
                plantas.append({"nivel": nombre, "id": existente.Id.Value})
                continue
            vista = ViewPlan.Create(doc, vft_planta.Id, lvl.Id)
            vista.Name = nombre_vista
            plantas.append({"nivel": nombre, "id": vista.Id.Value})

        t.Commit()

OUT = plantas


# --- py-building-gen: auto-reporte (cierre) ---
try:
    _pbg_report("ok", _out=globals().get("OUT", None))
except Exception:
    pass
# ----------------------------------------
frente_m = CodeBlock { 10.0; }
fondo_m = CodeBlock { 24.0; }
altura_total_m = CodeBlock { 20.299999999999997; }
crear_cortes_y_alzados = Python(IN[0]=frente_m, IN[1]=fondo_m, IN[2]=altura_total_m)  # PythonNet3
# ---------- crear_cortes_y_alzados.python (143 lines) ----------
def _fi(v, d=0.0): return float(v) if v is not None else float(d)
def _ii(v, d=0):   return int(v)   if v is not None else int(d)
def _si(v, d=""):  return str(v)   if v is not None else str(d)
# --- py-building-gen: auto-reporte (inicio) ---
import os as _pbg_os, json as _pbg_json, datetime as _pbg_dt
_PBG_DIR = 'C:\\Users\\feder\\OneDrive\\Escritorio\\py-building-gen\\output\\dynamo\\edificio_caballito_int\\_reports'
_PBG_SCRIPT = '08_vistas'
_PBG_NODE = 'Crear Cortes y Alzados'
_PBG_KEY = '08_vistas__01_crear_cortes_y_alzados'
def _pbg_warnings():
    try:
        _d = globals().get("doc", None)
        if _d is None:
            return []
        return [w.GetDescriptionText() for w in _d.GetWarnings()]
    except Exception:
        return []
def _pbg_report(_status, _out=None):
    try:
        _pbg_os.makedirs(_PBG_DIR, exist_ok=True)
        _rec = {
            "script": _PBG_SCRIPT,
            "nodo": _PBG_NODE,
            "key": _PBG_KEY,
            "status": _status,
            "timestamp": _pbg_dt.datetime.now().isoformat(timespec="seconds"),
            "out": _out,
            "warnings": _pbg_warnings() if _status == "ok" else [],
        }
        with open(_pbg_os.path.join(_PBG_DIR, _PBG_KEY + ".json"), "w", encoding="utf-8") as _f:
            _pbg_json.dump(_rec, _f, ensure_ascii=False, indent=2, default=str)
    except Exception:
        pass
_pbg_report("started")
# --- fin auto-reporte (inicio) ---

import clr
clr.AddReference("RevitAPI")
from Autodesk.Revit.DB import (
    ViewSection, ViewFamilyType, ViewFamily, BoundingBoxXYZ,
    XYZ, Transform, FilteredElementCollector, Transaction,
    UnitUtils, UnitTypeId,
)
clr.AddReference("RevitServices")
from RevitServices.Persistence import DocumentManager

doc = DocumentManager.Instance.CurrentDBDocument

frente_m     = _fi(IN[0])
fondo_m      = _fi(IN[1])
altura_total = _fi(IN[2])

def m_to_ft(m):
    return UnitUtils.ConvertToInternalUnits(m, UnitTypeId.Meters)

def get_vft_section():
    tipos = FilteredElementCollector(doc).OfClass(ViewFamilyType).ToElements()
    return next((t for t in tipos if t.ViewFamily == ViewFamily.Section), None)

def make_section(vft, origen, basis_x, basis_z, half_w, h, profundidad):
    """Crea una ViewSection con los vectores dados."""
    bbox = BoundingBoxXYZ()
    xf = Transform.Identity
    xf.BasisX = basis_x
    xf.BasisY = XYZ(0, 0, 1)
    xf.BasisZ = basis_z
    xf.Origin = origen
    bbox.Transform = xf
    margen = m_to_ft(1.0)
    bbox.Min = XYZ(-half_w - margen, 0, -margen)
    bbox.Max = XYZ( half_w + margen, h,  profundidad + margen)
    return ViewSection.CreateSection(doc, vft.Id, bbox)

vft  = get_vft_section()
vistas = []

if vft:
    with Transaction(doc, "py-building-gen: Cortes y Alzados v2") as t:
        t.Start()

        h      = m_to_ft(altura_total + 1.0)
        hf_x   = m_to_ft(frente_m / 2)
        hf_y   = m_to_ft(fondo_m  / 2)
        prof   = m_to_ft(fondo_m + 2.0)

        # ── Corte A-A transversal (perpendicular al frente) ───────────────
        v = make_section(vft,
            XYZ(hf_x, hf_y, 0),
            XYZ(1,0,0), XYZ(0,-1,0),
            hf_x, h, m_to_ft(fondo_m / 2 + 1.0))
        v.Name = "CORTE A-A"
        vistas.append({"tipo": "corte_transversal", "id": v.Id.Value})

        # ── Corte B-B longitudinal (paralelo al frente) ───────────────────
        v2 = make_section(vft,
            XYZ(hf_x, hf_y, 0),
            XYZ(0,1,0), XYZ(1,0,0),
            hf_y, h, m_to_ft(frente_m / 2 + 1.0))
        v2.Name = "CORTE B-B"
        vistas.append({"tipo": "corte_longitudinal", "id": v2.Id.Value})

        # ── Fachada principal (mirando desde el frente, Y negativo) ───────
        v3 = make_section(vft,
            XYZ(hf_x, m_to_ft(-2.0), 0),
            XYZ(1,0,0), XYZ(0,1,0),
            hf_x, h, prof)
        v3.Name = "FACHADA PRINCIPAL"
        vistas.append({"tipo": "fachada_principal", "id": v3.Id.Value})

        # ── Fachada contrafrente (mirando desde el fondo, Y positivo) ─────
        v4 = make_section(vft,
            XYZ(hf_x, m_to_ft(fondo_m + 2.0), 0),
            XYZ(-1,0,0), XYZ(0,-1,0),
            hf_x, h, prof)
        v4.Name = "FACHADA CONTRAFRENTE"
        vistas.append({"tipo": "fachada_contrafrente", "id": v4.Id.Value})

        # ── Fachada lateral izquierda (X = 0) ────────────────────────────
        v5 = make_section(vft,
            XYZ(m_to_ft(-2.0), hf_y, 0),
            XYZ(0,1,0), XYZ(-1,0,0),
            hf_y, h, prof)
        v5.Name = "FACHADA LATERAL IZQ"
        vistas.append({"tipo": "fachada_lateral_izq", "id": v5.Id.Value})

        # ── Fachada lateral derecha (X = frente_m) ───────────────────────
        v6 = make_section(vft,
            XYZ(m_to_ft(frente_m + 2.0), hf_y, 0),
            XYZ(0,-1,0), XYZ(1,0,0),
            hf_y, h, prof)
        v6.Name = "FACHADA LATERAL DER"
        vistas.append({"tipo": "fachada_lateral_der", "id": v6.Id.Value})

        t.Commit()

OUT = vistas


# --- py-building-gen: auto-reporte (cierre) ---
try:
    _pbg_report("ok", _out=globals().get("OUT", None))
except Exception:
    pass
# ----------------------------------------
crear_vista_3d = Python()  # PythonNet3
# ---------- crear_vista_3d.python (70 lines) ----------
def _fi(v, d=0.0): return float(v) if v is not None else float(d)
def _ii(v, d=0):   return int(v)   if v is not None else int(d)
def _si(v, d=""):  return str(v)   if v is not None else str(d)
# --- py-building-gen: auto-reporte (inicio) ---
import os as _pbg_os, json as _pbg_json, datetime as _pbg_dt
_PBG_DIR = 'C:\\Users\\feder\\OneDrive\\Escritorio\\py-building-gen\\output\\dynamo\\edificio_caballito_int\\_reports'
_PBG_SCRIPT = '08_vistas'
_PBG_NODE = 'Crear Vista 3D'
_PBG_KEY = '08_vistas__02_crear_vista_3d'
def _pbg_warnings():
    try:
        _d = globals().get("doc", None)
        if _d is None:
            return []
        return [w.GetDescriptionText() for w in _d.GetWarnings()]
    except Exception:
        return []
def _pbg_report(_status, _out=None):
    try:
        _pbg_os.makedirs(_PBG_DIR, exist_ok=True)
        _rec = {
            "script": _PBG_SCRIPT,
            "nodo": _PBG_NODE,
            "key": _PBG_KEY,
            "status": _status,
            "timestamp": _pbg_dt.datetime.now().isoformat(timespec="seconds"),
            "out": _out,
            "warnings": _pbg_warnings() if _status == "ok" else [],
        }
        with open(_pbg_os.path.join(_PBG_DIR, _PBG_KEY + ".json"), "w", encoding="utf-8") as _f:
            _pbg_json.dump(_rec, _f, ensure_ascii=False, indent=2, default=str)
    except Exception:
        pass
_pbg_report("started")
# --- fin auto-reporte (inicio) ---

import clr
clr.AddReference("RevitAPI")
from Autodesk.Revit.DB import (
    View3D, ViewFamilyType, ViewFamily,
    FilteredElementCollector, Transaction,
)

clr.AddReference("RevitServices")
from RevitServices.Persistence import DocumentManager
doc  = DocumentManager.Instance.CurrentDBDocument

def get_vft_3d():
    tipos = FilteredElementCollector(doc).OfClass(ViewFamilyType).ToElements()
    return next((t for t in tipos if t.ViewFamily == ViewFamily.ThreeDimensional), None)

vft = get_vft_3d()
resultado = []

if vft:
    with Transaction(doc, "py-building-gen: Vista 3D") as t:
        t.Start()
        v3d = View3D.CreateIsometric(doc, vft.Id)
        v3d.Name = "3D - Vista General"
        resultado.append({"tipo": "3d_isometrica", "id": v3d.Id.Value})
        t.Commit()

OUT = resultado


# --- py-building-gen: auto-reporte (cierre) ---
try:
    _pbg_report("ok", _out=globals().get("OUT", None))
except Exception:
    pass
# ----------------------------------------
visibility_overrides = Python()  # PythonNet3
# ---------- visibility_overrides.python (111 lines) ----------
def _fi(v, d=0.0): return float(v) if v is not None else float(d)
def _ii(v, d=0):   return int(v)   if v is not None else int(d)
def _si(v, d=""):  return str(v)   if v is not None else str(d)
# --- py-building-gen: auto-reporte (inicio) ---
import os as _pbg_os, json as _pbg_json, datetime as _pbg_dt
_PBG_DIR = 'C:\\Users\\feder\\OneDrive\\Escritorio\\py-building-gen\\output\\dynamo\\edificio_caballito_int\\_reports'
_PBG_SCRIPT = '08_vistas'
_PBG_NODE = 'Visibility Overrides'
_PBG_KEY = '08_vistas__03_visibility_overrides'
def _pbg_warnings():
    try:
        _d = globals().get("doc", None)
        if _d is None:
            return []
        return [w.GetDescriptionText() for w in _d.GetWarnings()]
    except Exception:
        return []
def _pbg_report(_status, _out=None):
    try:
        _pbg_os.makedirs(_PBG_DIR, exist_ok=True)
        _rec = {
            "script": _PBG_SCRIPT,
            "nodo": _PBG_NODE,
            "key": _PBG_KEY,
            "status": _status,
            "timestamp": _pbg_dt.datetime.now().isoformat(timespec="seconds"),
            "out": _out,
            "warnings": _pbg_warnings() if _status == "ok" else [],
        }
        with open(_pbg_os.path.join(_PBG_DIR, _PBG_KEY + ".json"), "w", encoding="utf-8") as _f:
            _pbg_json.dump(_rec, _f, ensure_ascii=False, indent=2, default=str)
    except Exception:
        pass
_pbg_report("started")
# --- fin auto-reporte (inicio) ---

import clr
clr.AddReference("RevitAPI")
from Autodesk.Revit.DB import (
    ViewPlan, View, BuiltInCategory, ElementId,
    OverrideGraphicSettings, FilteredElementCollector,
    Transaction,
)
clr.AddReference("RevitServices")
from RevitServices.Persistence import DocumentManager

doc = DocumentManager.Instance.CurrentDBDocument

# Categorías a ocultar según disciplina de la vista
CAT_ESTRUCTURA = [
    int(BuiltInCategory.OST_StructuralColumns),
    int(BuiltInCategory.OST_StructuralFraming),
    int(BuiltInCategory.OST_StructuralFoundation),
    int(BuiltInCategory.OST_StructuralStiffener),
]
CAT_ARQ = [
    int(BuiltInCategory.OST_Walls),
    int(BuiltInCategory.OST_Floors),
    int(BuiltInCategory.OST_Doors),
    int(BuiltInCategory.OST_Windows),
    int(BuiltInCategory.OST_Stairs),
    int(BuiltInCategory.OST_Rooms),
]

def is_arq_view(v):
    return v.Name.startswith("PLANTA") or v.Name.startswith("CORTE") or v.Name.startswith("FACHADA")

def is_est_view(v):
    return v.Name.startswith("EST ")

def is_mep_view(v):
    return v.Name.startswith("MEP ")

def set_hidden(view, cat_ids, hidden):
    for cat_id in cat_ids:
        eid = ElementId(cat_id)
        try:
            view.SetCategoryHidden(eid, hidden)
        except Exception:
            pass

vistas_config = []

with Transaction(doc, "py-building-gen: Visibility Overrides") as t:
    t.Start()
    all_views = FilteredElementCollector(doc).OfClass(ViewPlan).ToElements()
    for v in all_views:
        if v.IsTemplate:
            continue
        try:
            if is_arq_view(v):
                set_hidden(v, CAT_ESTRUCTURA, True)    # oculta estructura en ARQ
                vistas_config.append({"vista": v.Name, "config": "ARQ — estructura oculta"})
            elif is_est_view(v):
                set_hidden(v, CAT_ARQ, True)            # oculta elementos ARQ en EST
                vistas_config.append({"vista": v.Name, "config": "EST — elementos ARQ ocultos"})
            elif is_mep_view(v):
                set_hidden(v, CAT_ESTRUCTURA, True)
                vistas_config.append({"vista": v.Name, "config": "MEP — estructura oculta"})
        except Exception as e:
            vistas_config.append({"vista": v.Name, "error": str(e)})
    t.Commit()

OUT = {"vistas_configuradas": len(vistas_config), "detalle": vistas_config}


# --- py-building-gen: auto-reporte (cierre) ---
try:
    _pbg_report("ok", _out=globals().get("OUT", None))
except Exception:
    pass
# ----------------------------------------
