# Dynamo graph 09_sheets.dyn (Dynamo 4.0.0.0)
# Crea 13 láminas A3 IRAM organizadas por disciplina (ARQ, EST, MEP, 3D) con vistas colocadas.

nombre_proyecto = CodeBlock { "Edificio Caballito"; }
autor = CodeBlock { "Federico A. Casado"; }
pisos_tipo = CodeBlock { 6; }
tiene_azotea = CodeBlock { true; }
crear_sheets_v2 = Python(IN[0]=nombre_proyecto, IN[1]=autor, IN[2]=pisos_tipo, IN[3]=tiene_azotea)  # PythonNet3
# ---------- crear_sheets_v2.python (147 lines) ----------
def _fi(v, d=0.0): return float(v) if v is not None else float(d)
def _ii(v, d=0):   return int(v)   if v is not None else int(d)
def _si(v, d=""):  return str(v)   if v is not None else str(d)
# --- py-building-gen: auto-reporte (inicio) ---
import os as _pbg_os, json as _pbg_json, datetime as _pbg_dt
_PBG_DIR = 'C:\\Users\\feder\\OneDrive\\Escritorio\\py-building-gen\\output\\dynamo\\edificio_caballito_int\\_reports'
_PBG_SCRIPT = '09_sheets'
_PBG_NODE = 'Crear Sheets v2'
_PBG_KEY = '09_sheets__00_crear_sheets_v2'
def _pbg_warnings():
    try:
        _d = globals().get("doc", None)
        if _d is None:
            return []
        return [w.GetDescriptionText() for w in _d.GetWarnings()]
    except Exception:
        return []
def _pbg_report(_status, _out=None):
    try:
        _pbg_os.makedirs(_PBG_DIR, exist_ok=True)
        _rec = {
            "script": _PBG_SCRIPT,
            "nodo": _PBG_NODE,
            "key": _PBG_KEY,
            "status": _status,
            "timestamp": _pbg_dt.datetime.now().isoformat(timespec="seconds"),
            "out": _out,
            "warnings": _pbg_warnings() if _status == "ok" else [],
        }
        with open(_pbg_os.path.join(_PBG_DIR, _PBG_KEY + ".json"), "w", encoding="utf-8") as _f:
            _pbg_json.dump(_rec, _f, ensure_ascii=False, indent=2, default=str)
    except Exception:
        pass
_pbg_report("started")
# --- fin auto-reporte (inicio) ---

import clr
clr.AddReference("RevitAPI")
from Autodesk.Revit.DB import (
    ViewSheet, FamilySymbol, ViewPlan, ViewSection, View3D,
    FilteredElementCollector, BuiltInCategory,
    Transaction, Viewport, XYZ, UnitUtils, UnitTypeId,
)
clr.AddReference("RevitServices")
from RevitServices.Persistence import DocumentManager

doc = DocumentManager.Instance.CurrentDBDocument

proyecto      = _si(IN[0])
autor         = _si(IN[1])
pisos_tipo    = _ii(IN[2])
tiene_azotea  = bool(IN[3])

def m_to_ft(m):
    return UnitUtils.ConvertToInternalUnits(m, UnitTypeId.Meters)

# Centro A3 horizontal (420 × 297 mm)
CENTRO_A3 = XYZ(m_to_ft(0.210), m_to_ft(0.1485), 0)

def get_title_block():
    col = (FilteredElementCollector(doc)
           .OfClass(FamilySymbol)
           .OfCategory(BuiltInCategory.OST_TitleBlocks)
           .ToElements())
    for kw in ("iram","a3","A3"):
        match = next((s for s in col if kw.lower() in s.Name.lower()), None)
        if match:
            return match
    return col[0] if col else None

def todas_las_vistas():
    return (list(FilteredElementCollector(doc).OfClass(ViewPlan).ToElements()) +
            list(FilteredElementCollector(doc).OfClass(ViewSection).ToElements()) +
            list(FilteredElementCollector(doc).OfClass(View3D).ToElements()))

def set_meta(sheet, proyecto, autor):
    for nombres, val in [
        (["Drawn By","Dibujado por","Elaborado por"], autor),
        (["Designed By","Diseñado por","Proyectado por"], autor),
        (["Project Name","Nombre del proyecto","Proyecto"], proyecto),
    ]:
        for n in nombres:
            p = sheet.LookupParameter(n)
            if p and not p.IsReadOnly:
                p.Set(val)
                break

def create_sheet(tb, numero, titulo, filtro, vistas):
    sheet = ViewSheet.Create(doc, tb.Id)
    sheet.SheetNumber = numero
    sheet.Name = titulo
    set_meta(sheet, proyecto, autor)
    filtro_l = filtro.lower()
    vm = next((v for v in vistas if filtro_l in v.Name.lower()
               and sheet.CanAddViewToSheet(v)), None)
    if vm:
        Viewport.Create(doc, sheet.Id, vm.Id, CENTRO_A3)
    return sheet.Id.Value

tb = get_title_block()
sheets_creados = []

if not tb:
    OUT = {"error": "No se encontró title block. Cargar familia IRAM A3 antes de correr este script."}
else:
    if not tb.IsActive:
        tb.Activate()

    vistas = todas_las_vistas()

    # ── Configuración de láminas por disciplina ─────────────────────────────
    config_laminas = [
        # ARQ — plantas
        ("A-01", "ARQ - PLANTA BAJA",             "PLANTA PB"),
        ("A-02", "ARQ - PLANTA TIPO (P01)",        "PLANTA P01"),
        ("A-03", "ARQ - PLANTA AZOTEA",            "PLANTA AZO"),
        # ARQ — cortes y alzados
        ("A-04", "ARQ - CORTE A-A",                "CORTE A-A"),
        ("A-05", "ARQ - CORTE B-B",                "CORTE B-B"),
        ("A-06", "ARQ - FACHADA PRINCIPAL",        "FACHADA PRINCIPAL"),
        ("A-07", "ARQ - FACHADA CONTRAFRENTE",     "FACHADA CONTRAFRENTE"),
        ("A-08", "ARQ - FACHADAS LATERALES",       "FACHADA LATERAL"),
        # EST — estructura
        ("E-01", "EST - PLANTA FUNDACIONES",        "EST PB"),
        ("E-02", "EST - PLANTA ESTRUCTURA TIPO",    "EST P01"),
        # MEP — instalaciones
        ("M-01", "MEP - PLANTA INSTALACIONES PB",   "MEP PB"),
        ("M-02", "MEP - PLANTA INSTALACIONES TIPO", "MEP P01"),
        # General
        ("G-01", "3D - VISTA GENERAL",             "3D"),
    ]

    with Transaction(doc, "py-building-gen: Sheets v2") as t:
        t.Start()
        for numero, titulo, filtro in config_laminas:
            sid = create_sheet(tb, numero, titulo, filtro, vistas)
            sheets_creados.append({"numero": numero, "titulo": titulo, "id": sid})
        t.Commit()

OUT = {"total": len(sheets_creados), "laminas": sheets_creados}


# --- py-building-gen: auto-reporte (cierre) ---
try:
    _pbg_report("ok", _out=globals().get("OUT", None))
except Exception:
    pass
# ----------------------------------------
frente_m = CodeBlock { 10.0; }
fondo_m = CodeBlock { 24.0; }
pisos_tipo_2 = CodeBlock { 6; }
norte_y_cuadro = Python(IN[0]=frente_m, IN[1]=fondo_m, IN[2]=pisos_tipo_2)  # PythonNet3
# ---------- norte_y_cuadro.python (136 lines) ----------
def _fi(v, d=0.0): return float(v) if v is not None else float(d)
def _ii(v, d=0):   return int(v)   if v is not None else int(d)
def _si(v, d=""):  return str(v)   if v is not None else str(d)
# --- py-building-gen: auto-reporte (inicio) ---
import os as _pbg_os, json as _pbg_json, datetime as _pbg_dt
_PBG_DIR = 'C:\\Users\\feder\\OneDrive\\Escritorio\\py-building-gen\\output\\dynamo\\edificio_caballito_int\\_reports'
_PBG_SCRIPT = '09_sheets'
_PBG_NODE = 'Norte y Cuadro'
_PBG_KEY = '09_sheets__01_norte_y_cuadro'
def _pbg_warnings():
    try:
        _d = globals().get("doc", None)
        if _d is None:
            return []
        return [w.GetDescriptionText() for w in _d.GetWarnings()]
    except Exception:
        return []
def _pbg_report(_status, _out=None):
    try:
        _pbg_os.makedirs(_PBG_DIR, exist_ok=True)
        _rec = {
            "script": _PBG_SCRIPT,
            "nodo": _PBG_NODE,
            "key": _PBG_KEY,
            "status": _status,
            "timestamp": _pbg_dt.datetime.now().isoformat(timespec="seconds"),
            "out": _out,
            "warnings": _pbg_warnings() if _status == "ok" else [],
        }
        with open(_pbg_os.path.join(_PBG_DIR, _PBG_KEY + ".json"), "w", encoding="utf-8") as _f:
            _pbg_json.dump(_rec, _f, ensure_ascii=False, indent=2, default=str)
    except Exception:
        pass
_pbg_report("started")
# --- fin auto-reporte (inicio) ---

import clr
clr.AddReference("RevitAPI")
from Autodesk.Revit.DB import (
    ViewPlan, ViewSheet, FamilySymbol, FamilyInstance,
    FilteredElementCollector, BuiltInCategory,
    Transaction, TextNote, TextNoteOptions, TextNoteType,
    XYZ, UV, UnitUtils, UnitTypeId, ElementId,
)
from Autodesk.Revit.DB.Structure import StructuralType as ST
clr.AddReference("RevitServices")
from RevitServices.Persistence import DocumentManager

doc = DocumentManager.Instance.CurrentDBDocument

frente_m  = _fi(IN[0])
fondo_m   = _fi(IN[1])
pisos_tipo = _ii(IN[2])

def m_to_ft(m):
    return UnitUtils.ConvertToInternalUnits(m, UnitTypeId.Meters)

def get_planta_pb():
    todas = FilteredElementCollector(doc).OfClass(ViewPlan).ToElements()
    return next((v for v in todas if "PLANTA PB" in v.Name and not v.IsTemplate), None)

def get_sheet(numero):
    sheets = FilteredElementCollector(doc).OfClass(ViewSheet).ToElements()
    return next((s for s in sheets if s.SheetNumber == numero), None)

resultado = []
vista_pb  = get_planta_pb()

with Transaction(doc, "py-building-gen: Norte y cuadro superficies") as t:
    t.Start()

    # ── Símbolo de Norte ───────────────────────────────────────────────────
    # Buscar familia "North Arrow" o "Flecha Norte" en anotaciones genéricas
    north_col = (FilteredElementCollector(doc)
                 .OfClass(FamilySymbol)
                 .OfCategory(BuiltInCategory.OST_GenericAnnotation)
                 .ToElements())
    _kw_norte = ("north","norte","arrow","flecha","nort")
    north_sym = next((s for s in north_col
                      if any(k in s.FamilyName.lower() for k in _kw_norte)), None)

    if north_sym and vista_pb:
        if not north_sym.IsActive:
            north_sym.Activate()
        # Colocar en el ángulo superior izquierdo de la planta.
        # Símbolo de anotación 2D → overload NewFamilyInstance(XYZ, FamilySymbol, View).
        pt_norte = XYZ(m_to_ft(-2.0), m_to_ft(fondo_m + 1.5), 0)
        inst = doc.Create.NewFamilyInstance(pt_norte, north_sym, vista_pb)
        resultado.append({"tipo": "norte", "id": inst.Id.Value})
    else:
        resultado.append({"tipo": "norte", "status": "familia no encontrada en template"})

    # ── Cuadro de superficies (TextNote en hoja A-01) ────────────────────
    sheet_a01 = get_sheet("A-01")
    if sheet_a01 and vista_pb:
        # Calcular superficies
        ESC_ANCHO = 3.00; ESC_FONDO = 5.50; ASC_ANCHO = 2.00; PASILLO = 1.20
        ancho_nuc = 1 * ESC_ANCHO + 1 * ASC_ANCHO   # default: 1 esc + 1 asc
        y_nuc   = fondo_m - ESC_FONDO
        y_pas   = y_nuc - PASILLO
        sup_planta = frente_m * fondo_m
        sup_util   = frente_m * y_pas   # área de departamentos
        sup_circ   = frente_m * (fondo_m - y_pas)  # pasillo + shaft

        lineas = [
            f"CUADRO DE SUPERFICIES",
            f"Lote:                {frente_m:.2f} x {fondo_m:.2f} = {sup_planta:.1f} m²",
            f"Sup. útil/piso tipo: {sup_util:.1f} m²",
            f"Sup. circulación:    {sup_circ:.1f} m²",
            f"Pisos tipo:          {pisos_tipo}",
            f"Sup. total construida: {sup_planta * (pisos_tipo + 2):.1f} m²",
        ]
        texto = "\n".join(lineas)

        try:
            # TextNote.Create requiere un TextNoteType válido (no InvalidElementId)
            tnt = FilteredElementCollector(doc).OfClass(TextNoteType).FirstElement()
            tnt_id = tnt.Id if tnt else ElementId.InvalidElementId
            tnOpts = TextNoteOptions(tnt_id)
            # Colocar en la esquina inferior derecha de la hoja (en coordenadas de hoja)
            pt_txt = XYZ(m_to_ft(0.300), m_to_ft(0.035), 0)
            tn = TextNote.Create(doc, sheet_a01.Id, pt_txt, texto, tnOpts)
            resultado.append({"tipo": "cuadro_superficies", "id": tn.Id.Value})
        except Exception as e:
            resultado.append({"tipo": "cuadro_superficies", "error": str(e)})

    t.Commit()

OUT = {"resultado": resultado}


# --- py-building-gen: auto-reporte (cierre) ---
try:
    _pbg_report("ok", _out=globals().get("OUT", None))
except Exception:
    pass
# ----------------------------------------
