# Dynamo graph 09b_anotaciones.dyn (Dynamo 4.0.0.0)
# Coloca room tags con área, tags de puertas/ventanas y dimensiones generales. Ejecutar después de 09_sheets, 11_habitaciones y 05_aberturas.

pisos_tipo = CodeBlock { 6; }
room_tags = Python(IN[0]=pisos_tipo)  # PythonNet3
# ---------- room_tags.python (129 lines) ----------
def _fi(v, d=0.0): return float(v) if v is not None else float(d)
def _ii(v, d=0):   return int(v)   if v is not None else int(d)
def _si(v, d=""):  return str(v)   if v is not None else str(d)
# --- py-building-gen: auto-reporte (inicio) ---
import os as _pbg_os, json as _pbg_json, datetime as _pbg_dt
_PBG_DIR = 'C:\\Users\\feder\\OneDrive\\Escritorio\\py-building-gen\\output\\dynamo\\edificio_caballito_int\\_reports'
_PBG_SCRIPT = '09b_anotaciones'
_PBG_NODE = 'Room Tags'
_PBG_KEY = '09b_anotaciones__00_room_tags'
def _pbg_warnings():
    try:
        _d = globals().get("doc", None)
        if _d is None:
            return []
        return [w.GetDescriptionText() for w in _d.GetWarnings()]
    except Exception:
        return []
def _pbg_report(_status, _out=None):
    try:
        _pbg_os.makedirs(_PBG_DIR, exist_ok=True)
        _rec = {
            "script": _PBG_SCRIPT,
            "nodo": _PBG_NODE,
            "key": _PBG_KEY,
            "status": _status,
            "timestamp": _pbg_dt.datetime.now().isoformat(timespec="seconds"),
            "out": _out,
            "warnings": _pbg_warnings() if _status == "ok" else [],
        }
        with open(_pbg_os.path.join(_PBG_DIR, _PBG_KEY + ".json"), "w", encoding="utf-8") as _f:
            _pbg_json.dump(_rec, _f, ensure_ascii=False, indent=2, default=str)
    except Exception:
        pass
_pbg_report("started")
# --- fin auto-reporte (inicio) ---

import clr
clr.AddReference("RevitAPI")
from Autodesk.Revit.DB import (
    ViewPlan, ViewFamily, ViewFamilyType, Level,
    FilteredElementCollector, BuiltInCategory,
    IndependentTag, TagMode, TagOrientation, Reference,
    Transaction, XYZ, UV, UnitUtils, UnitTypeId,
    FamilySymbol,
)
from Autodesk.Revit.DB.Architecture import Room
clr.AddReference("RevitServices")
from RevitServices.Persistence import DocumentManager

doc = DocumentManager.Instance.CurrentDBDocument

pisos_tipo = _ii(IN[0])

def m_to_ft(m):
    return UnitUtils.ConvertToInternalUnits(m, UnitTypeId.Meters)

def ft_to_m(ft):
    return UnitUtils.ConvertFromInternalUnits(ft, UnitTypeId.Meters)

def get_planta_tipo(nombre_nivel):
    """Busca la vista PLANTA del nivel dado."""
    todas = FilteredElementCollector(doc).OfClass(ViewPlan).ToElements()
    return next((v for v in todas if f"PLANTA {nombre_nivel}" in v.Name
                 and not v.IsTemplate), None)

def get_room_tag_type():
    col = (FilteredElementCollector(doc)
           .OfClass(FamilySymbol)
           .OfCategory(BuiltInCategory.OST_RoomTags)
           .ToElements())
    # Preferir tag con área si existe
    match = next((s for s in col if "area" in s.FamilyName.lower()
                  or "área" in s.FamilyName.lower()), None)
    return match or (col[0] if col else None)

def get_rooms_en_nivel(nivel_nombre):
    rooms = FilteredElementCollector(doc).OfClass(Room).ToElements()
    return [r for r in rooms if r.Level and r.Level.Name == nivel_nombre
            and r.Area > 0.01]

tag_type = get_room_tag_type()
tags_creados = []

with Transaction(doc, "py-building-gen: Room Tags") as t:
    t.Start()

    if tag_type and not tag_type.IsActive:
        tag_type.Activate()

    # Tags en PLANTA P01 (representativa del piso tipo)
    for nivel_nombre in [f"P{i:02d}" for i in range(1, pisos_tipo + 1)]:
        vista = get_planta_tipo(nivel_nombre)
        if vista is None:
            continue
        rooms = get_rooms_en_nivel(nivel_nombre)
        for room in rooms:
            try:
                loc = room.Location
                if loc is None:
                    continue
                pt = loc.Point
                tag = IndependentTag.Create(
                    doc, vista.Id,
                    Reference(room),
                    False,
                    TagMode.TM_ADDBY_ELEMENT,
                    TagOrientation.Horizontal,
                    XYZ(pt.X, pt.Y, 0),
                )
                if tag_type:
                    tag.ChangeTypeId(tag_type.Id)
                tags_creados.append({
                    "nivel": nivel_nombre,
                    "room": room.Name,
                    "id": tag.Id.Value,
                })
            except Exception as e:
                tags_creados.append({"nivel": nivel_nombre, "error": str(e)})

    t.Commit()

OUT = {"total_tags": len(tags_creados), "detalle": tags_creados}


# --- py-building-gen: auto-reporte (cierre) ---
try:
    _pbg_report("ok", _out=globals().get("OUT", None))
except Exception:
    pass
# ----------------------------------------
frente_m = CodeBlock { 10.0; }
fondo_m = CodeBlock { 24.0; }
dimensiones = Python(IN[0]=frente_m, IN[1]=fondo_m)  # PythonNet3
# ---------- dimensiones.python (132 lines) ----------
def _fi(v, d=0.0): return float(v) if v is not None else float(d)
def _ii(v, d=0):   return int(v)   if v is not None else int(d)
def _si(v, d=""):  return str(v)   if v is not None else str(d)
# --- py-building-gen: auto-reporte (inicio) ---
import os as _pbg_os, json as _pbg_json, datetime as _pbg_dt
_PBG_DIR = 'C:\\Users\\feder\\OneDrive\\Escritorio\\py-building-gen\\output\\dynamo\\edificio_caballito_int\\_reports'
_PBG_SCRIPT = '09b_anotaciones'
_PBG_NODE = 'Dimensiones'
_PBG_KEY = '09b_anotaciones__01_dimensiones'
def _pbg_warnings():
    try:
        _d = globals().get("doc", None)
        if _d is None:
            return []
        return [w.GetDescriptionText() for w in _d.GetWarnings()]
    except Exception:
        return []
def _pbg_report(_status, _out=None):
    try:
        _pbg_os.makedirs(_PBG_DIR, exist_ok=True)
        _rec = {
            "script": _PBG_SCRIPT,
            "nodo": _PBG_NODE,
            "key": _PBG_KEY,
            "status": _status,
            "timestamp": _pbg_dt.datetime.now().isoformat(timespec="seconds"),
            "out": _out,
            "warnings": _pbg_warnings() if _status == "ok" else [],
        }
        with open(_pbg_os.path.join(_PBG_DIR, _PBG_KEY + ".json"), "w", encoding="utf-8") as _f:
            _pbg_json.dump(_rec, _f, ensure_ascii=False, indent=2, default=str)
    except Exception:
        pass
_pbg_report("started")
# --- fin auto-reporte (inicio) ---

import clr
clr.AddReference("RevitAPI")
from Autodesk.Revit.DB import (
    ViewPlan, ViewSection, Wall, Level, Line, XYZ,
    ReferenceArray, FilteredElementCollector,
    Transaction, UnitUtils, UnitTypeId,
)
clr.AddReference("RevitServices")
from RevitServices.Persistence import DocumentManager

doc = DocumentManager.Instance.CurrentDBDocument

frente_m = _fi(IN[0])
fondo_m  = _fi(IN[1])

def m_to_ft(m):
    return UnitUtils.ConvertToInternalUnits(m, UnitTypeId.Meters)

def ft_to_m(ft):
    return UnitUtils.ConvertFromInternalUnits(ft, UnitTypeId.Meters)

def get_planta_pb():
    todas = FilteredElementCollector(doc).OfClass(ViewPlan).ToElements()
    return next((v for v in todas if "PLANTA PB" in v.Name and not v.IsTemplate), None)

def get_walls_at_y(target_y, tol=0.40):
    walls = FilteredElementCollector(doc).OfClass(Wall).ToElements()
    result = []
    for w in walls:
        loc = w.Location
        if not hasattr(loc, "Curve"):
            continue
        c = loc.Curve
        y1 = ft_to_m(c.GetEndPoint(0).Y)
        y2 = ft_to_m(c.GetEndPoint(1).Y)
        if abs(y1 - target_y) < tol and abs(y2 - target_y) < tol:
            result.append(w)
    return result

def get_walls_at_x(target_x, tol=0.30):
    walls = FilteredElementCollector(doc).OfClass(Wall).ToElements()
    result = []
    for w in walls:
        loc = w.Location
        if not hasattr(loc, "Curve"):
            continue
        c = loc.Curve
        x1 = ft_to_m(c.GetEndPoint(0).X)
        x2 = ft_to_m(c.GetEndPoint(1).X)
        if abs(x1 - target_x) < tol and abs(x2 - target_x) < tol:
            result.append(w)
    return result

dims_creadas = []
vista_pb = get_planta_pb()

if vista_pb:
    with Transaction(doc, "py-building-gen: Dimensiones") as t:
        t.Start()

        # Dimensión frente (a lo largo de X, debajo del edificio).
        # Se toma un endpoint de referencia de cada muro lateral (x=0 y x=frente);
        # la distancia entre ambos es el frente del edificio.
        walls_izq = get_walls_at_x(0.0)
        walls_der = get_walls_at_x(frente_m)
        refs = ReferenceArray()
        for ww in walls_izq[:1] + walls_der[:1]:
            loc = ww.Location
            if hasattr(loc, "Curve"):
                refs.Append(loc.Curve.GetEndPointReference(0))

        if refs.Size >= 2:
            dim_line = Line.CreateBound(
                XYZ(m_to_ft(0), m_to_ft(-2.0), 0),
                XYZ(m_to_ft(frente_m), m_to_ft(-2.0), 0)
            )
            try:
                dim = doc.Create.NewDimension(vista_pb, dim_line, refs)
                dims_creadas.append({"tipo": "frente", "id": dim.Id.Value})
            except Exception as e:
                dims_creadas.append({"tipo": "frente_error", "error": str(e)})
        else:
            dims_creadas.append({"tipo": "frente", "status": "muros laterales no encontrados"})

        t.Commit()
else:
    dims_creadas.append({"error": "Vista PLANTA PB no encontrada. Correr 08_vistas primero."})

OUT = {"total": len(dims_creadas), "detalle": dims_creadas}


# --- py-building-gen: auto-reporte (cierre) ---
try:
    _pbg_report("ok", _out=globals().get("OUT", None))
except Exception:
    pass
# ----------------------------------------
pisos_tipo_2 = CodeBlock { 6; }
tags_aberturas = Python(IN[0]=pisos_tipo_2)  # PythonNet3
# ---------- tags_aberturas.python (124 lines) ----------
def _fi(v, d=0.0): return float(v) if v is not None else float(d)
def _ii(v, d=0):   return int(v)   if v is not None else int(d)
def _si(v, d=""):  return str(v)   if v is not None else str(d)
# --- py-building-gen: auto-reporte (inicio) ---
import os as _pbg_os, json as _pbg_json, datetime as _pbg_dt
_PBG_DIR = 'C:\\Users\\feder\\OneDrive\\Escritorio\\py-building-gen\\output\\dynamo\\edificio_caballito_int\\_reports'
_PBG_SCRIPT = '09b_anotaciones'
_PBG_NODE = 'Tags Aberturas'
_PBG_KEY = '09b_anotaciones__02_tags_aberturas'
def _pbg_warnings():
    try:
        _d = globals().get("doc", None)
        if _d is None:
            return []
        return [w.GetDescriptionText() for w in _d.GetWarnings()]
    except Exception:
        return []
def _pbg_report(_status, _out=None):
    try:
        _pbg_os.makedirs(_PBG_DIR, exist_ok=True)
        _rec = {
            "script": _PBG_SCRIPT,
            "nodo": _PBG_NODE,
            "key": _PBG_KEY,
            "status": _status,
            "timestamp": _pbg_dt.datetime.now().isoformat(timespec="seconds"),
            "out": _out,
            "warnings": _pbg_warnings() if _status == "ok" else [],
        }
        with open(_pbg_os.path.join(_PBG_DIR, _PBG_KEY + ".json"), "w", encoding="utf-8") as _f:
            _pbg_json.dump(_rec, _f, ensure_ascii=False, indent=2, default=str)
    except Exception:
        pass
_pbg_report("started")
# --- fin auto-reporte (inicio) ---

import clr
clr.AddReference("RevitAPI")
from Autodesk.Revit.DB import (
    ViewPlan, FamilyInstance, FamilySymbol, BuiltInCategory,
    FilteredElementCollector, IndependentTag, TagMode, TagOrientation,
    Reference, Transaction, XYZ, UV, UnitUtils, UnitTypeId,
)
clr.AddReference("RevitServices")
from RevitServices.Persistence import DocumentManager

doc = DocumentManager.Instance.CurrentDBDocument

pisos_tipo = _ii(IN[0])

def get_planta(nombre):
    todas = FilteredElementCollector(doc).OfClass(ViewPlan).ToElements()
    return next((v for v in todas if f"PLANTA {nombre}" in v.Name and not v.IsTemplate), None)

def get_tag_type(categoria):
    col = (FilteredElementCollector(doc)
           .OfClass(FamilySymbol)
           .OfCategory(categoria)
           .ToElements())
    return col[0] if col else None

def get_instances(categoria, level_id):
    return [e for e in FilteredElementCollector(doc)
            .OfClass(FamilyInstance)
            .OfCategory(categoria)
            .ToElements()
            if e.LevelId == level_id]

tags_creados = []

tag_puerta  = get_tag_type(BuiltInCategory.OST_DoorTags)
tag_ventana = get_tag_type(BuiltInCategory.OST_WindowTags)

with Transaction(doc, "py-building-gen: Tags puertas y ventanas") as t:
    t.Start()

    for sym in [tag_puerta, tag_ventana]:
        if sym and not sym.IsActive:
            sym.Activate()

    # Solo etiquetar P01 (representativo — el resto es idéntico)
    from Autodesk.Revit.DB import Level
    levels = FilteredElementCollector(doc).OfClass(Level).ToElements()
    lvl_p01 = next((l for l in levels if l.Name == "P01"), None)
    if lvl_p01 is None:
        lvl_p01 = next((l for l in levels if l.Name.startswith("P") and l.Name[1:].isdigit()), None)

    if lvl_p01:
        vista = get_planta(lvl_p01.Name)
        if vista:
            for categoria, tag_type in [
                (BuiltInCategory.OST_Doors,   tag_puerta),
                (BuiltInCategory.OST_Windows, tag_ventana),
            ]:
                if tag_type is None:
                    continue
                for inst in get_instances(categoria, lvl_p01.Id):
                    try:
                        loc = inst.Location
                        if not hasattr(loc, "Point"):
                            continue
                        pt = loc.Point
                        tag = IndependentTag.Create(
                            doc, vista.Id,
                            Reference(inst), False,
                            TagMode.TM_ADDBY_ELEMENT,
                            TagOrientation.Horizontal,
                            XYZ(pt.X, pt.Y, 0),
                        )
                        tag.ChangeTypeId(tag_type.Id)
                        tags_creados.append({"tipo": categoria.ToString(), "id": tag.Id.Value})
                    except Exception:
                        pass

    t.Commit()

OUT = {"total": len(tags_creados), "tags": tags_creados}


# --- py-building-gen: auto-reporte (cierre) ---
try:
    _pbg_report("ok", _out=globals().get("OUT", None))
except Exception:
    pass
# ----------------------------------------
