# Dynamo graph 10_schedules.dyn (Dynamo 4.0.0.0)
# Crea tablas de cómputo (áreas, puertas, ventanas, estructura) para documentación y presupuesto.

pisos_tipo = CodeBlock { 6; }
crear_schedules = Python(IN[0]=pisos_tipo)  # PythonNet3
# ---------- crear_schedules.python (151 lines) ----------
def _fi(v, d=0.0): return float(v) if v is not None else float(d)
def _ii(v, d=0):   return int(v)   if v is not None else int(d)
def _si(v, d=""):  return str(v)   if v is not None else str(d)
# --- py-building-gen: auto-reporte (inicio) ---
import os as _pbg_os, json as _pbg_json, datetime as _pbg_dt
_PBG_DIR = 'C:\\Users\\feder\\OneDrive\\Escritorio\\py-building-gen\\output\\dynamo\\edificio_caballito_int\\_reports'
_PBG_SCRIPT = '10_schedules'
_PBG_NODE = 'Crear Schedules'
_PBG_KEY = '10_schedules__00_crear_schedules'
def _pbg_warnings():
    try:
        _d = globals().get("doc", None)
        if _d is None:
            return []
        return [w.GetDescriptionText() for w in _d.GetWarnings()]
    except Exception:
        return []
def _pbg_report(_status, _out=None):
    try:
        _pbg_os.makedirs(_PBG_DIR, exist_ok=True)
        _rec = {
            "script": _PBG_SCRIPT,
            "nodo": _PBG_NODE,
            "key": _PBG_KEY,
            "status": _status,
            "timestamp": _pbg_dt.datetime.now().isoformat(timespec="seconds"),
            "out": _out,
            "warnings": _pbg_warnings() if _status == "ok" else [],
        }
        with open(_pbg_os.path.join(_PBG_DIR, _PBG_KEY + ".json"), "w", encoding="utf-8") as _f:
            _pbg_json.dump(_rec, _f, ensure_ascii=False, indent=2, default=str)
    except Exception:
        pass
_pbg_report("started")
# --- fin auto-reporte (inicio) ---

import clr
clr.AddReference("RevitAPI")
from Autodesk.Revit.DB import (
    ViewSchedule, SchedulableField, ScheduleFieldType,
    BuiltInParameter, FilteredElementCollector,
    BuiltInCategory, ScheduleSortGroupField,
    Transaction, ElementId,
)
clr.AddReference("RevitServices")
from RevitServices.Persistence import DocumentManager

doc = DocumentManager.Instance.CurrentDBDocument

pisos_tipo = _ii(IN[0])

def crear_schedule(nombre, cat_id_int):
    try:
        sch = ViewSchedule.CreateSchedule(doc, ElementId(cat_id_int))
        sch.Name = nombre
        return sch
    except Exception:
        return None

def agregar_campos(sch, bip_list):
    """Agrega campos BuiltInParameter al schedule si están disponibles."""
    sched_def = sch.Definition
    campos_disponibles = {f.ParameterId: f for f in sched_def.GetSchedulableFields()}
    for bip in bip_list:
        fid = ElementId(int(bip))
        if fid in campos_disponibles:
            try:
                sched_def.AddField(campos_disponibles[fid])
            except Exception:
                pass

schedules_creados = []

# Campos por categoría (BuiltInParameter)
CAMPOS = {
    int(BuiltInCategory.OST_Rooms): [
        BuiltInParameter.ROOM_NAME,
        BuiltInParameter.ROOM_NUMBER,
        BuiltInParameter.LEVEL_NAME,
        BuiltInParameter.ROOM_AREA,
        BuiltInParameter.ROOM_PERIMETER,
    ],
    int(BuiltInCategory.OST_Doors): [
        BuiltInParameter.ALL_MODEL_MARK,
        BuiltInParameter.ELEM_FAMILY_AND_TYPE_PARAM,
        BuiltInParameter.LEVEL_PARAM,
        BuiltInParameter.DOOR_WIDTH,
        BuiltInParameter.DOOR_HEIGHT,
    ],
    int(BuiltInCategory.OST_Windows): [
        BuiltInParameter.ALL_MODEL_MARK,
        BuiltInParameter.ELEM_FAMILY_AND_TYPE_PARAM,
        BuiltInParameter.LEVEL_PARAM,
        BuiltInParameter.WINDOW_WIDTH,
        BuiltInParameter.WINDOW_HEIGHT,
    ],
    int(BuiltInCategory.OST_Walls): [
        BuiltInParameter.ALL_MODEL_MARK,
        BuiltInParameter.ELEM_FAMILY_AND_TYPE_PARAM,
        BuiltInParameter.WALL_BASE_CONSTRAINT,
        BuiltInParameter.HOST_AREA_COMPUTED,
        BuiltInParameter.CURVE_ELEM_LENGTH,
    ],
    int(BuiltInCategory.OST_Floors): [
        BuiltInParameter.ELEM_FAMILY_AND_TYPE_PARAM,
        BuiltInParameter.LEVEL_PARAM,
        BuiltInParameter.HOST_AREA_COMPUTED,
        BuiltInParameter.FLOOR_HEIGHTABOVELEVEL_PARAM,
    ],
    int(BuiltInCategory.OST_StructuralColumns): [
        BuiltInParameter.ALL_MODEL_MARK,
        BuiltInParameter.ELEM_FAMILY_AND_TYPE_PARAM,
        BuiltInParameter.SCHEDULE_BASE_LEVEL_PARAM,
        BuiltInParameter.FAMILY_HEIGHT_PARAM,
    ],
    int(BuiltInCategory.OST_StructuralFraming): [
        BuiltInParameter.ALL_MODEL_MARK,
        BuiltInParameter.ELEM_FAMILY_AND_TYPE_PARAM,
        BuiltInParameter.STRUCTURAL_BEAM_END0_ELEVATION,
        BuiltInParameter.CURVE_ELEM_LENGTH,
    ],
}

config = [
    ("CÓMPUTO - LOCALES Y ÁREAS",   int(BuiltInCategory.OST_Rooms)),
    ("CÓMPUTO - PUERTAS",           int(BuiltInCategory.OST_Doors)),
    ("CÓMPUTO - VENTANAS",          int(BuiltInCategory.OST_Windows)),
    ("CÓMPUTO - MUROS",             int(BuiltInCategory.OST_Walls)),
    ("CÓMPUTO - LOSAS",             int(BuiltInCategory.OST_Floors)),
    ("CÓMPUTO - COLUMNAS",          int(BuiltInCategory.OST_StructuralColumns)),
    ("CÓMPUTO - VIGAS",             int(BuiltInCategory.OST_StructuralFraming)),
]

with Transaction(doc, "py-building-gen: Schedules v2") as t:
    t.Start()
    for nombre, cat_id in config:
        sch = crear_schedule(nombre, cat_id)
        if sch:
            campos_bip = CAMPOS.get(cat_id, [])
            agregar_campos(sch, campos_bip)
            schedules_creados.append({"nombre": nombre, "id": sch.Id.Value})
    t.Commit()

OUT = {"total": len(schedules_creados), "schedules": schedules_creados}


# --- py-building-gen: auto-reporte (cierre) ---
try:
    _pbg_report("ok", _out=globals().get("OUT", None))
except Exception:
    pass
# ----------------------------------------
