# Dynamo graph 11_habitaciones.dyn (Dynamo 4.0.0.0)
# Crea Room objects en Revit para cada local de cada departamento. Ejecutar después de 02_muros y 01_niveles.

frente_m = CodeBlock { 10.0; }
fondo_m = CodeBlock { 24.0; }
pisos_tipo = CodeBlock { 6; }
cant_depto_tipo = CodeBlock { 2; }
tipologias = CodeBlock { "2amb:1,3amb:1"; }
cant_escaleras = CodeBlock { 1; }
cant_ascensores = CodeBlock { 1; }
crear_rooms = Python(IN[0]=frente_m, IN[1]=fondo_m, IN[2]=pisos_tipo, IN[3]=cant_depto_tipo, IN[4]=tipologias, IN[5]=cant_escaleras, IN[6]=cant_ascensores)  # PythonNet3
# ---------- crear_rooms.python (185 lines) ----------
def _fi(v, d=0.0): return float(v) if v is not None else float(d)
def _ii(v, d=0):   return int(v)   if v is not None else int(d)
def _si(v, d=""):  return str(v)   if v is not None else str(d)
# --- py-building-gen: auto-reporte (inicio) ---
import os as _pbg_os, json as _pbg_json, datetime as _pbg_dt
_PBG_DIR = 'C:\\Users\\feder\\OneDrive\\Escritorio\\py-building-gen\\output\\dynamo\\edificio_caballito_int\\_reports'
_PBG_SCRIPT = '11_habitaciones'
_PBG_NODE = 'Crear Rooms'
_PBG_KEY = '11_habitaciones__00_crear_rooms'
def _pbg_warnings():
    try:
        _d = globals().get("doc", None)
        if _d is None:
            return []
        return [w.GetDescriptionText() for w in _d.GetWarnings()]
    except Exception:
        return []
def _pbg_report(_status, _out=None):
    try:
        _pbg_os.makedirs(_PBG_DIR, exist_ok=True)
        _rec = {
            "script": _PBG_SCRIPT,
            "nodo": _PBG_NODE,
            "key": _PBG_KEY,
            "status": _status,
            "timestamp": _pbg_dt.datetime.now().isoformat(timespec="seconds"),
            "out": _out,
            "warnings": _pbg_warnings() if _status == "ok" else [],
        }
        with open(_pbg_os.path.join(_PBG_DIR, _PBG_KEY + ".json"), "w", encoding="utf-8") as _f:
            _pbg_json.dump(_rec, _f, ensure_ascii=False, indent=2, default=str)
    except Exception:
        pass
_pbg_report("started")
# --- fin auto-reporte (inicio) ---

import clr
import json
clr.AddReference("RevitAPI")
from Autodesk.Revit.DB import (
    Level, UV, FilteredElementCollector, Transaction,
    UnitUtils, UnitTypeId,
)
from Autodesk.Revit.DB.Architecture import Room
clr.AddReference("RevitServices")
from RevitServices.Persistence import DocumentManager

doc = DocumentManager.Instance.CurrentDBDocument

frente_m        = _fi(IN[0])
fondo_m         = _fi(IN[1])
pisos_tipo      = _ii(IN[2])
cant_depto_tipo = _ii(IN[3])
tipologias_str  = _si(IN[4])   # "2amb:1,3amb:1" (quote-free para Code Block)
cant_escaleras  = _ii(IN[5])
cant_ascensores = _ii(IN[6])

apts = []
for _par in tipologias_str.split(","):
    _par = _par.strip()
    if not _par:
        continue
    _tipo, _, _cant = _par.partition(":")
    _tipo = _tipo.strip() or "2amb"
    try:
        _n = int(_cant)
    except Exception:
        _n = 1
    for _ in range(_n):
        apts.append(_tipo)

# ── Layout geometry (identical constants to Scripts 02 y 05) ─────────────────
ESC_ANCHO = 3.00; ESC_FONDO = 5.50; ASC_ANCHO = 2.00; PASILLO_PROF = 1.20
_n_apts      = max(cant_depto_tipo, 1)
ancho_nucleo = cant_escaleras * ESC_ANCHO + cant_ascensores * ASC_ANCHO
y_nucleo     = fondo_m - ESC_FONDO
y_pasillo    = y_nucleo - PASILLO_PROF
apt_ancho    = frente_m / _n_apts

_PROP_LIVING = {"1amb":0.00,"estudio":0.00,"2amb":0.40,"3amb":0.38,"4amb":0.35,"duplex":0.35}
_PROP_SERV   = {"1amb":0.65,"estudio":0.70,"2amb":0.70,"3amb":0.68,"4amb":0.65,"duplex":0.65}
_NOMBRES = {
    "living":    "Living-Comedor",
    "dorm_p":    "Dormitorio Principal",
    "dorm":      "Dormitorio",
    "dorm1":     "Dormitorio 1",
    "dorm2":     "Dormitorio 2",
    "dorm3":     "Dormitorio 3",
    "living_d":  "Living-Dormitorio",
    "cocina":    "Cocina",
    "bano":      "Baño",
    "bano1":     "Baño 1",
    "bano2":     "Baño 2",
    "pasillo":   "Pasillo",
}

def m_to_ft(m):
    return UnitUtils.ConvertToInternalUnits(m, UnitTypeId.Meters)

def get_level(nombre):
    levels = FilteredElementCollector(doc).OfClass(Level).ToElements()
    return next((l for l in levels if l.Name == nombre), None)

def zonas_apt(apt_idx, tipo):
    """Retorna lista de (nombre, x_centroid, y_centroid) para cada zona del depto."""
    x0 = apt_ancho * apt_idx
    x1 = x0 + apt_ancho
    pct_l = _PROP_LIVING.get(tipo, 0.40)
    pct_s = _PROP_SERV.get(tipo, 0.70)
    y_l   = y_pasillo * pct_l
    y_s   = y_pasillo * pct_s

    cx = (x0 + x1) / 2       # centro X del depto
    xcoc = x0 + apt_ancho * 0.55 / 2        # centro X cocina
    xban = x0 + apt_ancho * 0.55 + apt_ancho * 0.45 / 2  # centro X baño

    zonas = []

    if tipo in ("1amb", "estudio"):
        zonas.append((_NOMBRES["living_d"], cx, y_s / 2))
        zonas.append((_NOMBRES["cocina"],   xcoc, y_s + (y_pasillo - y_s) / 2))
        zonas.append((_NOMBRES["bano"],     xban, y_s + (y_pasillo - y_s) / 2))

    elif tipo == "2amb":
        zonas.append((_NOMBRES["living"],  cx, y_l / 2))
        zonas.append((_NOMBRES["dorm_p"],  cx, y_l + (y_s - y_l) / 2))
        zonas.append((_NOMBRES["cocina"],  xcoc, y_s + (y_pasillo - y_s) / 2))
        zonas.append((_NOMBRES["bano"],    xban, y_s + (y_pasillo - y_s) / 2))

    elif tipo == "3amb":
        x_mid = x0 + apt_ancho * 0.50
        zonas.append((_NOMBRES["living"],  cx, y_l / 2))
        zonas.append((_NOMBRES["dorm1"],   (x0 + x_mid) / 2,  y_l + (y_s - y_l) / 2))
        zonas.append((_NOMBRES["dorm2"],   (x_mid + x1) / 2,  y_l + (y_s - y_l) / 2))
        zonas.append((_NOMBRES["cocina"],  xcoc, y_s + (y_pasillo - y_s) / 2))
        zonas.append((_NOMBRES["bano1"],   xban, y_s + (y_pasillo - y_s) / 2))

    elif tipo in ("4amb", "duplex"):
        x_13 = x0 + apt_ancho * 0.33
        x_23 = x0 + apt_ancho * 0.67
        zonas.append((_NOMBRES["living"],  cx, y_l / 2))
        zonas.append((_NOMBRES["dorm_p"],  (x0 + x_13) / 2,  y_l + (y_s - y_l) / 2))
        zonas.append((_NOMBRES["dorm1"],   (x_13 + x_23) / 2, y_l + (y_s - y_l) / 2))
        zonas.append((_NOMBRES["dorm2"],   (x_23 + x1) / 2,  y_l + (y_s - y_l) / 2))
        zonas.append((_NOMBRES["cocina"],  xcoc, y_s + (y_pasillo - y_s) / 2))
        zonas.append((_NOMBRES["bano1"],   xban, y_s + (y_pasillo - y_s) / 2))

    return zonas

rooms_creados = []

with Transaction(doc, "py-building-gen: Rooms") as t:
    t.Start()
    for i_piso in range(1, pisos_tipo + 1):
        nombre_nivel = f"P{i_piso:02d}"
        lvl = get_level(nombre_nivel)
        if lvl is None:
            continue
        for apt_idx in range(_n_apts):
            tipo = apts[apt_idx] if apt_idx < len(apts) else "2amb"
            letra_depto = chr(ord("A") + apt_idx)
            for i_zona, (nombre_zona, cx, cy) in enumerate(zonas_apt(apt_idx, tipo)):
                try:
                    room = doc.Create.NewRoom(lvl, UV(m_to_ft(cx), m_to_ft(cy)))
                    room.Name = nombre_zona
                    room.Number = f"{i_piso}{letra_depto}{i_zona+1:02d}"
                    rooms_creados.append({
                        "nivel": nombre_nivel,
                        "depto": letra_depto,
                        "nombre": nombre_zona,
                        "numero": room.Number,
                        "id": room.Id.Value,
                    })
                except Exception as e:
                    rooms_creados.append({"nivel": nombre_nivel, "error": str(e)})
    t.Commit()

OUT = {"total": len(rooms_creados), "rooms": rooms_creados}


# --- py-building-gen: auto-reporte (cierre) ---
try:
    _pbg_report("ok", _out=globals().get("OUT", None))
except Exception:
    pass
# ----------------------------------------
